# Grasshopper definition InnerFill_SurfaceManipulation.gh (Grasshopper 1.0.7)
# Copyright: 2020
# plug-ins: Mesh Pipe, Pufferfish

brep = Brep(<brep referenced from the Rhino model>)
fmerge = MergeFaces(Brep=brep)  # -> Breps, Before, After

# ---- group: Scan 1
brep_2 = Brep(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)

# ---- group: Scan 2
brep_3 = Brep(fmerge.Breps)

# ---- group: Choose the side face you want to edit
panel = Panel("121")

# ---- group: Join Inner and Outer Path / Layer Path
number_slider = Slider(23, range=0..33)

# ---- group: Meshing for Visualization
mpipe = MeshPipe(
    Radius=Slider(0.007, range=0..0.009),
    Accuracy=0.2,
    Rotation=0,
    Segments=Slider(20, range=0..100),
    Caps=Slider(0, range=0..10))

# ----
# Inner Fill Path
brep_4 = Brep(brep_2)
debrep = DeconstructBrep(Brep=brep_4)  # -> Faces, Edges, Vertices
area = Area(Geometry=debrep.Faces)  # -> Area, Centroid
points = PointList(Points=area.Centroid, Size=Slider(0.01, range=0..0.1))
bbox = BoundingBox(Content=brep_4, Plane=PlaneXY(0, 0, 0))  # -> Box, Box_2
debox = DeconstructBox(Box=bbox.Box)  # -> Plane, X, Y, Z
panel_2 = Panel("""True
False""")
item = ListItem(List=debox.Z, Index=Slider(1, range=0..1), Wrap=True)
entwine = Entwine(Branch00=panel_2, Branch01=reverse(panel_2), FlattenInputs=True)
num = Number(item)
Z = UnitZ(Factor=num)

# ---- group: Choose the Top Face
item_2 = ListItem(List=debrep.Faces, Index=Slider(119, range=0..1000), Wrap=True)

# ----
# Surface Manipulation - Optional
item_3 = ListItem(List=debrep.Faces, Index=panel, Wrap=True)
srf = Surface(item_3)
untrim = Untrim(Surface=srf)
number_slider_2 = Slider(12, range=0..100)
number_slider_3 = Slider(12, range=0..100)
srf_2 = Surface(untrim)
rebsrf = RebuildSurface(Surface=srf_2, CountU=number_slider_3, CountV=number_slider_3, DegreeU=number_slider_2, DegreeV=number_slider_2)
srfpt = SurfacePoints(Surface=rebsrf)  # -> Points, Weights, Greville, UCount, VCount

# ---- group: Move Point
moving_distance = Slider(0.02, range=-0.1..0.1)
p1_index = Slider(88, range=0..100)
Y = UnitY(Factor=moving_distance)
item_4 = ListItem(List=srfpt.Points, Index=p1_index, Wrap=True)
move = Move(Geometry=item_4, Motion=Y)  # -> Geometry, Transform

moving_distance_2 = Slider(-0.03, range=-0.1..0.1)
number_slider_4 = Slider(53, range=0..1000)
item_5 = ListItem(List=srfpt.Points, Index=number_slider_4, Wrap=True)
Y_2 = UnitY(Factor=moving_distance_2)
move_2 = Move(Geometry=item_5, Motion=Y_2)  # -> Geometry, Transform

# ----
edges = BrepEdges(Brep=item_2)  # -> Naked, Interior, NonManifold
join = JoinCurves(Curves=edges.Naked, Preserve=False)
simplify = SimplifyCurve(Curve=join)  # -> Curve, Simplified
explode = Explode(Curve=simplify.Curve, Recursive=True)  # -> Segments, Vertices
len = Length(Curve=explode.Segments)
sort = SortList(Keys=len, ValuesA=explode.Segments)  # -> Keys, ValuesA

# ---- group: Choose the Edges of the L Shape Top View
item_6 = ListItem(List=sort.ValuesA, Index=0, Wrap=True)  # -> Item4, Item3, Item2, Item1, Item

# ----
join_2 = JoinCurves(Curves=[item_6.Item4, item_6.Item2], Preserve=False)
join_3 = JoinCurves(Curves=[item_6.Item3, item_6.Item1], Preserve=False)
flip = FlipCurve(Curve=join_3)  # -> Curve, Flag
merge = Merge(Data1=join_2, Data2=flip.Curve)
divide = DivideCurve(Curve=merge, Count=Slider(15, range=0..100), Kinks=False)  # -> Points, Tangents, Parameters
cull = CullPattern(List=divide.Points, CullPattern=entwine)
flip_2 = FlipMatrix(Data=cull)
pshift = SmartPathShift(data_tree=flip_2)
pline = PolyLine(Vertices=pshift, Closed=False)
extr = Extrude(Base=pline, Direction=expr("-x", Z))
disc = Discontinuity(Curve=pline, Level=1)  # -> Points, Parameters
split = SplitBrep(Brep=extr, Cutter=brep_4)
intcrv = Interpolate(Vertices=disc.Points, Degree=3, Periodic=False, KnotStyle=1)  # -> Curve, Length, Domain
item_7 = ListItem(List=split, Index=Slider(1, range=0..11), Wrap=True)
cull_i = CullIndex(List=split, Indices="1", Wrap=True)
join_4 = BrepJoin(Breps=cull_i)  # -> Breps, Closed

replace = ReplaceItems(List=srfpt.Points, Item=[move.Geometry, move_2.Geometry], Indices=[p1_index, number_slider_4], Wrap=False)

srfgrid = SurfaceFromPoints(Points=replace, UCount=srfpt.UCount, Interpolate=False)
edges_2 = BrepEdges(Brep=srf)  # -> Naked, Interior, NonManifold
join_5 = JoinCurves(Curves=edges_2.Naked, Preserve=False)
Y_3 = UnitY(Factor=expr("-x", Slider(0.1, range=0..1)))
Y_4 = UnitY(Factor=Slider(0.1, range=0..1))
extr_2 = Extrude(Base=graft(join_5), Direction=[Y_4, Y_3])
join_6 = BrepJoin(Breps=extr_2)  # -> Breps, Closed
split_2 = SplitBrep(Brep=srfgrid, Cutter=join_6.Breps)
item_8 = ListItem(List=split_2, Index=Slider(1, range=0..1), Wrap=True)

replace_2 = ReplaceItems(List=debrep.Faces, Item=item_8, Indices="121", Wrap=False)

Z_2 = UnitZ(Factor=1)
contour = Contour(Shape=join_4.Breps, Point=Point(0, 0, 0), Direction=Z_2, Distance=Slider(0.01005, range=0..0.015))
simplify_2 = SimplifyCurve(Curve=contour)  # -> Curve, Simplified
cp = ControlPoints(Curve=simplify_2.Curve)  # -> Points, Weights, Knots
srf_cp = SurfaceClosestPoint(Point=cp.Points, Surface=item_8)  # -> Point, UVPoint, Distance
smaller = SmallerThan(FirstNumber=srf_cp.Distance, SecondNumber=Slider(0.015, range=0..1))  # -> SmallerThan, OrEqualTo
cull_2 = CullPattern(List=srf_cp.Point, CullPattern=smaller.SmallerThan)
index = ItemIndex(List=srf_cp.Point, Item=cull_2)
replace_3 = ReplaceItems(List=cp.Points, Item=cull_2, Indices=index, Wrap=False)
pline_2 = PolyLine(Vertices=replace_3, Closed=False)

# ---- group: Joined Geometry
join_7 = BrepJoin(Breps=flatten(replace_2))  # -> Breps, Closed

# ----
Z_3 = UnitZ(Factor=1)
contour_2 = Contour(Shape=join_7.Breps, Point=Point(0, 0, 0), Direction=Z_3, Distance=Slider(0.01005, range=0..0.015))  # -> flatten(Contours)
join_8 = JoinCurves(Curves=contour_2, Preserve=False)

# ---- group: Modified Inner Fill
crv = Curve(flatten(pline_2))

# ---- group: Sliced Geometry
crv_2 = Curve(join_8)

# ----
curvepoint = PointOnCurve(join_8, parameter=0.531)
curvepoint_2 = PointOnCurve(crv, parameter=0.531)
points_2 = PointList(Points=curvepoint)
points_3 = PointList(Points=curvepoint_2)

# ---- group: Join Inner and Outer Path
item_9 = ListItem(List=crv, Index=number_slider, Wrap=True)
item_10 = ListItem(List=crv_2, Index=number_slider, Wrap=True)
crv_3 = Curve(item_9)
crv_4 = Curve(item_10)
ccx = CurveCurve(CurveA=crv_3, CurveB=crv_4)  # -> Points, ParamsA, ParamsB

# ---- group: Join Inner and Outer Path / Split Points
pt = Point(ccx.Points)

# ---- group: Join Inner and Outer Path (continued)
crv_cp = CurveClosestPoint(Point=pt, Curve=crv_4)  # -> Point, Parameter, Distance
shatter = Shatter(Curve=flatten(crv_4), Parameters=crv_cp.Parameter)
item_11 = ListItem(List=shatter, Index=Slider(1, range=0..1), Wrap=True)
item_12 = ListItem(List=shatter, Index=0, Wrap=True)
ext = ExtendCurve(Curve=item_12, Type=0, Start=expr("-x", Slider(0.0062, range=0..1)), End="0")

# ---- group: Final Joind Curve
join_9 = JoinCurves(Curves=flatten([crv_3, item_11, ext]), Preserve=False)

# ==== cluster SmartPathShift: "smart" PShift that checks path depth to avoid shifting data out of existence.
data_tree = ClusterInput()
tstat = TreeStatistics(Tree=data_tree)  # -> Paths, Length, Count
dpath = DeconstructPath(Branch=tstat.Paths)
lng = ListLength(List=dpath)  # -> flatten(Length)
sort = SortList(Keys=lng)  # -> Keys, ValuesA
item = ListItem(List=reverse(sort.Keys), Index=0, Wrap=True)
larger = LargerThan(FirstNumber=item, SecondNumber=1)  # -> LargerThan, OrEqualTo
pshift = ShiftPaths(Data=data_tree, Offset=-1)
flatten = FlattenTree(Tree=data_tree, Path="{0}")
filter = StreamFilter(Gate=larger.LargerThan, Stream0=flatten, Stream1=pshift)
data_path_shifted = ClusterOutput(filter)
