# Grasshopper definition Realsense_D435i_tools_GD220804.ghx (Grasshopper 1.0.7)
# plug-ins: Pufferfish, LunchBox

panel = Panel("brick_wall_test_01_segment.ply")
panel_2 = Panel("brick_wall_test_01.ply")

# ---- group: Name of the .ply file
list = ValueList({"frame_00.ply", "frame_01.ply", "frame_02.ply", "frame_03.ply", "frame_04.ply", "frame_05.ply", "frame_06.ply", "frame_07.ply", "frame_08.ply", "frame_09.ply"}, selected="frame_00.ply")

# ---- group: Click to create new .ply file, when camera connected
button = Button()

# ---- group: Toggle true to read .ply file
toggle = BooleanToggle(True)

# ---- group: Change the path to your directory
data = GhPythonScript()  # -> data
# ---------- data: Python ----------
__author__ = "Gido"
__version__ = "2020.01.14"

import rhinoscriptsyntax as rs

# Path to directory containing .ply files
data = r"C:\Users\Gido\Documents"
# ---------- end data ----------

# ----
realsense_d435i = GhPythonScript(data=data, file="brick_wall_test_03_3.ply", create=button, read=toggle)  # -> out, a, points, mesh
# ---------- realsense_d435i: Python ----------
__author__ = "Gido Dielemans"
__version__ = "2021.06.09"

import os
from compas_ghpython.utilities import draw_points
from compas_ghpython.artists import MeshArtist
from compas.files import PLY
from compas.rpc import Proxy
from compas.datastructures import Mesh

# create filepath
filepath = os.path.join(data, file)
print(filepath)

# create a new file using RPC
if create:
    realsense = Proxy()
    # Locate script to execute with RPC
    realsense.package = 'mobile_additive_manufacturing.sensors.realsense_d435i_methods'
    # Execute method from script using the Proxy
    realsense.export_to_ply(filepath)

# read the .ply file
if read:
    # check if there is a file with the name at the location
    assert os.path.isfile(filepath)
    # in case of an AssertionError please confirm the filepath and ensure the file is present
    
    # read the .ply file
    ply = PLY(filepath)
    ply.read()
    vertices = ply.reader.vertices
    points = []
    # convert vertices in points to draw using draw_points
    for i, v in enumerate(vertices):
        if i == 0:
            print v
        points.append({'pos': [v['x'],-v['y'],v['z']]})
    points = draw_points(points)
    cmesh = Mesh.from_ply(filepath)
    artist = MeshArtist(cmesh)
    mesh = artist.draw_mesh()
# ---------- end realsense_d435i ----------
pt = Point([<point referenced from the Rhino model> x3])
mesh = Mesh(realsense_d435i.mesh)
Z = UnitZ(Factor=1)
pt_2 = Point(realsense_d435i.points)
pt_3 = Point(realsense_d435i.points)

# ---- group: Preview
list_2 = ValueList({"dist_color": 0, "black": 1}, selected="dist_color")
colorize = Colorize(B=pt_3)
filter = StreamFilter(Gate=list_2, Stream0=colorize, Stream1=ColourSwatch(SwatchColor=RGB(0, 0, 0)))
preview = CustomPreview(Geometry=pt_3, Material=filter)

# ----
move = Move(Geometry=pt_2, Motion=Z)  # -> Geometry, Transform
cps = ClosestPoints(Point=pt, Cloud=move.Geometry, Count=1)  # -> ClosestPoint, CPIndex, Distance
bang = ExplodeTree(Data=cps.ClosestPoint)  # -> Branch0, Branch1, Branch2
number_slider = Slider(0.01, range=0..1)
number_slider_2 = Slider(0.01, range=0..1)
pl_3pt = Plane3Pt(PointA=bang.Branch0, PointB=bang.Branch1, PointC=bang.Branch2)
Z_2 = UnitZ(Factor=Slider(0.045, range=0..0.1))
move_2 = Move(Geometry=mesh, Motion=Z)  # -> Geometry, Transform
move_3 = Move(Geometry=pl_3pt, Motion=Z_2)  # -> Geometry, Transform
msplit = MeshSplitPlane(Mesh=move_2.Geometry, Plane=move_3.Geometry)  # -> Above, Below
mesh_2 = Mesh(msplit.Above)
number_slider_3 = Slider(0.005, range=0..0.1)
demesh = DeconstructMesh(Mesh=mesh_2)  # -> Vertices, Faces, Colours, Normals
lng = ListLength(List=demesh.Faces)  # -> flatten(Length)
sort = SortList(Keys=lng, ValuesA=lng)  # -> Keys, ValuesA
item = ListItem(List=sort.ValuesA, Index=0, Wrap=True)  # -> Item1, Item
index = ItemIndex(List=lng, Item=item.Item1)
item_2 = ListItem(List=mesh_2, Index=index, Wrap=True)
disjoint = DisjointMesh(Mesh=item_2)
item_3 = ListItem(List=disjoint, Index=0, Wrap=True)
demesh_2 = DeconstructMesh(Mesh=item_3)  # -> Vertices, Faces, Colours, Normals
voxmsh = VoxelMesh(
    Points=demesh_2.Vertices,
    Plane=PlaneXY(0, 0, 0),
    SizeX=number_slider_3,
    SizeY=number_slider_3,
    SizeZ=number_slider_3,
    Triangulate=False)
medges = MeshEdges(Mesh=item_3)  # -> NakedEdges, InteriorEdges, NonManifoldEdges
redumsh = ReduceMesh(Mesh=item_3, FaceCount=Slider(250, range=0..1000), Accuracy=1, FaceType=0, Distort=True, Normalize=False)  # -> Reduced, CountDifference
mshreduce = MeshReduce(Mesh=item_3, TargetSize=5000, Distort=True, Accuracy=5, NormalizeSize=True)
line = Line(medges.NakedEdges)
quad = Quadrangulate(Mesh=redumsh.Reduced, Angle=0.03490658504, Ratio=0.875)  # -> Mesh, Count
xz = XZPlane(Origin=Point(0, 0, 0))
join = JoinCurves(Curves=line, Preserve=False)
number_slider_4 = Slider(20, range=0..500)  # disabled
refinement = GhPythonScript(mesh=redumsh.Reduced, n_rec=number_slider_4)  # -> out, new_mesh; inputs mesh: Mesh, n_rec: Int32; disabled
# ---------- refinement: Python ----------
from compas_rhino.geometry import RhinoMesh
from compas_ghpython.artists import MeshArtist

rmesh = RhinoMesh.from_geometry(mesh)
cmesh = rmesh.to_compas()

succes = []
failed = []
for n in range(n_rec):
    for face in cmesh.faces():
        if len(cmesh.face_neighbors(face))<=1:
            cmesh.delete_face(face)
            cmesh.cull_vertices()
            break
    else:
        break
    
print(len(succes))
print(len(failed))
artist = MeshArtist(cmesh)
new_mesh = artist.draw_mesh()
# ---------- end refinement ----------
len = Length(Curve=join)
sec = MeshPlane(Mesh=mshreduce, Plane=xz)
demesh_3 = DeconstructMesh(Mesh=redumsh.Reduced)  # -> Vertices, Faces, Colours, Normals
cls = Closed(Curve=join)  # -> Closed, Periodic
mesh_3 = Mesh(refinement.new_mesh)  # disabled
cull = CullPattern(List=join, CullPattern=invert(cls.Closed))
panel_3 = Panel(len)
len_2 = Length(Curve=cull)
smaller = SmallerThan(FirstNumber=len_2, SecondNumber=Slider(0.05, range=0..1))  # -> SmallerThan, OrEqualTo
cull_2 = CullPattern(List=cull, CullPattern=invert(smaller.SmallerThan))
smoothpline = SmoothPolyline(Polyline=cull_2, Strength=1, Times=10)
srf = Surface(<surface referenced from the Rhino model>)
project = Project(Curve=join, Brep=srf, Direction=Vector(0, 0, 1))
cp = ControlPoints(Curve=project)  # -> flatten(Points), Weights, Knots
del = DelaunayMesh(Points=cp.Points, Plane=PlaneXY(0, 0, 0))
medges_2 = MeshEdges(Mesh=del)  # -> NakedEdges, InteriorEdges, NonManifoldEdges
join_2 = JoinCurves(Curves=medges_2.NakedEdges, Preserve=False)
item_4 = ListItem(List=join_2, Index=0, Wrap=True)
Z_3 = UnitZ(Factor=1)
# Divide curve into points.
# Draw a closed curve in Rhino.
crv = Curve(join_2)
area = Area(Geometry=item_4)  # -> Area, Centroid
number_slider_5 = Slider(0.78, range=0..1)
divide = DivideCurve(Curve=crv, Number=Slider(52, range=0..950), Kinks=False)  # -> Points, Tangents, Parameters
scale = Scale(Geometry=item_4, Center=area.Centroid, Factor=number_slider_5)  # -> Geometry, Transform
boundary = BoundarySurfaces(Edges=join_2)
scale_nu = ScaleNU(Geometry=item_4, Plane=area.Centroid, ScaleX=Slider(0.98, range=0..1), ScaleY=number_slider_5, ScaleZ=1)  # -> Geometry, Transform
extr = Extrude(Base=scale_nu.Geometry, Direction=Z_3)
cap = CapHoles(Brep=extr)
mesh_4 = Mesh(cap)
msplit_2 = MeshSplit(Mesh=cap, Splitters=voxmsh)
item_5 = ListItem(List=msplit_2, Index=Slider(1, range=0..10), Wrap=True)
medges_3 = MeshEdges(Mesh=item_5)  # -> NakedEdges, InteriorEdges, NonManifoldEdges
line_2 = Line(medges_3.NakedEdges)
join_3 = JoinCurves(Curves=line_2, Preserve=False)
item_6 = ListItem(List=join_3, Index=0, Wrap=True)  # -> Item, Item1
# Compute planar VORONOI diagram.
voronoi = Voronoi(Points=divide.Points, BruteForceOverride=False)
# Trim voronoi with the original curve.
trim = TrimWithRegion(Curve=voronoi, Region=crv)  # -> flatten(Inside), Outside
# Explode the curves into segments and remove the duplicates.
explode = Explode(Curve=trim.Inside, Recursive=True)  # -> flatten(Segments), Vertices
len_3 = Length(Curve=explode.Segments)
smaller_2 = SmallerThan(FirstNumber=len_3, SecondNumber=Slider(0.02, range=0..1))  # -> SmallerThan, OrEqualTo
cull_3 = CullPattern(List=explode.Segments, CullPattern=smaller_2.SmallerThan)
join_4 = JoinCurves(Curves=cull_3, Preserve=False)

# ==== cluster Colorize
B = ClusterInput()
xy = XYPlane(Origin=Point(0, 0, 0))
dist = Distance(PointA=xy, PointB=B)
sort = SortList(Keys=dist, ValuesA=dist)  # -> Keys, ValuesA
item = ListItem(List=sort.ValuesA, Index=0, Wrap=True)  # -> Item1, Item
gradient = Gradient(
    LowerLimit=0,
    UpperLimit=item.Item1,
    Parameter=dist,
    stops=[0: RGB(234, 38, 0), 0.25: RGB(234, 126, 0), 0.5: RGB(254, 244, 84), 0.75: RGB(173, 203, 249), 1: RGB(75, 107, 169)])
C = ClusterOutput(gradient)
