# Grasshopper definition test.gh (Grasshopper 1.0.7)
# plug-ins: Volvox, Kangaroo2 Components, Pufferfish, Pancake

crv = Curve(<curve referenced from the Rhino model>)
pt = Point(<point referenced from the Rhino model>)
srf = Surface(crv)
srf_2 = Surface(srf)
pt_2 = Point(pt)
srf_cp = SurfaceClosestPoint(Point=pt_2, Surface=srf_2)  # -> Point, UVPoint, Distance
vec2pt = Vector2Pt(PointA=srf_cp.Point, PointB=pt_2, Unitize=False)  # -> Vector, Length
extr = Extrude(Base=srf_2, Direction=vec2pt.Vector)

crv_2 = Curve(<curve referenced from the Rhino model>)
pt_3 = Point(<point referenced from the Rhino model>)
clo = Cloud(<cloud referenced from the Rhino model>)
srf_3 = Surface(crv_2)
pt_4 = Point(pt_3)
vsub = VoxelSubsampling(Size=Slider(1, range=0..10))
number_slider = Slider(1, range=0..1)
srf_4 = Surface(srf_3)
clo_2 = Cloud(<cloud referenced from the Rhino model>)

volume = Volume(Geometry=extr)  # -> Volume, Centroid
scale = Scale(Geometry=extr, Center=volume.Centroid, Factor=Slider(2, range=0..10))  # -> Geometry, Transform

srf_cp_2 = SurfaceClosestPoint(Point=pt_4, Surface=srf_4)  # -> Point, UVPoint, Distance
cloude = CloudEngine(Cloud=clo, Instruction0=vsub)
vec2pt_2 = Vector2Pt(PointA=srf_cp_2.Point, PointB=pt_4, Unitize=False)  # -> Vector, Length
vsub_2 = VoxelSubsampling(Size=Slider(10, range=0..10))
decloud = DeconstructCloud(Cloud=cloude)  # -> Points, Normals, Colors
decloud_2 = DeconstructCloud(Cloud=clo_2)  # -> Points, Normals, Colors
extr_2 = Extrude(Base=srf_4, Direction=vec2pt_2.Vector)
pt_5 = Point(decloud.Points)
cloude_2 = CloudEngine(Cloud=clo_2, Instruction0=vsub_2)
decloud_3 = DeconstructCloud(Cloud=cloude_2)  # -> Points, Normals, Colors
volume_2 = Volume(Geometry=extr_2)  # -> Volume, Centroid
brepinc = PointInBrep(Brep=scale.Geometry, Point=pt_5, Strict=False)
pt_6 = Point(decloud_3.Points)
scale_2 = Scale(Geometry=extr_2, Center=volume_2.Centroid, Factor=Slider(2, range=0..10))  # -> Geometry, Transform
dispatch = Dispatch(List=pt_5, DispatchPattern=brepinc)  # -> ListA, ListB
brepinc_2 = PointInBrep(Brep=scale_2.Geometry, Point=pt_6, Strict=False)
pt_7 = Point(dispatch.ListA)
dispatch_2 = Dispatch(List=pt_6, DispatchPattern=brepinc_2)  # -> ListA, ListB
del = DelaunayMesh(Points=pt_7, Plane=PlaneXY(0, 0, 0))
pt_8 = Point(dispatch_2.ListA)
clean = CombineClean(Meshes=del)
del_2 = DelaunayMesh(Points=pt_8, Plane=PlaneXY(0, 0, 0))
mesh = MeshBrep(
    Brep=extr,
    Settings={GridMaxCount=0, GridMinCount=16, JaggedSeams=False, MaxEdgeLength=0, MinEdgeLength=0.0001, MinTolerance=0, Refine=True, RefineAngle=0, RelativeTolerance=0.65, SimplePlanes=True, Tolerance=0})
weld = WeldMesh(Mesh=clean, Angle=3.141592654)
mesh_2 = MeshBrep(
    Brep=extr_2,
    Settings={GridMaxCount=0, GridMinCount=16, JaggedSeams=False, MaxEdgeLength=0, MinEdgeLength=0.0001, MinTolerance=0, Refine=True, RefineAngle=0, RelativeTolerance=0.65, SimplePlanes=True, Tolerance=0})
clean_2 = CombineClean(Meshes=del_2)
redumsh = ReduceMesh(
    Mesh=weld,
    FaceCount=Slider(200, range=0..1000),
    Accuracy=Slider(10, range=0..10),
    FaceType=0,
    Distort="TRUE",
    Normalize=False)  # -> Reduced, CountDifference
msplit = MeshSplit(Mesh=mesh, Splitters=redumsh.Reduced)
msplit_2 = MeshSplit(Mesh=mesh_2, Splitters=clean_2)
item = ListItem(List=msplit, Index=Slider(0, range=0..10), Wrap=True)
item_2 = ListItem(List=msplit_2, Index=Slider(0, range=0..10), Wrap=True)
mesh_3 = Mesh(redumsh.Reduced)
move = Move(Geometry=item, Motion="{100,100,100}")  # -> Geometry, Transform
move_2 = Move(Geometry=mesh_3, Motion="{100,100,100}")  # -> Geometry, Transform
clean_3 = CombineClean(Meshes=move.Geometry)
msh2psrf = MeshToPolysurface(Mesh=move_2.Geometry, Triangles=False, FaceMerge=False)
msh2psrf_2 = MeshToPolysurface(Mesh=clean_3, Triangles=False, FaceMerge=False)
splitmul = SplitBrepMultiple(Brep=msh2psrf, Cutters=msh2psrf_2)
item_3 = ListItem(List=splitmul, Index=Slider(1, range=0..10), Wrap=True)
merge = Merge(Data1=msh2psrf_2, Data2=item_3)
join = BrepJoin(Breps=merge)  # -> Breps, Closed

# ----
# Print parameters
path_resolution = Slider(1, range=0..100)
spiral_or_seam = Slider(1, range=0..1)
layer_height = Slider(5, range=0..30)
layer_width = Slider(3.5, range=0..200)

# ----
# Mesh to be printed
mesh_4 = Mesh(join.Breps)

speed = Slider(4500, range=0..10000)

# ----
# Obejct number /
# new export
export_data = Button()

# ----
# Export Geometry
boolean_toggle = BooleanToggle(False)
directory = GhPythonScript(Number="1")  # -> FilePath
# ---------- directory: Python ----------
from ghpythonlib.componentbase import executingcomponent as component
import Grasshopper, GhPython
import System
import Rhino
import rhinoscriptsyntax as rs

class MyComponent(component):
    
    def RunScript(self, Number):
        """Provides a scripting component.
            Inputs:
                x: The x script variable
                y: The y script variable
            Output:
                a: The a output variable"""
        
        __author__ = "lachmayer"
        __version__ = "2022.05.24"
        
        import rhinoscriptsyntax as rs
        import os
        cwd = ghenv.Component.OnPingDocument().FilePath
        laenge = len(cwd)-12
        cwd1 = ""
        for i in range(laenge):
            cwd1 = (cwd1+cwd[i])
        cwd = cwd1
        cwd = cwd + "\mesh" + Number + ".stl"
        print(cwd)
        FilePath = cwd
                
        
        # return outputs if you have them; here I try it for you:
        return FilePath
# ---------- end directory ----------
pcexportstl = ExportSTL(
    Mesh=mesh_4,
    Relocate=boolean_toggle,
    SavePath=directory,
    SaveAsBinaryFile=True,
    SaveNow=export_data,
    LastSaveLocalization="neutral,N")

# ----
# Export Print parameters
directory_2 = GhPythonScript(Number="1")  # -> FilePath
# ---------- directory_2: Python ----------
from ghpythonlib.componentbase import executingcomponent as component
import Grasshopper, GhPython
import System
import Rhino
import rhinoscriptsyntax as rs

class MyComponent(component):
    
    def RunScript(self, Number):
        """Provides a scripting component.
            Inputs:
                x: The x script variable
                y: The y script variable
            Output:
                a: The a output variable"""
                
        __author__ = "lachmayer"
        __version__ = "2022.05.24"
                
        import rhinoscriptsyntax as rs
        import os
        cwd = ghenv.Component.OnPingDocument().FilePath
        laenge = len(cwd)-12
        cwd1 = ""
        for i in range(laenge):
            cwd1 = (cwd1+cwd[i])
        cwd = cwd1
        cwd = cwd + "\parameters" + Number + ".txt"
        print(cwd)
        FilePath = cwd
                
        
        # return outputs if you have them; here I try it for you:
        return FilePath
# ---------- end directory_2 ----------
merge_2 = Merge(Data1=layer_height, Data2=layer_width, Data3=path_resolution, Data4=spiral_or_seam)
join_2 = TextJoin(Text=merge_2, Join=";")
pcexporttxt = ExportTXT(
    Content=join_2,
    FileLocation=directory_2,
    Overwrite=export_data,
    Encoding="utf-8",
    Export=export_data,
    LastSaveLocalization="neutral,N")
