# Grasshopper definition test.gh (Grasshopper 1.0.7)
# plug-ins: Volvox, Kangaroo2 Components, Pufferfish, Pancake

crv = Curve(<curve referenced from the Rhino model>)
pt = Point(<point referenced from the Rhino model>)
srf = Surface(crv)
srf_2 = Surface(srf)
pt_2 = Point(pt)
srf_cp = SurfaceClosestPoint(Point=pt_2, Surface=srf_2)  # -> Point, UVPoint, Distance
vec2pt = Vector2Pt(PointA=srf_cp.Point, PointB=pt_2, Unitize=False)  # -> Vector, Length
extr = Extrude(Base=srf_2, Direction=vec2pt.Vector)

subsampling_by_taking_each_point = Slider(10, range=0..20)
which_part_of_the_sliced_surface = Slider(1, range=0..10)
clo = Cloud(<cloud referenced from the Rhino model>)
which_part_of_the_sliced_object = Slider(0, range=0..10)
face_count_about_200 = Slider(200, range=0..1000)
accuracy_about_10 = Slider(10, range=0..10)
_2d_boundary_curve = Curve(<curve referenced from the Rhino model>)
z_vector_for_extrusion_length = Panel("{0,0,-200}")
upscaling_factor = Slider(2, range=0..10)
point_cloud = Cloud(<cloud referenced from the Rhino model>)
vsub = VoxelSubsampling(Size=Slider(1, range=0..10))

volume = Volume(Geometry=extr)  # -> Volume, Centroid
scale = Scale(Geometry=extr, Center=volume.Centroid, Factor=Slider(2, range=0..10))  # -> Geometry, Transform

cloude = CloudEngine(Cloud=clo, Instruction0=vsub)
decloud = DeconstructCloud(Cloud=cloude)  # -> Points, Normals, Colors

# ---- group: Region of interest
srf_3 = Surface(_2d_boundary_curve)
extr_2 = Extrude(Base=srf_3, Direction=z_vector_for_extrusion_length)
volume_2 = Volume(Geometry=extr_2)  # -> Volume, Centroid
scale_2 = Scale(Geometry=extr_2, Center=volume_2.Centroid, Factor=upscaling_factor)  # -> Geometry, Transform

# ---- group: Reduced point Cloud
vsub_2 = VoxelSubsampling(Size=subsampling_by_taking_each_point)
cloude_2 = CloudEngine(Cloud=point_cloud, Instruction0=vsub_2)
decloud_2 = DeconstructCloud(Cloud=cloude_2)  # -> Points, Normals, Colors
pt_3 = Point(decloud_2.Points)
brepinc = PointInBrep(Brep=scale_2.Geometry, Point=pt_3, Strict=False)
dispatch = Dispatch(List=pt_3, DispatchPattern=brepinc)  # -> ListA, ListB
pt_4 = Point(dispatch.ListA)

# ----
pt_5 = Point(decloud.Points)

# ---- group: Rebuilding the Delauny Triangulation with adjusted parameters
del = DelaunayMesh(Points=pt_4, Plane=PlaneXY(0, 0, 0))
clean = CombineClean(Meshes=del)
weld = WeldMesh(Mesh=clean, Angle=3.141592654)
redumsh = ReduceMesh(Mesh=weld, FaceCount=face_count_about_200, Accuracy=accuracy_about_10, FaceType=0, Distort="TRUE", Normalize=False)  # -> Reduced, CountDifference

# ----
brepinc_2 = PointInBrep(Brep=scale.Geometry, Point=pt_5, Strict=False)
dispatch_2 = Dispatch(List=pt_5, DispatchPattern=brepinc_2)  # -> ListA, ListB

# ---- group: To be printed object
print_object = MeshBrep(
    Brep=extr_2,
    Settings={GridMaxCount=0, GridMinCount=16, JaggedSeams=False, MaxEdgeLength=0, MinEdgeLength=0.0001, MinTolerance=0, Refine=True, RefineAngle=0, RelativeTolerance=0.65, SimplePlanes=True, Tolerance=0})

# ---- group: Split designed Object with surface
msplit = MeshSplit(Mesh=print_object, Splitters=redumsh.Reduced)
item = ListItem(List=msplit, Index=which_part_of_the_sliced_object, Wrap=True)
clean_2 = CombineClean(Meshes=item)
msh2psrf = MeshToPolysurface(Mesh=clean_2, Triangles=False, FaceMerge=False)

# ---- group: Slice the surface with the designed object
mesh = Mesh(redumsh.Reduced)
msh2psrf_2 = MeshToPolysurface(Mesh=mesh, Triangles=False, FaceMerge=False)
splitmul = SplitBrepMultiple(Brep=msh2psrf_2, Cutters=msh2psrf)
item_2 = ListItem(List=splitmul, Index=which_part_of_the_sliced_surface, Wrap=True)

# ---- group: Preview of the reconstructed object
movement_just_for_visualization = Panel("{100,400,100}")
merge = Merge(Data1=msh2psrf, Data2=item_2)
join = BrepJoin(Breps=merge)  # -> Breps, Closed
move = Move(Geometry=join.Breps, Motion=movement_just_for_visualization)  # -> Geometry, Transform

# ----
pt_6 = Point(dispatch_2.ListA)
del_2 = DelaunayMesh(Points=pt_6, Plane=PlaneXY(0, 0, 0))
clean_3 = CombineClean(Meshes=del_2)
mesh_2 = MeshBrep(
    Brep=extr,
    Settings={GridMaxCount=0, GridMinCount=16, JaggedSeams=False, MaxEdgeLength=0, MinEdgeLength=0.0001, MinTolerance=0, Refine=True, RefineAngle=0, RelativeTolerance=0.65, SimplePlanes=True, Tolerance=0})
weld_2 = WeldMesh(Mesh=clean_3, Angle=3.141592654)
redumsh_2 = ReduceMesh(
    Mesh=weld_2,
    FaceCount=Slider(200, range=0..1000),
    Accuracy=Slider(10, range=0..10),
    FaceType=0,
    Distort="TRUE",
    Normalize=False)  # -> Reduced, CountDifference
msplit_2 = MeshSplit(Mesh=mesh_2, Splitters=redumsh_2.Reduced)
item_3 = ListItem(List=msplit_2, Index=Slider(0, range=0..10), Wrap=True)
mesh_3 = Mesh(redumsh_2.Reduced)
move_2 = Move(Geometry=mesh_3, Motion="{100,100,100}")  # -> Geometry, Transform
move_3 = Move(Geometry=item_3, Motion="{100,100,100}")  # -> Geometry, Transform
clean_4 = CombineClean(Meshes=move_3.Geometry)
msh2psrf_3 = MeshToPolysurface(Mesh=move_2.Geometry, Triangles=False, FaceMerge=False)
msh2psrf_4 = MeshToPolysurface(Mesh=clean_4, Triangles=False, FaceMerge=False)
splitmul_2 = SplitBrepMultiple(Brep=msh2psrf_3, Cutters=msh2psrf_4)
item_4 = ListItem(List=splitmul_2, Index=Slider(1, range=0..10), Wrap=True)
merge_2 = Merge(Data1=msh2psrf_4, Data2=item_4)
join_2 = BrepJoin(Breps=merge_2)  # -> Breps, Closed

# ----
# Print parameters
path_resolution = Slider(1, range=0..100)
spiral_or_seam = Slider(1, range=0..1)
layer_height = Slider(5, range=0..30)
layer_width = Slider(3.5, range=0..200)

# ----
# Mesh to be printed
mesh_4 = Mesh(join_2.Breps)

speed = Slider(4500, range=0..10000)

# ----
# Obejct number /
# new export
export_data = Button()

# ----
# Export Geometry
boolean_toggle = BooleanToggle(False)
directory = GhPythonScript(Number="1")  # -> FilePath
# ---------- directory: Python ----------
from ghpythonlib.componentbase import executingcomponent as component
import Grasshopper, GhPython
import System
import Rhino
import rhinoscriptsyntax as rs

class MyComponent(component):
    
    def RunScript(self, Number):
        """Provides a scripting component.
            Inputs:
                x: The x script variable
                y: The y script variable
            Output:
                a: The a output variable"""
        
        __author__ = "lachmayer"
        __version__ = "2022.05.24"
        
        import rhinoscriptsyntax as rs
        import os
        cwd = ghenv.Component.OnPingDocument().FilePath
        laenge = len(cwd)-12
        cwd1 = ""
        for i in range(laenge):
            cwd1 = (cwd1+cwd[i])
        cwd = cwd1
        cwd = cwd + "\mesh" + Number + ".stl"
        print(cwd)
        FilePath = cwd
                
        
        # return outputs if you have them; here I try it for you:
        return FilePath
# ---------- end directory ----------
pcexportstl = ExportSTL(
    Mesh=mesh_4,
    Relocate=boolean_toggle,
    SavePath=directory,
    SaveAsBinaryFile=True,
    SaveNow=export_data,
    LastSaveLocalization="neutral,N")

# ----
# Export Print parameters
directory_2 = GhPythonScript(Number="1")  # -> FilePath
# ---------- directory_2: Python ----------
from ghpythonlib.componentbase import executingcomponent as component
import Grasshopper, GhPython
import System
import Rhino
import rhinoscriptsyntax as rs

class MyComponent(component):
    
    def RunScript(self, Number):
        """Provides a scripting component.
            Inputs:
                x: The x script variable
                y: The y script variable
            Output:
                a: The a output variable"""
                
        __author__ = "lachmayer"
        __version__ = "2022.05.24"
                
        import rhinoscriptsyntax as rs
        import os
        cwd = ghenv.Component.OnPingDocument().FilePath
        laenge = len(cwd)-12
        cwd1 = ""
        for i in range(laenge):
            cwd1 = (cwd1+cwd[i])
        cwd = cwd1
        cwd = cwd + "\parameters" + Number + ".txt"
        print(cwd)
        FilePath = cwd
                
        
        # return outputs if you have them; here I try it for you:
        return FilePath
# ---------- end directory_2 ----------
merge_3 = Merge(Data1=layer_height, Data2=layer_width, Data3=path_resolution, Data4=spiral_or_seam)
join_3 = TextJoin(Text=merge_3, Join=";")
pcexporttxt = ExportTXT(
    Content=join_3,
    FileLocation=directory_2,
    Overwrite=export_data,
    Encoding="utf-8",
    Export=export_data,
    LastSaveLocalization="neutral,N")
