# Grasshopper definition mobile_robot_workspace_earth_SPI.ghx (Grasshopper 1.0.7)
# plug-ins: Pufferfish

ext_ip = ValueList({"192.168.10.10", "192.168.10.20", "192.168.10.11", "192.168.10.12", "127.0.0.1", "192.168.10.111", "192.168.0.220", "192.168.0.30", "192.168.10.50", "0.0.0.0"}, selected="192.168.0.220")
ext_port = ValueList({"50003", "50004"}, selected="50004")

# ----
# Settings
# --> Set your IP address
# --> Set robot IP address
server_ip = ValueList({"192.168.10.44", "192.168.10.12", "192.168.10.11", "192.168.10.10", "192.168.10.2", "127.0.0.1", "192.168.10.111", "192.168.0.250", "192.168.0.30", "10.42.0.212", "10.42.0.133"}, selected="192.168.0.250")
ur_ip = ValueList({"192.168.10.10", "192.168.10.20", "192.168.10.11", "192.168.10.12", "127.0.0.1", "192.168.10.111", "192.168.0.210", "192.168.0.30"}, selected="192.168.0.210")
server_port = ValueList({"50002", "50003", "50005", "50006", "50007", "50008", "50009", "50010", "50011", "50012", "50013", "50014", "50015", "50016"}, selected="50007")
ur_port = ValueList({"30002"}, selected="30002")
globals = PythonScript(
    server_ip=server_ip,
    server_port=server_port,
    ur_ip=ur_ip,
    ur_port=ur_port,
    ext_ip=ext_ip,
    ext_port=ext_port,
    clear=Button())  # inputs server_port: Int32
# ---------- globals: Python ----------
from scriptcontext import sticky as st

st["server_ip"] = server_ip
st["server_port"] = server_port

st["ur_ip"] = ur_ip
st["ur_port"] = ur_port

st["ext_ip"] = ext_ip
st["ext_port"] = ext_port


if clear:
    st.clear()
# ---------- end globals ----------

# ----
# Check if UR robot
#  is available
ping = Button()
py = PythonScript(ip=ur_ip, ping=ping)  # -> out, trigger
# ---------- py: Python ----------
from scriptcontext import sticky as st
from ur_fabrication_control.direct_control.utilities import is_available

guid = str(ghenv.Component.InstanceGuid)
txt_key = "txt_" + guid
if txt_key not in st:
    st[txt_key] = ""

if ping:
    
    available = is_available(ip)
    
    if available:
        st[txt_key] = "%s is up!" % ip
        trigger = True
    else:
        st[txt_key] = "%s is down!" % ip
        trigger = False

print(st[txt_key])
# ---------- end py ----------
panel = Panel(py.out)

reload = Button()
panel_2 = Panel("Unload libraries")
py_2 = PythonScript(reload=reload)
# ---------- py_2: Python ----------
from compas_ghpython import unload_modules

if reload:
    unload_modules("compas")
    unload_modules("compas_fab")
    unload_modules("roslibpy")
    unload_modules("fabrication_manager")
    unload_modules("assembly_information_model")
    unload_modules("am_information_model")
    unload_modules("ur_fabrication_control")
    unload_modules("workshop_aaec_revamp")
# ---------- end py_2 ----------

plane = Plane(Plane(origin=(1.295219321, 0.6819139808, 0.914408), x=(0.8815448872, 0.2585732613, 0.3949917472), y=(-0.003726485372, -0.8328320409, 0.5535132383)))  # disabled
plane_2 = Plane(Plane(origin=(0.9280628927, 0.6859965325, 0.91012), x=(0.8874119293, 0.4557923956, -0.06894461371), y=(0.3948455453, -0.6743686052, 0.6239583156)))  # disabled
plane_3 = Plane(Plane(origin=(0.5445328415, 0.6896136665, 0.908022), x=(0.6367849652, 0.7049576321, -0.3123133763), y=(0.6835754002, -0.3287803465, 0.6516349868)))  # disabled
plane_4 = Plane(Plane(origin=(0.5409385471, 0.4035826803, 0.907922), x=(0.5064495004, 0.8553843134, -0.1087500797), y=(0.7839364699, -0.4042402063, 0.4712042728)))  # disabled
plane_5 = Plane(Plane(origin=(0.5293688023, -0.2685027213, 0.908958), x=(0.8341274545, 0.256525374, -0.488288974), y=(0.07983803354, -0.9320977663, -0.3532982344)))  # disabled
plane_6 = Plane(Plane(origin=(0.5253440848, -0.8017332249, 0.910599), x=(0.9526221535, -0.2901236807, -0.0913196721), y=(-0.2853850595, -0.9564348321, 0.06154494154)))  # disabled
merge = Merge(Data1=plane, Data2=plane_2, Data3=plane_3, Data4=plane_4, Data5=plane_5, Data6=plane_6)  # disabled
merge_2 = Merge(Data1=plane_3, Data2=plane_2, Data3=plane)  # disabled
merge_3 = Merge(Data1=plane_3, Data2=plane_4, Data3=plane_5, Data4=plane_6)  # disabled
fit_line = FitLine(Points=merge_3)  # disabled
fit_line_2 = FitLine(Points=merge_2)  # disabled
sphere_radius = Slider(75, range=0..150)
wall_thickness = Slider(32, range=0..100)
layer_width = Slider(8, range=0..10)
end_points = EndPoints(Curve=fit_line_2)  # -> Start, End; disabled
end_points_2 = EndPoints(Curve=fit_line)  # -> Start, End; disabled
sphere_am_model = GhPythonScript(layer_height=Slider(6, range=0..10), layer_width=layer_width, r=sphere_radius, thickness=wall_thickness)  # -> all_curves
# ---------- sphere_am_model: Python ----------
__author__ = "emakr"
__version__ = "2022.10.19"

import rhinoscriptsyntax as rs
import compas
import math
import itertools
import Rhino.Geometry as rg

from compas.geometry import Circle, Plane, Curve, NurbsCurve
from compas_ghpython.artists import CircleArtist, CurveArtist
from itertools import chain



all_curves = []

#Define the number of layers from the layer height and the sphere radius
number_of_layers = int(math.floor(2*r/layer_height))
radius = (number_of_layers*layer_height)/2

for i in range(2,number_of_layers):
    curves = []
    arcs = []
    arcs_nurbs = []
    lines = []
    #Create an outer circle for each layer
    z = i*layer_height 
    x_out = math.sqrt(2*z*radius-z**2)
    point = rg.Point3d(0,0,z)
    vector = rg.Vector3d(0,0,1)
    #Create circular toolpaths for each layer
    number_of_paths = int(math.floor(x_out/layer_width))
    if number_of_paths > thickness/layer_width:
        number_of_paths = int(math.floor(thickness/layer_width))
    for k in range(0,number_of_paths):
        r = x_out - k*layer_width - 0.5*layer_width
        circle = rg.Circle(rg.Plane(point,vector), r)
        arc = rg.Arc(circle, rg.Interval(layer_width/(2*r),3.14*2-layer_width/(2*r)))
        arcs.append(arc)
    for j, arc in enumerate(arcs):
        arc_nurb = rg.Arc.ToNurbsCurve(arc)
        curves.append(arc_nurb)
        if j%2==0 and j < len(arcs)-1:
            line = rg.LineCurve(arcs[j].EndPoint, arcs[j+1].EndPoint)
            curves.append(line)
        if j%2!=0 and j < len(arcs)-1:
            line = rg.LineCurve(arcs[j].StartPoint, arcs[j+1].StartPoint)
            curves.append(line)
    spiral = rg.NurbsCurve.JoinCurves(curves)[0]
    spiral.Rotate((2*3.14*i)/number_of_layers,vector,point)
    all_curves.append(spiral)
# ---------- end sphere_am_model ----------
vector_2pt = Vector2Pt(PointA=end_points.Start, PointB=end_points.End, Unitize=False)  # -> Vector, Length; disabled
vector_2pt_2 = Vector2Pt(PointA=end_points_2.End, PointB=end_points_2.Start, Unitize=False)  # -> Vector, Length; disabled
construct_plane = ConstructPlane(Origin=plane_3, XAxis=vector_2pt_2.Vector, YAxis=vector_2pt.Vector)  # disabled
point = Point(Point(0, 0, 0))
point_2 = Point(Point(335.2845414, 464.7154586, 19))
point_3 = Point(Point(464.7154586, 335.2845414, 19))
point_4 = Point(Point(1035.284541, 464.7154586, 19))
point_5 = Point(Point(1164.715459, 335.2845414, 19))
curve = Curve([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])
vector_2pt_3 = Vector2Pt(PointA=point, PointB=point_2, Unitize=False)  # -> Vector, Length
vector_2pt_4 = Vector2Pt(PointA=point, PointB=point_4, Unitize=False)  # -> Vector, Length
vector_2pt_5 = Vector2Pt(PointA=point, PointB=point_5, Unitize=False)  # -> Vector, Length
vector_2pt_6 = Vector2Pt(PointA=point, PointB=point_3, Unitize=False)  # -> Vector, Length
curve_2 = Curve([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])
geometry = Geometry(curve)
unit_z = UnitZ(Factor=Slider(21, range=0..30))
unit_z_2 = UnitZ(Factor=Slider(19, range=0..20))
move = Move(Geometry=geometry, Motion=vector_2pt_4.Vector)  # -> Geometry, Transform
move_2 = Move(Geometry=geometry, Motion=vector_2pt_3.Vector)  # -> Geometry, Transform
move_3 = Move(Geometry=geometry, Motion=vector_2pt_6.Vector)  # -> Geometry, Transform
move_4 = Move(Geometry=curve_2, Motion=vector_2pt_5.Vector)  # -> Geometry, Transform

# ---- group: Retraction distance
number_slider = Slider(0.07, range=0..0.1)

# ----
move_5 = Move(Geometry=[move_2.Geometry, move_3.Geometry], Motion=unit_z_2)  # -> Geometry, Transform
move_6 = Move(Geometry=[move.Geometry, move_4.Geometry], Motion=unit_z)  # -> Geometry, Transform

# ---- group: Scale and transform to table
scale = Scale(Geometry=[move_5.Geometry, move_6.Geometry], Center=Point(0, 0, 0), Factor=Slider(0.001, range=0..0.001))  # -> Geometry, Transform
table_bot_left_corner = Plane(Plane(origin=(0.5445328415, 0.6896136665, 0.908022), x=(-0.0134656247, -0.9999077913, 0.001756672257), y=(0.9998735035, -0.0134502487, 0.008489275436)))
orient = Orient(Geometry=scale.Geometry, Source=PlaneXY(0, 0, 0), Target=table_bot_left_corner)  # -> Geometry, Transform

# ---- group: Sorting curves on Z-value
end = EndPoints(Curve=orient.Geometry)  # -> Start, End
pdecon = Deconstruct(Point=end.Start)  # -> XComponent, YComponent, ZComponent
lng = ListLength(List=pdecon.ZComponent)
x_minus_one = XMinusOne(NumberX=lng)
range = Range(Domain=x_minus_one, Steps=x_minus_one)
sort = SortList(Keys=pdecon.ZComponent, ValuesA=range)  # -> Keys, ValuesA
item = ListItem(List=orient.Geometry, Index=sort.ValuesA, Wrap=True)

# ---- group: Create planes
divlength = DivideLength(Curve=item, Length=Slider(0.005, range=0..0.1))  # -> Points, Tangents, Parameters
control_points = Point(divlength.Points)
pl = ConstructPlane(Origin=control_points, XAxis=Vector(1, 0, 0), YAxis=Vector(0, 1, 0))

# ----
# Printplanes generation
python = GhPythonScript(planes=simplify(pl), z_offset=number_slider)  # -> out, planes_data, jumps; inputs planes: tree of Plane
# ---------- python: Python ----------
import rhinoscriptsyntax as rs
import Rhino.Geometry as rg
from compas_ghpython import ghtree_to_list, draw_frame
from compas.geometry import Frame, Vector, Translation

def planes_to_frames(planes):
    return [Frame(plane.Origin, plane.XAxis, -plane.YAxis) if plane.XAxis[0]>0 else Frame(plane.Origin, -plane.XAxis, -plane.YAxis) for plane in planes if plane]

def frames_to_planes(frames):
    return [draw_frame(frame) for frame in frames]

jumps = 0
nl_planes = ghtree_to_list(planes)
print(len(nl_planes))
T = Translation.from_vector(Vector(0,0,z_offset))
planes_data = []
for subplanes in nl_planes:
    if len(subplanes)>3:
        subframes = planes_to_frames(subplanes)
        init_frame = subframes[0].transformed(T)
        end_frame = subframes[-1].transformed(T)
        planes_data.extend([draw_frame(init_frame), draw_frame(subframes[0])])
        planes_data.append("extruder_on")
        planes_data.extend(frames_to_planes(subframes[1:len(subframes)]))
        planes_data.append("extruder_off")
        planes_data.extend([draw_frame(init_frame)])
        jumps += 1
# ---------- end python ----------
panel_3 = Panel(python.planes_data)

plane_7 = Plane(python.planes_data)
list = ValueList({"default", "measured", "initial"}, selected="default")

python_2 = GhPythonScript(choice=list, vertical_axis_height=Slider(0, range=0..0.72), vertical_axis_correction=Slider(0, range=-0.1..0.1))  # -> out, ur_base_frame_rhino_local_tf, ur_base_plane
# ---------- python_2: Python ----------
__author__ = "Gido"
__version__ = "2022.04.11"

import rhinoscriptsyntax as rs
from compas.geometry import Frame
from compas.geometry import Translation
from compas_ghpython.utilities import draw_frame

if choice=="measured":
    ur_base_frame_rhino_local_tf = Frame(ur_base_plane_rhino_local_tf.Origin, 
                                         ur_base_plane_rhino_local_tf.XAxis, 
                                         ur_base_plane_rhino_local_tf.YAxis)
    T = Translation.from_vector(ur_base_frame_rhino_local_tf.zaxis*(vertical_axis_height+vertical_axis_correction))
    ur_base_frame_rhino_local_tf = ur_base_frame_rhino_local_tf.transformed(T)
elif choice=="initial":
    ur_base_frame_rhino_local_tf = Frame(ur_base_plane_init.Origin, 
                                         ur_base_plane_init.XAxis, 
                                         ur_base_plane_init.YAxis)
    T = Translation.from_vector(ur_base_frame_rhino_local_tf.zaxis*(vertical_axis_height+vertical_axis_correction))
    ur_base_frame_rhino_local_tf = ur_base_frame_rhino_local_tf.transformed(T)

elif choice =="default":
    ur_base_frame_rhino_local_tf = Frame([0.275, 0.0, 1.105], [-0.707, 0.707, 0.0], [-0.707, -0.707,0.0])
    T = Translation.from_vector(ur_base_frame_rhino_local_tf.zaxis*(vertical_axis_height+vertical_axis_correction))
    ur_base_frame_rhino_local_tf = ur_base_frame_rhino_local_tf.transformed(T)


ur_base_plane = draw_frame(ur_base_frame_rhino_local_tf)
# ---------- end python_2 ----------

# ----
# Stop Extruder
stop = Button()
stop_2 = PythonScript(stop=stop)
# ---------- stop_2: Python ----------
import time
from scriptcontext import sticky as st
from extruder_control.extruderclient import ExtruderClient

ext_ip = st["ext_ip"]
ext_port = st["ext_port"]

ec = ExtruderClient(ext_ip, ext_port)
wait_for_response = False

if stop:
    ec.connect()
    time.sleep(0.2)
    ec.send_stop(wait_for_response)
    time.sleep(0.2)
    ec.close()
# ---------- end stop_2 ----------

# ----
# Set Extruder data
speed = Slider(2000, range=0..51200)
# Direct extruder control
max_speed = Slider(16000, range=0..51200)
value = BooleanToggle(True)
send = Button()
extruder_data = PythonScript(motor_state=value, max_speed=max_speed, speed=speed, send=send)  # -> urscript; inputs motor_state: Boolean
# ---------- extruder_data: Python ----------
import time
from scriptcontext import sticky as st
from extruder_control.extruderclient import ExtruderClient

ext_ip = st["ext_ip"]
ext_port = st["ext_port"]

ec = ExtruderClient(ext_ip, ext_port)
wait_for_response = False

if send:
    ec.connect()
    time.sleep(0.2)
    ec.send_motordata(motor_state, max_speed, speed, wait_for_response)
    time.sleep(0.2)
    ec.close()
# ---------- end extruder_data ----------

# ----
# Toggle Extruder
value_2 = BooleanToggle(False)
send_2 = Button()
extruder_state = PythonScript(state=value_2, send=send_2)  # -> urscript; inputs state: Boolean
# ---------- extruder_state: Python ----------
import time
from scriptcontext import sticky as st
from extruder_control.extruderclient import ExtruderClient

ext_ip = st["ext_ip"]
ext_port = st["ext_port"]

ec = ExtruderClient(ext_ip, ext_port)
wait_for_response = False

if send:
    ec.connect()
    time.sleep(0.2)
    ec.send_motorstate(int(state), wait_for_response)
    time.sleep(0.2)
    ec.close()
# ---------- end extruder_state ----------

# ----
# SERVER
button = Button()
feedbackserver = GhPythonScript(create=button, clear=Button(), close=Button())  # -> server
# ---------- feedbackserver: Python ----------
__author__ = "Gido"
__version__ = "2022.05.16"

import rhinoscriptsyntax as rs
from scriptcontext import sticky as st
from fabrication_manager.communication import TCPFeedbackServer

server_ip = st["server_ip"]
server_port = st["server_port"]

server = TCPFeedbackServer(server_ip, server_port)

if clear:
    server.clear()
    
if close:
    server.shutdown()
# ---------- end feedbackserver ----------

# ----
# Toggle Extruder and Air ON
max_speed_2 = Slider(24000, range=0..24000)
speed_2 = Slider(1000, range=0..16000)
value_3 = BooleanToggle(True)
send_3 = Button()
list_2 = ValueList({"8"}, selected="8")
extruder_data_2 = PythonScript(state=value_3, max_speed=max_speed_2, speed=speed_2, pin=list_2, send=send_3)  # -> urscript; inputs state: Boolean
# ---------- extruder_data_2: Python ----------
import time
from scriptcontext import sticky as st
from extruder_control.extruderclient import ExtruderClient

ext_ip = st["ext_ip"]
ext_port = st["ext_port"]

ec = ExtruderClient(ext_ip, ext_port)
wait_for_response = False

if send:
    ec.connect()
    time.sleep(0.2)
    ec.send_motordata(int(state), max_speed, speed, wait_for_response)
    ec.send_set_do(pin, int(state), wait_for_response)
    time.sleep(0.2)
    ec.close()
# ---------- end extruder_data_2 ----------

# ----
# Toggle air
value_4 = BooleanToggle(False)
send_4 = Button()
list_3 = ValueList({"8"}, selected="8")
digital_out = PythonScript(pin=list_3, state=value_4, send=send_4)  # -> urscript; inputs pin: Int32, state: Boolean
# ---------- digital_out: Python ----------
import time
from scriptcontext import sticky as st
from extruder_control.extruderclient import ExtruderClient

ext_ip = st["ext_ip"]
ext_port = st["ext_port"]

ec = ExtruderClient(ext_ip, ext_port)
wait_for_response = False

if send:
    ec.connect()
    time.sleep(0.2)
    ec.send_set_do(pin, int(state), wait_for_response)
    time.sleep(0.2)
    ec.close()
# ---------- end digital_out ----------

next_task = Button()

# ----
# FABRICATION STATE  VIEWER
fabrication_state = PythonScript(update=Toggle(False))  # -> out, state, num_tasks, num_current_task, num_tasks_left, log_messages
# ---------- fabrication_state: Python ----------
from scriptcontext import sticky as st
from compas_ghpython.utilities import update_component

fabrication = st["fabrication"]

if hasattr(fabrication, "fab_thread"):
    if fabrication.fab_thread.is_alive():
        state = "THREAD RUNNING"
    else:
        state = "THREAD STOPPED"
else:
    state = "THREAD NOT STARTED"

num_tasks = len(fabrication.tasks)
if fabrication.current_task_key is not None:
    num_current_task = fabrication.current_task_key
else:
    num_current_task = 0
num_tasks_left = num_tasks-num_current_task
log_messages = fabrication.log_messages

if update:
    update_component(ghenv, 1000)
# ---------- end fabrication_state ----------
num_tasks = Panel(fabrication_state.num_tasks)
num_current_task = Panel(fabrication_state.num_current_task)
state = Panel(fabrication_state.state)
log_messages = Panel(fabrication_state.log_messages)

# ----
# SIMULATION ENVIRONMENT
py_3 = PythonScript()  # -> repositories_path, rbvogui_data_path, ur_data_path
# ---------- py_3: Python ----------
import os

"""
ASSUMING THE BELOW PACKAGES ARE STORED IN THE SAME LOCATION:
    ur_fabrication_control;
    rbvogui_common; and
    mobile_additive_manufacturing.
"""

repositories_path = os.path.abspath(os.path.join(ghdoc.Path,"../../../"))

assert os.path.exists(os.path.join(repositories_path, "ur_fabrication_control/data"))
assert os.path.exists(os.path.join(repositories_path, "rbvogui_common/rbvogui_description"))
assert os.path.exists(os.path.join(repositories_path, "mobile_fabrication_control"))

ur_data_path = os.path.abspath(os.path.join(ghdoc.Path,"../../../ur_fabrication_control/data"))
rbvogui_data_path = os.path.abspath(os.path.join(repositories_path, "rbvogui_common"))
# ---------- end py_3 ----------
list_4 = ValueList({"ur3.urdf", "ur3_rot.urdf", "ur5.urdf", "ur10.urdf", "ur3e.urdf", "ur5e.urdf", "ur10e.urdf", "ur10e_rot.urdf"}, selected="ur10e_rot.urdf")
list_5 = ValueList({"ur3.srdf", "ur5.srdf", "ur10.srdf", "ur3e.srdf", "ur5e.srdf", "ur10e.srdf"}, selected="ur10e.srdf")
list_6 = ValueList({"realsense": 0, "keyence": 1}, selected="realsense")
py_4 = PythonScript()  # -> DATA
# ---------- py_4: Python ----------
import os

#package_path = os.path.dirname(mobile_fabrication_control.__file__)
#DATA = os.path.abspath(os.path.join(package_path,"../../data"))

package_path = ghdoc.Path
# package_path = os.path.dirname(ur_fabrication_control.__file__)
#DATA = os.path.abspath(os.path.join(package_path,"../../data"))

# .stl files not stored in am_hackathon repo. but in mobile_fabrication_control
DATA = os.path.abspath(os.path.join(package_path,"../../../workshop_aaec_revamp/data"))

print(package_path)
print(DATA)
# ---------- end py_4 ----------
plane_nr = Slider(0, range=0..200)
list_7 = ValueList({"Zero": 0, "One": 1, "Two": 2, "Three": 3, "Four": 4, "Five": 5}, selected="Zero")

# ----
# Robot Model
# Load Model
list_8 = ValueList({"ur_description", "ur_e_description", "ur_setups"}, selected="ur_e_description")
py_5 = PythonScript(
    repositories_path=py_3.repositories_path,
    rbvogui_data_path=py_3.rbvogui_data_path,
    ur_data_path=py_3.ur_data_path,
    package=list_8,
    urdf_name=list_4,
    srdf_name=list_5)  # -> loaders, urdf_filename, srdf_filename
# ---------- py_5: Python ----------
import os
from compas.robots import LocalPackageMeshLoader

#loaders

ur_path = os.path.join(ur_data_path, "robot_description")
ur_packages = ["ur_description", "ur_e_description", "ur_end_effectors", "ur_setups"]
ur_loaders = [LocalPackageMeshLoader(ur_path, pck) for pck in ur_packages]

rbvogui_packages = ["rbvogui_description"]
rbvogui_loaders = [LocalPackageMeshLoader(rbvogui_data_path, pck) for pck in rbvogui_packages]

ewellix_packages = ["ewellix_description"]
ewellix_loaders = [LocalPackageMeshLoader(repositories_path, pck) for pck in ewellix_packages]

sensors_packages = ["robotnik_sensors"]
sensors_loaders = [LocalPackageMeshLoader(repositories_path, pck) for pck in sensors_packages]

loaders = ur_loaders + rbvogui_loaders + ewellix_loaders + sensors_loaders

#files
urdf_filename = os.path.join(repositories_path, r"mobile_fabrication_control\data\rbvogui_xl_lift_ur10e.urdf")
srdf_filename = os.path.join(repositories_path, r"mobile_fabrication_control\data\rbvogui.srdf")

assert os.path.isfile(urdf_filename)
assert os.path.isfile(srdf_filename)
# ---------- end py_5 ----------
units = ValueList({"m": 1, "cm": 100, "mm": 1000}, selected="m")
load = Button()
create = PythonScript(
    load=load,
    ur_base_frame_rhino_local_tf=python_2.ur_base_frame_rhino_local_tf,
    loaders=py_5.loaders,
    urdf_filename=py_5.urdf_filename,
    srdf_filename=py_5.srdf_filename,
    scale_factor=units)  # -> out, robot, rcf; inputs load: Boolean, loaders: list
# ---------- create: Python ----------
import os
from scriptcontext import sticky as st

import compas

from compas_ghpython import draw_frame
from compas.robots import RobotModel
from compas.robots import LocalPackageMeshLoader

from compas_fab.robots import Robot
from compas_fab.robots import RobotSemantics
from compas_fab.ghpython import RobotArtist

compas.PRECISION = '12f'

# store robot in component
guid = str(ghenv.Component.InstanceGuid)
robot_key = "robot"

if robot_key not in st:
    st[robot_key] = None

#print loaders
if load:
    model = RobotModel.from_urdf_file(urdf_filename)
    
    model.load_geometry(*loaders)
    artist = RobotArtist(model)
    semantics = RobotSemantics.from_srdf_file(srdf_filename, model)
    robot = Robot(model, artist, semantics, client=None)
    
    st[robot_key] = robot

robot = st[robot_key]
print(robot)
rcf = draw_frame(robot.get_RCF())
print(rcf)

if robot:
    robot.scale(scale_factor)
    robot.RCF_in_WCF = ur_base_frame_rhino_local_tf
# ---------- end create ----------
robot = Data(create.robot)

# ----
# Tool
list_9 = ValueList({"measurement_tool": 0, "clay_extruder_v21_7mm": 3, "scanner_tool": 4}, selected="clay_extruder_v21_7mm")
show = BooleanToggle(False)
python_3 = PythonScript(data_path=py_4, tool=list_9, tcp_frame=list_6, show=show)  # -> tool, M, ee_plane; inputs tcp_frame: Int32
# ---------- python_3: Python ----------
import os, math
from compas.geometry import Frame, Rotation
from compas.datastructures import Mesh
from compas_ghpython.artists import MeshArtist
from compas_fab.robots import Tool
from compas_ghpython.utilities import draw_frame

tolerance = 0

if tool == 0:
    filename = 'measurement_tool_zaxis.stl'
    ee_frame = Frame([0, 0, 0.109], [1, 0, 0], [0, 1, 0])

elif tool == 1:
    filename = 'clay_extruder_7mm.stl'
    # real frame:
    ee_frame = Frame([-0.000502, -0.105348, 0.0662,], [1, 0, 0], [0, 0, 1])
    
    # test frame:
    # ee_frame = Frame([0.0, 0.0, 0.1,], [1, 0, 0], [0, 1, 0])
elif tool == 2:
    filename = 'clay_extruder_7mm_with_2d_laser.stl'
    # non-rotated frame:
    if tcp_frame == "nozzle":
        ee_frame = Frame([-0.0013, -0.0053, 0.3441,], [1, 0, 0], [0, 1, 0])
    elif tcp_frame == "scanner":
        # Original frame
#        ee_frame = Frame([-0.0493, -0.0063, 0.3949,], [-1, 0, 0], [0, -1, 0])
        # Raised frame
        ee_frame = Frame([-0.0493, -0.0063, 0.4200,], [-1, 0, 0], [0, -1, 0])

elif tool == 3:
    filename = 'clay_extruder_v21_7mm.stl'
    ee_frame = Frame([0, 0, 0.33821], [1, 0, 0], [0, 1, 0])

elif tool == 4:
    filename = 'scanner_end_effector_v2.stl'
    if tcp_frame == 0: # Realsense
        ee_frame = Frame([0.0693178,-0.01232132,0.239685], [0,-1,0], [1,0,0])
    elif tcp_frame == 1: # Keyence
        ee_frame = Frame([0.0110607,0.00809854,0.41498], [0,-1,0], [-1,0,0])

data_path = os.path.join(data_path, "tool_geometry")
fullfilename = os.path.join(data_path, filename)
print fullfilename

ee_mesh = Mesh.from_stl(fullfilename)

#R = Rotation.from_axis_and_angle(ee_frame.zaxis, math.radians(180), point=ee_frame.point)
#ee_frame.transform(R)

if show:
    artist = MeshArtist(ee_mesh)
    M = artist.draw()

tool = Tool(ee_mesh, ee_frame)
ee_plane = draw_frame(ee_frame)
print(ee_frame.quaternion.xyzw)
ee_framek = Frame([0.0110607,0.00809854,0.41498], [0,1,0], [1,0,0])
print(ee_framek.quaternion.xyzw)
# ---------- end python_3 ----------
panel_4 = Panel("Attach a custom tool")
py_6 = PythonScript(robot=robot, tool=python_3.tool, attach=Toggle(True))  # -> a
# ---------- py_6: Python ----------
if attach:
    robot.attach_tool(tool, group = "ur10e")
else:
    robot.detach_tool()
# ---------- end py_6 ----------

# ----
# Get Pose Cartesian
get = Button()
pose = PythonScript(get=get, tool=python_3.tool, from_robot=Toggle(False))  # -> pose_cartesian, frame_WCS, plane_WCS
# ---------- pose: Python ----------
from scriptcontext import sticky as st
from ur_fabrication_control.direct_control.common import get_current_pose_cartesian
from compas.geometry import Frame
from compas_ghpython import draw_frame

robot = st["robot"]

server_ip = st["server_ip"]
server_port = st["server_port"]
ur_port = st["ur_port"]
ur_ip = st["ur_ip"]

# retrieve the current tool frame in axis angle format
if from_robot:
    if robot.attached_tool:
        tool_angle_axis = list(robot.attached_tool.frame.point) + list(robot.attached_tool.frame.axis_angle_vector)
    else:
        tool0_frame = Frame([0, 0, 0], [1, 0, 0], [0, 1, 0])
        tool_angle_axis = list(tool0_frame.point) + list(tool0_frame.axis_angle_vector)
else:
    tool_angle_axis = list(tool.frame.point) + list(tool.frame.axis_angle_vector)

print(tool_angle_axis)

guid = str(ghenv.Component.InstanceGuid)
pose_cartesian_key = "pose_cartesian" + guid


if get:
    st[pose_cartesian_key] = get_current_pose_cartesian(tool_angle_axis, server_ip, server_port, ur_ip, ur_port, send=True)

if pose_cartesian_key not in st:
    pose_cartesian = []
else:
    pose_cartesian = st[pose_cartesian_key]

print(pose_cartesian)

# get frame and plane of the current pose cartesian in world coordinates for visualization
if pose_cartesian:
    frame_RCS = Frame.from_axis_angle_vector(axis_angle_vector=pose_cartesian[3:], point=pose_cartesian[:3])
    frame_WCS = robot.RCF_in_WCF.to_world_coordinates(frame_RCS)
    plane_WCS  = draw_frame(frame_WCS)
    print frame_RCS
    print frame_WCS
# ---------- end pose ----------
draw = GhPythonScript(frames=pose.frame_WCS, scale=Slider(0.1, range=0..1))  # -> P, V, W; inputs frames: list
# ---------- draw: Python ----------
from System.Drawing import Color
from compas_ghpython.utilities import draw_frame

red = Color.FromArgb(255, 0, 0)
green = Color.FromArgb(0, 255, 0)
blue = Color.FromArgb(0, 0, 255)

P = []
V = []
C = []

scale = float(scale)

for frame in frames:
    if not frame:
        continue
    plane = draw_frame(frame)
    P += [plane.Origin] * 3
    V.append(plane.XAxis * scale)
    V.append(plane.YAxis * scale)
    V.append(plane.ZAxis * scale)
    C += [red, green, blue]

W = 3
# ---------- end draw ----------
vdisex = VectorDisplayEx(Point=draw.P, Vector=draw.V, Colour=RGB(0, 0, 0), Width=draw.W)
panel_5 = Panel(pose.pose_cartesian)

pln = Plane(create.rcf)

# ----
# Info
info = PythonScript(robot=robot)  # -> out, main_group_name
# ---------- info: Python ----------
if robot:
    robot.info()
    main_group_name = robot.main_group_name
# ---------- end info ----------
panel_6 = Panel(info.out)

# ---- group: forward kinematics
# Configuration
a1 = Slider(45, range=-360..360)
a2 = Slider(-45, range=-360..360)
a3 = Slider(135, range=-360..360)
a5 = Slider(-90, range=-360..360)
a6 = Slider(0, range=-360..360)
a4 = Slider(-180, range=-360..360)
jp = GhPythonScript()  # -> joint_positions
# ---------- jp: Python ----------
import math

joint_positions = [0,-90,90,0,90,0]
joint_positions = [math.radians(a) for a in joint_positions]
#joint_positions = [-3.136, -0.328, -1.218, 3.129, 0.852, 0.008]
#joint_positions = [0] * 6



#joint_positions = [1.6239667567485938, 0.25439606475392273, 4.409424838594969-2*3.14, 3.1901607306255908, 1.5707963267948954, 0.053170429953696939]
#joint_positions = [1.598543436748912, 0.23021224965157744, 4.712232135219824-2*3.14, 6.0531299026928744, 4.7123889803846915, 0.027747109954015234]
#joint_positions = [-1.1373533430447322, 4.0117247163121572, 5.4083762087596021-2*3.14, 1.5754733624925168, 4.7123889803846879, 3.5750356373399574]
print joint_positions
# ---------- end jp ----------
forward_kinematics = PythonScript(robot=robot, set_joint_positions=Button(), joint_positions=jp, a1=a1, a2=a2, a3=a3, a4=a4, a5=a5, a6=a6)  # -> full_configuration; inputs joint_positions: list
# ---------- forward_kinematics: Python ----------
import math
import Grasshopper
from compas.robots import Joint
from compas_fab.robots import Configuration

if set_joint_positions:

    j = 0
    for i in range(ghenv.Component.Params.Input.Count):
        nslider = ghenv.Component.Params.Input[i].Sources[0]
        if nslider.GetType() == Grasshopper.Kernel.Special.GH_NumberSlider:
            nslider.TrySetSliderValue(math.degrees(joint_positions[j]))
            j += 1

if robot:
    joint_positions = [a1, a2, a3, a4, a5, a6]
    joint_types = robot.get_configurable_joint_types()
    for i, joint_type in enumerate(joint_types):
        if joint_type == Joint.REVOLUTE:
            joint_positions[i] = math.radians(joint_positions[i])
    full_configuration = Configuration(joint_positions, joint_types)
    
print(full_configuration)
# ---------- end forward_kinematics ----------

# ---- group: inverse kinematics
select_configuration = Slider(0, range=0..7)
inverse = PythonScript(robot=robot, group=info.main_group_name, idx=select_configuration)  # -> out, plane_tool0_RCS, plane_tcp_RCS, configuration; inputs plane_WCS: Plane, idx: Int32
# ---------- inverse: Python ----------
import Rhino.Geometry as rg
import math
from compas.geometry import Frame, Transformation, Rotation
from compas_fab.robots import Configuration
from ur_fabrication_control.kinematics.ur_kinematics import inverse_kinematics
from ur_fabrication_control.kinematics.ur_params import ur_params
from compas_ghpython import draw_frame

tcp_WCS = Frame(plane_WCS.Origin, plane_WCS.XAxis, plane_WCS.YAxis)

# transform frame to robot coordinate system
print tcp_WCS
print plane_WCS
tcp_RCS = robot.RCF_in_WCF.to_local_coordinates(tcp_WCS)

tool0_RCS = robot.from_tcf_to_t0cf([tcp_RCS])[0]
print tcp_RCS
print tool0_RCS
plane_tool0_RCS = draw_frame(tool0_RCS)
plane_tcp_RCS = draw_frame(tcp_RCS)
# calculate solutions to frame
ur_params = ur_params["ur10e"] # get the parameters according to the robot model
print ur_params
solutions = inverse_kinematics(tool0_RCS, ur_params)
print solutions

if not len(solutions):
    joint_values = [0,0,0,0,0,0]
    configuration = Configuration.from_revolute_values(joint_values)
else:
    joint_values = solutions[idx]
    #print joint_values
    
    ### ***** HACK ***** ##### TODO: CHECK!!!
    for i, v in enumerate(joint_values):
        if v > math.pi:
            v -= 2*math.pi
        if v < -math.pi:
            v += 2*math.pi
        joint_values[i] = v
    ### ***** HACK ***** ##### TODO: CHECK!!!
    configuration = [Configuration.from_revolute_values(joint_values)]

print(configuration)
# ---------- end inverse ----------

select_configuration_2 = Slider(2, range=0..7)
# Block is red due to invalid inputs, though remains perfectly functional
inverse_2 = PythonScript(robot=robot, planes_WCS=python.planes_data, plane_nr=plane_nr, idx=select_configuration_2)  # -> out, plane_tool0_RCS, plane_tcp_RCS, configuration; inputs planes_WCS: list of Plane, plane_nr: Int32, idx: Int32
# ---------- inverse_2: Python ----------
import Rhino.Geometry as rg
import math
from compas.geometry import Frame, Transformation, Rotation
from compas_fab.robots import Configuration
from ur_fabrication_control.kinematics.ur_kinematics import inverse_kinematics
from ur_fabrication_control.kinematics.ur_params import ur_params
from compas_ghpython import draw_frame

plane_WCS = planes_WCS[plane_nr]
tcp_WCS = Frame(plane_WCS.Origin, plane_WCS.XAxis, plane_WCS.YAxis)

# transform frame to robot coordinate system
tcp_RCS = robot.RCF_in_WCF.to_local_coordinates(tcp_WCS)
tool0_RCS = robot.from_tcf_to_t0cf([tcp_RCS])[0]

print tcp_RCS
print tool0_RCS
plane_tool0_RCS = draw_frame(tool0_RCS)
plane_tcp_RCS = draw_frame(tcp_RCS)
# calculate solutions to frame
ur_params = ur_params["ur10e"] # get the parameters according to the robot model
solutions = inverse_kinematics(tool0_RCS, ur_params)

if not len(solutions):
    joint_values = [0,0,0,0,0,0]
    configuration = Configuration.from_revolute_values(joint_values)
else:
    joint_values = solutions[idx]
    #print joint_values
    
    ### ***** HACK ***** ##### TODO: CHECK!!!
    for i, v in enumerate(joint_values):
        if v > math.pi:
            v -= 2*math.pi
        if v < -math.pi:
            v += 2*math.pi
        joint_values[i] = v
    ### ***** HACK ***** ##### TODO: CHECK!!!
    
    configuration = [Configuration.from_revolute_values(joint_values)]

print(configuration)
# ---------- end inverse_2 ----------

# ----
list_10 = ValueList({"0 forward_kinematics": 0, "1 inverse_kinematics": 1, "2 inverse_kinematics": 2}, selected="2 inverse_kinematics")
filter = StreamFilter(Gate=list_10, Stream0=forward_kinematics, Stream1=inverse.configuration, Stream2=inverse_2.configuration)

plane_8 = Plane(inverse_2.plane_tcp_RCS)

# ----
# Visualisation
show_end_effector_frame = BooleanToggle(True)
show_base_frame = BooleanToggle(False)
show_collision = BooleanToggle(False)
show_frames = BooleanToggle(True)
show_visual = BooleanToggle(True)
show_acm = BooleanToggle(False)
visualize = PythonScript(
    robot=robot,
    tool=python_3.tool,
    group=info.main_group_name,
    configuration=filter,
    redraw=py_6,
    show_visual=show_visual,
    show_collision=show_collision,
    show_end_effector_frame=show_end_effector_frame,
    show_frames=show_frames,
    show_base_frame=show_base_frame,
    show_acm=show_acm,
    station=list_7)  # -> out, robot, visual, collision, attached_meshes, frames, ee_frame, tool0_frame, base_frame, base_pt; inputs redraw: list, attached_collision_meshes: list, station_pts: list
# ---------- visualize: Python ----------
import rhinoscriptsyntax as rs
import Rhino.Geometry as rg
import ghpythonlib.components as ghcomp
from compas.geometry import Vector
from compas.geometry import Point
from compas.geometry import Transformation
from compas.geometry import Frame
from compas_ghpython.artists import MeshArtist
from compas_ghpython.utilities import draw_frame
from compas_fab.robots import Configuration
from ur_fabrication_control.kinematics.ur_kinematics import forward_kinematics
from ur_fabrication_control.kinematics.ur_params import ur_params

print(configuration)

if robot and configuration:
    
    robot.update(configuration, visual=show_visual, collision=show_collision)
    ur_params = ur_params[robot.main_group_name]
    print(ur_params)
    if show_visual:
        visual = robot.artist.draw_visual()
        robot_RCF = draw_frame(robot.RCF_in_WCF)
        init_robot_plane = rg.Plane(rg.Point3d(0.275, 0.0, 1.105), rg.Vector3d(-0.707, 0.707, 0.0), rg.Vector3d(-0.707, -0.707,0.0))
        visual = ghcomp.Orient(visual, init_robot_plane, robot_RCF)[0]
        
    if show_collision:
        collision = robot.artist.draw_collision()
    
    frames = robot.transformed_frames(configuration, group)

    if show_base_frame:
        base_frame = frames[0]

    if show_end_effector_frame:
#        tool0_frame = forward_kinematics(configuration.revolute_values, ur_params)
        tool0_frame = robot.forward_kinematics(configuration, group)
        print tool0_frame
        ee_frame = robot.from_t0cf_to_tcf([tool0_frame])
        print("End-effector", ee_frame)
    
    if not show_frames:
        frames = None

#    frame = forward_kinematics(configuration.revolute_values, ur_params)
    frame = robot.forward_kinematics(configuration, options=dict(solver='model', link_name=robot.attached_tool.link_name))
    #robot.artist.update_tool(visual=visual, collision=collision, transformation=Transformation.from_frame_to_frame(Frame.worldXY(), tool0_frame))
    
    if show_acm:
        M = []
        for acm in attached_collision_meshes:
            frame = robot.forward_kinematics(configuration, options=dict(solver='model', link_name=acm.link_name))
            T = Transformation.from_frame_to_frame(Frame.worldXY(), frame)
            mesh = acm.collision_mesh.mesh.transformed(T)
            M.append(MeshArtist(mesh).draw())
        attached_meshes = M
# ---------- end visualize ----------
geo = Geometry(visualize.visual)
geo_2 = Geometry(visualize.collision)
draw_2 = GhPythonScript(frames=[visualize.frames, visualize.ee_frame, visualize.base_frame], scale=Slider(0.1, range=0..1))  # -> P, V, C, W; inputs frames: list; same code as draw
preview = CustomPreview(Geometry=geo, Shader=ColourSwatch(SwatchColor=RGB(105, 105, 105)))
preview_2 = CustomPreview(Geometry=visualize.attached_meshes, Shader=ColourSwatch(SwatchColor=RGB(255, 255, 255)))
vdisex_2 = VectorDisplayEx(Point=draw_2.P, Vector=draw_2.V, Colour=draw_2.C, Width=draw_2.W)

orient_2 = Orient(Geometry=plane_8, Source=PlaneXY(0, 0, 0), Target=pln)  # -> Geometry, Transform

# ----
# PRINT TASKS
number_slider_2 = Slider(0.014, range=0..1)
printtasks = GhPythonScript(create=Button(), robot=robot, robot_speed=number_slider_2, server=feedbackserver, planes_data=python.planes_data)  # -> out, tasks; inputs planes_data: list
# ---------- printtasks: Python ----------
from scriptcontext import sticky as st
from ur_fabrication_control.direct_control.fabrication_process import URTask
from extruder_control.fabrication import EXTTask
from ur_fabrication_control.direct_control import URScript
from compas.geometry import Frame
from compas_ghpython.utilities import ghtree_to_list

ur_ip = st["ur_ip"]
ur_port = st["ur_port"]
server_ip = st["server_ip"]
server_port = st["server_port"]

def eval_data(data):
    tasks=[]
    datalist = []
    for item in data:
        if item == "extruder_on":
            tasks.append(urtask_from_data(datalist, len(tasks)))
            datalist = []
            exttask = EXTTask(key=len(tasks))
            exttask.add_function("send_set_do", 8, 1, True)
            exttask.add_function("send_motordata", 1, 24000, 1000, True)
            tasks.append(exttask)
        elif item == "extruder_off":
            tasks.append(urtask_from_data(datalist, len(tasks)))
            datalist = []
            exttask = EXTTask(key=len(tasks))
            exttask.add_function("send_motordata", 0, 24000, 1000, True)
#            exttask.add_function("send_set_do", 8, 0, True)
            tasks.append(exttask)
        elif len(datalist)>250:
            datalist.append(item)
            tasks.append(urtask_from_data(datalist, len(tasks)))
            datalist = []
        else:
            datalist.append(item)
    if len(datalist)>0:
        tasks.append(urtask_from_data(datalist, len(tasks)))
        datalist = []
        exttask = EXTTask(key=len(tasks))
        exttask.add_function("send_motordata", 0, 24000, 1000, True)
        exttask.add_function("send_set_do", 8, 0, True)
        tasks.append(exttask)
    return tasks

def urtask_from_data(data, key):
    planes = data
    req_msg = "Task_{}_Completed".format(key)
    urscript = urscript_from_data(planes, robot_speed, key, req_msg)
    new_task = URTask(server, urscript, req_msg, key)
    return new_task

def planes_to_frames(planes):
    return [Frame(plane.Origin, plane.XAxis, plane.YAxis) for plane in planes]

def get_frames_in_RCS(frames):
    return [robot.RCF_in_WCF.to_local_coordinates(frame) for frame in frames]

def urscript_from_data(planes, speed, pkey, exit_message):
    frames = planes_to_frames(planes)
    ur_script = URScript(ur_ip=ur_ip, ur_port=ur_port)
    tool_angle_axis = list(robot.attached_tool.frame.point) + list(robot.attached_tool.frame.axis_angle_vector)
    ur_script.start()
    ur_script.set_tcp(tool_angle_axis)
    RCS_frames = get_frames_in_RCS(frames)
    ur_script.add_line("textmsg(\">> TASK {}.\")".format(pkey))
    # Initialize first movement (with accelleration)
    ur_script.socket_open(server_ip, server_port, "Feedbackserver")
    
    for key, RCS_frame in enumerate(RCS_frames):
        if key == 0:
            ur_script.move_linear(RCS_frame, speed, 0.004)
            node_msg = {"TASK":pkey, "NODE":0}
            ur_script.socket_send_line_string(str(node_msg), socket_name="Feedbackserver")
        else:
            # Send all next frames of the layer (constant speed, no accelleration)
            ur_script.move_process(RCS_frame, speed, 0.004)
            node_msg = {"TASK":pkey, "NODE":key}
            ur_script.socket_send_line_string(str(node_msg), socket_name="Feedbackserver")
    ur_script.socket_close(name="Feedbackserver")# BS: Closing socket at the end of the loop
    # Signify ready
    ur_script.socket_open(server_ip, server_port, "Feedbackserver")
    ur_script.socket_send_line_string(exit_message, socket_name="Feedbackserver")
    ur_script.socket_close(name="Feedbackserver")# BS: Closing socket at the end of the loop
    #Finalize script
    ur_script.end()
    ur_script.generate()
    return ur_script

if create:
#    fabdata = [[planes_data[i], vels_data[i]] for i,p in enumerate(planes_data)]
    st["tasks"] = eval_data(planes_data)

tasks = st["tasks"]
print(tasks)
# ---------- end printtasks ----------

# ----
# CONTROL ENVIRONMENT
# FABRICATION MANAGER
# 3>
start_fabrication = Button()
stop_fabrication = Button()
set_tasks = Button()
init = Button()
fabricationmanager = PythonScript(
    server=feedbackserver,
    tasks=printtasks.tasks,
    init=init,
    parallelize=Toggle(False),
    set_tasks=set_tasks,
    start=start_fabrication,
    stop=stop_fabrication,
    next_task=next_task)  # -> out, server; inputs tasks: list
# ---------- fabricationmanager: Python ----------
from scriptcontext import sticky as st
from fabrication_manager.fabrication import FabricationManager

if init:
    fabrication = FabricationManager(server)
    fabrication.parallelize = parallelize
    st["fabrication"] = fabrication

fabrication = st["fabrication"]

if set_tasks:
    print "setting tasks"    
    fabrication.clear_tasks()
    fabrication.set_tasks(tasks)

if start:
    #if robot.is_connected(): #and arduino.is_connected():
    print "starting process"
    fabrication.start()

if stop:
    print "stopping process"
    fabrication.stop()
    
if reset:
    print "resetting process"
    fabrication.reset()

if next_task:
    t = fabrication.get_next_task()
    task_state_set(True, t)
    
if reset_task:
    t = fabrication.get_next_task()
    task_state_set(False, t)

if prev_task:
    t = fabrication.get_next_task()
    task_state_set(False, t)
    t = fabrication.tasks[fabrication.current_task_key-1]
    task_state_set(False, t)
    fabrication.get_next_task()

def task_state_set(state, t):
    t.is_completed = state
    t.is_running = False

server = fabrication.server
# ---------- end fabricationmanager ----------
num_tasks_left = Panel(fabrication_state.num_tasks_left)

# ----
# Toggle Extruder and Air Off
max_speed_3 = Slider(16000, range=0..16000)
speed_3 = Slider(1000, range=0..16000)
send_5 = Button()
value_5 = BooleanToggle(False)
list_11 = ValueList({"8"}, selected="8")
extruder_data_3 = PythonScript(state=value_5, max_speed=max_speed_3, speed=speed_3, pin=list_11, send=stop_fabrication)  # -> urscript; inputs state: Boolean; same code as extruder_data_2

# ----
# SERVER STATE  VIEWER
server_state = GhPythonScript(server=fabricationmanager.server)  # -> out, msgs, server_state, processing_state
# ---------- server_state: Python ----------
__author__ = "Gido"
__version__ = "2022.05.17"

import rhinoscriptsyntax as rs

msgs = server.msgs.values()
if hasattr(server, "server_thread"):
    if server.server_thread.is_alive():
        server_state = "RUNNING"
    else:
        server_state = "HALTED"
else:
    server_state = "NOT RUNNING"

if hasattr(server, "process_thread"):
    if server.process_thread.is_alive():
        processing_state = "RUNNING"
    else:
        processing_state = "HALTED"
else:
    processing_state = "NOT RUNNING"
# ---------- end server_state ----------
server_state_2 = Panel(server_state.server_state)
processing_state = Panel(server_state.processing_state)
server_messages = Panel(server_state.msgs)
