# Grasshopper definition mobile_robot_workspace_revamp_ema.ghx (Grasshopper 1.0.7)
# plug-ins: Volvox, Kangaroo2 Components, Pufferfish, Pancake, LunchBox

ext_ip = ValueList({"192.168.10.10", "192.168.10.20", "192.168.10.11", "192.168.10.12", "127.0.0.1", "192.168.10.111", "192.168.0.220", "192.168.0.30", "192.168.10.50", "0.0.0.0"}, selected="192.168.0.220")
ext_port = ValueList({"50003", "50004"}, selected="50004")

# ----
# Settings
# --> Set your IP address
# --> Set robot IP address
server_ip = ValueList({"192.168.10.44", "192.168.10.12", "192.168.10.11", "192.168.10.10", "192.168.10.2", "127.0.0.1", "192.168.10.111", "192.168.0.250", "192.168.0.30", "10.42.0.212", "10.42.0.133"}, selected="192.168.0.250")
ur_ip = ValueList({"192.168.10.10", "192.168.10.20", "192.168.10.11", "192.168.10.12", "127.0.0.1", "192.168.10.111", "192.168.0.210", "192.168.0.30"}, selected="192.168.0.210")
server_port = ValueList({"50002", "50003", "50005", "50006", "50007", "50008", "50009", "50010", "50011", "50012", "50013", "50014", "50015", "50016"}, selected="50011")
ur_port = ValueList({"30002"}, selected="30002")
globals = PythonScript(
    server_ip=server_ip,
    server_port=server_port,
    ur_ip=ur_ip,
    ur_port=ur_port,
    ext_ip=ext_ip,
    ext_port=ext_port,
    clear=Button())  # inputs server_port: Int32
# ---------- globals: Python ----------
from scriptcontext import sticky as st

st["server_ip"] = server_ip
st["server_port"] = server_port

st["ur_ip"] = ur_ip
st["ur_port"] = ur_port

st["ext_ip"] = ext_ip
st["ext_port"] = ext_port


if clear:
    st.clear()
# ---------- end globals ----------

# ----
# Check if UR robot
#  is available
ping = Button()
py = PythonScript(ip=ur_ip, ping=ping)  # -> out, trigger
# ---------- py: Python ----------
from scriptcontext import sticky as st
from ur_fabrication_control.direct_control.utilities import is_available

guid = str(ghenv.Component.InstanceGuid)
txt_key = "txt_" + guid
if txt_key not in st:
    st[txt_key] = ""

if ping:
    
    available = is_available(ip)
    
    if available:
        st[txt_key] = "%s is up!" % ip
        trigger = True
    else:
        st[txt_key] = "%s is down!" % ip
        trigger = False

print(st[txt_key])
# ---------- end py ----------
panel = Panel(py.out)

reload = Button()
panel_2 = Panel("Unload libraries")
# DESIGN ENVIRONMENT
py_2 = PythonScript(reload=reload)
# ---------- py_2: Python ----------
from compas_ghpython import unload_modules

if reload:
    unload_modules("compas")
    unload_modules("compas_fab")
    unload_modules("roslibpy")
    unload_modules("fabrication_control")
    unload_modules("assembly_information_model")
    unload_modules("am_information_model")
    unload_modules("ur_fabrication_control")
    unload_modules("workshop_aaec_revamp")
# ---------- end py_2 ----------

panel_3 = Panel("test_1.ply")

crv = Curve(<curve referenced from the Rhino model>)
pt = Point(<point referenced from the Rhino model>)
srf = Surface(crv)
srf_2 = Surface(srf)
pt_2 = Point(pt)
srf_cp = SurfaceClosestPoint(Point=pt_2, Surface=srf_2)  # -> Point, UVPoint, Distance
vec2pt = Vector2Pt(PointA=srf_cp.Point, PointB=pt_2, Unitize=False)  # -> Vector, Length
extr = Extrude(Base=srf_2, Direction=vec2pt.Vector)

# ---- group: Toggle true to read .ply file
toggle = BooleanToggle(True)

# ---- group: Click to create new .ply file, when camera connected
button = Button()

# ---- group: Name of the .ply file
list = ValueList({"frame_00.ply", "frame_01.ply", "frame_02.ply", "frame_03.ply", "frame_04.ply", "frame_05.ply", "frame_06.ply", "frame_07.ply", "frame_08.ply", "frame_09.ply"}, selected="frame_00.ply")

# ----
vsub = VoxelSubsampling(Size=Slider(0.001, range=0..0.001))

# ---- group: Change the path to your directory
data = GhPythonScript()  # -> data
# ---------- data: Python ----------
__author__ = "Gido"
__version__ = "2020.01.14"

import rhinoscriptsyntax as rs

# Path to directory containing .ply files
data = r"C:\Users\emakr\workspace\workshop_aaec_revamp\data"
# ---------- end data ----------

# ----
# Realsense capture
# -- Rough scan --
panel_4 = Panel("brick_wall_test_06_1.ply")
realsense_d435i = GhPythonScript(data=data, file=panel_4, create=button, read=toggle, transformed=Toggle(False))  # -> out, pc, cmesh, points, mesh
# ---------- realsense_d435i: Python ----------
__author__ = "Gido Dielemans"
__version__ = "2021.06.09"

import os
import rhinoscriptsyntax as rs
import scriptcontext as sc
import Rhino.Geometry as rg
from compas_ghpython.utilities import draw_points
from compas_ghpython.artists import MeshArtist
from compas.geometry import Transformation
from compas.files import PLY
from compas.rpc import Proxy
from compas.datastructures import Mesh
from compas.geometry import Pointcloud
from compas.geometry import Point
from compas_ghpython.artists import PointArtist
#from workshop_aaec_revamp import PointCloudArtist

# create filepath
filepath = os.path.join(data, file)
print(filepath)

# create a new file using RPC
if create:
    realsense = Proxy()
    # Locate script to execute with RPC
    realsense.package = 'workshop_aaec_revamp.sensors.realsense_d435i_methods'
    # Execute method from script using the Proxy
    realsense.export_to_ply(filepath)

# read the .ply file
if read:
    # check if there is a file with the name at the location
    assert os.path.isfile(filepath)
    # in case of an AssertionError please confirm the filepath and ensure the file is present
    
    # read the .ply file
    ply = PLY(filepath)
    ply.read()
    vertices = ply.parser.vertices
    faces = ply.parser.faces
    
    pc = Pointcloud(vertices)
    cmesh = Mesh.from_vertices_and_faces(vertices, faces)
    artist = MeshArtist(cmesh)
    mesh = artist.draw_mesh()
    
    pts = [{"pos":v.data} for i, v in enumerate(pc.points)]
    points = draw_points(pts)
#    points = rg.PointCloud()
#    points.AddRange(rhinopoints)
#    print(points.IsValid)
    
#    pcartist = PointCloudArtist(pc)
#    points = pcartist.draw()

#    print(pc.points[0].data)
#    points = draw_points([pt.data for pt in pc.points])
#    cmesh = Mesh.from_ply(filepath)
#    points = draw_points(points)
    
#    if transformed:
#        T = Transformation.from_frame(tool_frame)
#        npts = []
#        for pt in points:
#            cpt = Point(pt.X, pt.Y, pt.Z)
#            ncpt = cpt.transformed(T)
#            npts.append(PointArtist(ncpt).draw())
##        cpoints = [pt.transformed(T) for pt in cpoints]
#        points = npts
#        cmesh = cmesh.transformed(T)
# ---------- end realsense_d435i ----------

clo = Cloud(<cloud referenced from the Rhino model>)
Z = UnitZ(Factor=Slider(-1.01, range=-2..2))

volume = Volume(Geometry=extr)  # -> Volume, Centroid
scale = Scale(Geometry=extr, Center=volume.Centroid, Factor=Slider(2, range=0..10))  # -> Geometry, Transform

cloude = CloudEngine(Cloud=clo, Instruction0=vsub)
xy = XYPlane(Origin=Z)
decloud = DeconstructCloud(Cloud=cloude)  # -> Points, Normals, Colors
pln = Plane(Plane(origin=(-0.7193439642, 0.001401400122, 0), x=(0, -1, 0), y=(1, 0, 0)))
python = GhPythonScript(M=realsense_d435i.cmesh, PC=realsense_d435i.pc, plane=xy)  # -> out, split_pts
# ---------- python: Python ----------
from workshop_aaec_revamp import ScanModel

scanmodel = ScanModel()
# ---------- end python ----------
rec = DataRecorder(realsense_d435i.out, DataLimit=-10, RecordData=True)
pt_3 = Point(decloud.Points)
vec = VectorXYZ(XComponent=Slider(-0.107, range=-1..1), YComponent=Slider(0.056, range=-1..1), ZComponent=Slider(1.253, range=-2..2.001))  # -> Vector, Length
move = Move(Geometry=pln, Motion=vec.Vector)  # -> Geometry, Transform
pt_4 = Point(realsense_d435i.points)
pt_5 = Point(realsense_d435i.points)
cloud = ConstructCloud(Points=pt_4)  # disabled
panel_5 = Panel(rec)
orient = Orient(Geometry=pt_4, Source=PlaneXY(0, 0, 0), Target=move.Geometry)  # -> Geometry, Transform
orient_2 = Orient(Geometry=realsense_d435i.mesh, Source=PlaneXY(0, 0, 0), Target=move.Geometry)  # -> Geometry, Transform
brepinc = PointInBrep(Brep=scale.Geometry, Point=pt_3, Strict=False)
clo_2 = Cloud(cloud)
dispatch = Dispatch(List=pt_3, DispatchPattern=brepinc)  # -> ListA, ListB

# ----
# Removing floor
pdecon = Deconstruct(Point=orient.Geometry)  # -> XComponent, YComponent, ZComponent
pdecon_2 = Deconstruct(Point=pln)  # -> XComponent, YComponent, ZComponent
deplane = DeconstructPlane(Plane=pln)  # -> Origin, XAxis, YAxis, ZAxis
avr = Average(Input=pdecon.ZComponent)
pt_6 = ConstructPoint(XCoordinate=pdecon_2.XComponent, YCoordinate=pdecon_2.YComponent, ZCoordinate=0)
pl = ConstructPlane(Origin=pt_6, XAxis=deplane.XAxis, YAxis=deplane.YAxis)
addition = Addition(A=avr, B=Slider(0.02, range=0..0.1))
Z_2 = UnitZ(Factor=addition)
move_2 = Move(Geometry=pl, Motion=Z_2)  # -> Geometry, Transform
rectangle = Rectangle(Plane=move_2.Geometry, XSize=Domain(-1, 1), YSize=Domain(-1, 1), Radius=0)  # -> Rectangle, Length
Z_3 = UnitZ(Factor=1)
extr_2 = Extrude(Base=rectangle.Rectangle, Direction=Z_3)
cap = CapHoles(Brep=extr_2)
msplit = MeshSplitPlane(Mesh=orient_2.Geometry, Plane=move_2.Geometry)  # -> Above, Below
brepinc_2 = PointInBrep(Brep=cap, Point=orient.Geometry, Strict=False)
cull = CullPattern(List=orient.Geometry, CullPattern=brepinc_2)
mesh = Mesh(msplit.Above)

pdecon_3 = Deconstruct(Point=deplane.Origin)  # -> XComponent, YComponent, ZComponent
multiplication = Multiplication(A=[deplane.XAxis, deplane.YAxis], B=0.5)
panel_6 = Panel(deplane.Origin)
pt_7 = Point(dispatch.ListA)
ma = MassAddition(Input=multiplication)  # -> Result, PartialResults
multiplication_2 = Multiplication(A=deplane.XAxis, B=pdecon_3.XComponent)
multiplication_3 = Multiplication(A=deplane.YAxis, B=pdecon_3.YComponent)
multiplication_4 = Multiplication(A=deplane.ZAxis, B=pdecon_3.ZComponent)
dprod = DotProduct(VectorA=deplane.ZAxis, VectorB=deplane.Origin, Unitize=False)
del = DelaunayMesh(Points=pt_7, Plane=PlaneXY(0, 0, 0))
move_3 = Move(Geometry=pln, Motion=ma.Result)  # -> Geometry, Transform
ma_2 = MassAddition(Input=[multiplication_2, multiplication_3, multiplication_4])  # -> Result, PartialResults
clean = CombineClean(Meshes=del)
subtraction = Subtraction(A=deplane.Origin, B=move_3.Geometry)
mesh_2 = MeshBrep(
    Brep=extr,
    Settings={GridMaxCount=0, GridMinCount=16, JaggedSeams=False, MaxEdgeLength=0, MinEdgeLength=0.0001, MinTolerance=0, Refine=True, RefineAngle=0, RelativeTolerance=0.65, SimplePlanes=True, Tolerance=0})
weld = WeldMesh(Mesh=clean, Angle=3.141592654)
panel_7 = Panel(ma_2.Result)
dprod_2 = DotProduct(VectorA=deplane.ZAxis, VectorB=subtraction, Unitize=False)
clo_3 = Cloud(<cloud referenced from the Rhino model>)
redumsh = ReduceMesh(
    Mesh=weld,
    FaceCount=Slider(200, range=0..1000),
    Accuracy=Slider(10, range=0..10),
    FaceType=0,
    Distort="TRUE",
    Normalize=False)  # -> Reduced, CountDifference
msplit_2 = MeshSplit(Mesh=mesh_2, Splitters=redumsh.Reduced)
item = ListItem(List=msplit_2, Index=Slider(0, range=0..10), Wrap=True)

# ----
# Removing disjoint pieces
disjoint = DisjointMesh(Mesh=mesh)  # -> flatten(Meshes)
demesh = DeconstructMesh(Mesh=disjoint)  # -> Vertices, Faces, Colours, Normals
lng = ListLength(List=demesh.Vertices)  # -> flatten(Length)
sort = SortList(Keys=lng, ValuesA=lng)  # -> Keys, ValuesA
item_2 = ListItem(List=sort.ValuesA, Index=0, Wrap=True)  # -> Item1, Item
index = ItemIndex(List=lng, Item=item_2.Item1)
item_3 = ListItem(List=disjoint, Index=index, Wrap=True)

mesh_3 = Mesh(redumsh.Reduced)
local_grid_subdivisions = Slider(4, range=0..10)

# ----
# Creating boundary box and grid
bbox = BoundingBox(Content=cull, Plane=PlaneXY(0, 0, 0), UnionBox=True)  # -> Box, Box_2
debox = DeconstructBox(Box=bbox.Box)  # -> Plane, X, Y, Z
dedomain = DeconstructDomain(Domain=debox.X)  # -> Start, End
dedomain_2 = DeconstructDomain(Domain=debox.Y)  # -> Start, End
number_slider = Slider(0.03, range=0..0.1)
rectangle_2 = Rectangle(Plane=debox.Plane, XSize=debox.X, YSize=debox.Y, Radius=0)  # -> Rectangle, Length
subtraction_2 = Subtraction(A=dedomain_2.Start, B=dedomain_2.End)
subtraction_3 = Subtraction(A=dedomain.Start, B=dedomain.End)
abs = Absolute(Value=subtraction_3)
abs_2 = Absolute(Value=subtraction_2)
division = Division(A=abs, B=number_slider)
division_2 = Division(A=abs_2, B=number_slider)
round = Round(Number=division)  # -> Nearest, Floor, Ceiling
round_2 = Round(Number=division_2)  # -> Nearest, Floor, Ceiling
grid = GridStructure(Surface=rectangle_2.Rectangle, UDivisions=round.Ceiling, VDivisions=round_2.Ceiling)  # -> StructureLines, StructureNodes

global_grid_size = Slider(0.04, range=0..0.1)
tolerance = Slider(0.002, range=0..0.005)
move_4 = Move(Geometry=item, Motion="{0.100,0.100,0.100}")  # -> Geometry, Transform
move_5 = Move(Geometry=mesh_3, Motion="{0.100,0.100,0.100}")  # -> Geometry, Transform
divide = DivideCurve(Curve=grid.StructureLines, Count=Slider(5, range=0..10), Kinks=False)  # -> Points, Tangents, Parameters
clean_2 = CombineClean(Meshes=move_4.Geometry)
msh2psrf = MeshToPolysurface(Mesh=move_5.Geometry, Triangles=False, FaceMerge=False)
cullpt = CullDuplicates(Points=flatten(divide.Points), Tolerance=Slider(0.001, range=0..0.001), CullMode=3)  # -> Points, Indices, Valence

# ----
# Transform grid to pointcloud
demesh_2 = DeconstructMesh(Mesh=item_3)  # -> Vertices, Faces, Colours, Normals
pdecon_4 = Deconstruct(Point=demesh_2.Vertices)  # -> XComponent, YComponent, ZComponent
pt_8 = ConstructPoint(XCoordinate=pdecon_4.XComponent, YCoordinate=pdecon_4.YComponent, ZCoordinate=0)
cp = ClosestPoint(Point=cullpt.Points, Cloud=pt_8)  # -> ClosestPoint, CPIndex, Distance
smaller = SmallerThan(FirstNumber=cp.Distance, SecondNumber=Slider(0.002, range=0..0.1))  # -> SmallerThan, OrEqualTo
cull_2 = CullPattern(List=cp.CPIndex, CullPattern=smaller.SmallerThan)
item_4 = ListItem(List=demesh_2.Vertices, Index=cull_2, Wrap=True)

grid_to_pointcloud_frames = GhPythonScript(pointcloud=cull, density=global_grid_size, factor=local_grid_subdivisions, tolerance=tolerance)  # -> points_aligned_x, points_aligned_y, lines_x, lines_y, planes_x, planes_y; inputs pointcloud: list of Point3d, factor: Int32
# ---------- grid_to_pointcloud_frames: Python ----------
"""Provides a scripting component.
    Inputs:
        x: The x script variable
        y: The y script variable
    Output:
        a: The a output variable"""

__author__ = "emakr"
__version__ = "2022.09.30"

import rhinoscriptsyntax as rs
import math
from compas.geometry import bounding_box, Box, Point, KDTree, NurbsCurve, Vector, cross_vectors, Frame, angle_vectors, Rotation, length_vector
from compas_ghpython.utilities import draw_points, draw_frame, list_to_ghtree
from compas_ghpython.artists import CurveArtist
from math import ceil,floor, pi

bbox = bounding_box(pointcloud)
box = Box.from_bounding_box(bbox)
x_bounds = [box.xmin, box.xmax]
y_bounds = [box.ymin, box.ymax]
u_count = int(ceil(abs(box.xmin-box.xmax)/density))
v_count = int(ceil(abs(box.ymin-box.ymax)/density))
points_grid_x = [[] for i in range(u_count)]
points_grid_y = [[] for i in range(v_count)]
u_length = box.width/(u_count-1)
v_length = box.depth/(v_count-1)
cutoff_length = 0.03

for u in range(0,u_count):
    for v in range(0,v_count*factor):
        point = Point(box.xmin+u*(u_length),box.ymin+v*(box.depth/(v_count*factor-1)),0)
        points_grid_x[u].append(point)
        
for v in range(0,v_count):
    for u in range(0,u_count*factor):
        point = Point(box.xmin+u*(box.width/(u_count*factor-1)),box.ymin + v*(v_length),0)
        points_grid_y[v].append(point)


points_tuples = [Point(point.X,point.Y,0) for point in pointcloud]
points_kdtree = KDTree(points_tuples)

points_grid_nearest_x = [[] for i in range(u_count)]
points_grid_nearest_y = [[] for i in range(v_count)]

for i,points in enumerate(points_grid_x):
    for point in points:
        point_flat = Point(point.x,point.y,0)
        nearest_point, index, d = points_kdtree.nearest_neighbor(point_flat)
        nearest_point = Point(point.x,nearest_point[1],pointcloud[index].Z)
        if d < tolerance:
            points_grid_nearest_x[i].append(nearest_point)
            
for i,points in enumerate(points_grid_y):
    for point in points:
        point_flat = Point(point.x,point.y,0)
        nearest_point, index, d = points_kdtree.nearest_neighbor(point_flat)
        nearest_point = Point(nearest_point[0],point.y,pointcloud[index].Z)
        if d < tolerance:
            points_grid_nearest_y[i].append(nearest_point)


#points_grid_x = [{"pos":pt.data} for pt in points_grid_nearest_x]
#points_grid_x = draw_points(points_grid)
#points_grid_y = [{"pos":pt.data} for pt in points_grid_nearest_y]
#points_grid_y = draw_points(points_grid)

planes_x = []
planes_y = []
lines_x = []
lines_y = []


for points in points_grid_nearest_x:
    line_x = NurbsCurve.from_points(points)
    if len(points) > 5:
        m = 0
        n = len(points)
        planes = []
        for index, point in enumerate(points):
            if index == 0:
                vy = Vector.from_start_end(point,points[index+1])
                length = length_vector(vy)
            elif index == len(points)-1:
                vy = Vector.from_start_end(points[index-1],point)
            else:
                v1 = Vector.from_start_end(points[index-1],point)
                v2 = Vector.from_start_end(point,points[index+1])
                vy = v1+v2
                length = length_vector(Vector.from_start_end(point,points[index+1]))
            if vy.z < 0:
                vector_z = [0,0,-1]
                k = -1
            else:
                vector_z = [0,0,1]
                k=1
            if angle_vectors(vy, vector_z) > math.pi/3:  
                vy = Vector(vy.x,vy.y,0)
            elif angle_vectors(vy, vector_z) < math.pi/6: 
                vy = Vector(vy.x,vy.y,0)
                axis = cross_vectors(vy, Vector.Zaxis())
                R = Rotation.from_axis_and_angle(axis, k*math.pi/3)
                vy.transform(R)
            vx = cross_vectors(vy, Vector.Zaxis())
            planes.append(draw_frame(Frame(point, vx, -vy)))
            if index <= 2 and length > cutoff_length:
                m = index+1
            if len(points)-1 > index >= len(points)-4 and length > cutoff_length:
                if index < n:
                    n = index+1
        planes = planes[m:n]
        planes_x.extend(planes)
    artist = CurveArtist(line_x)
    lines_x.append(artist.draw())

for points in points_grid_nearest_y:
    line_y = NurbsCurve.from_points(points)
    if len(points) > 5:
        m = 0
        n = len(points)
        planes = []
        for index, point in enumerate(points):
            if index == 0:
                vy = Vector.from_start_end(point,points[index+1])
                length = length_vector(vy)
            elif index == len(points)-1:
                vy = Vector.from_start_end(points[index-1],point)
            else:
                v1 = Vector.from_start_end(points[index-1],point)
                v2 = Vector.from_start_end(point,points[index+1])
                vy = v1+v2
                length = length_vector(Vector.from_start_end(point,points[index+1]))
            if vy.z < 0:
                vector_z = [0,0,-1]
                k=-1
            else:
                vector_z = [0,0,1]
                k=1
            if angle_vectors(vy, vector_z) > math.pi/3:  
                vy = Vector(vy.x,vy.y,0)
            elif angle_vectors(vy, vector_z) < math.pi/6: 
                vy = Vector(vy.x,vy.y,0)
                axis = cross_vectors(vy, Vector.Zaxis())
                R = Rotation.from_axis_and_angle(axis, k*math.pi/3)
                vy.transform(R)
            vx = cross_vectors(vy, Vector.Zaxis())
            planes.append(draw_frame(Frame(point, vx, -vy)))
            if index <= 2 and length > cutoff_length:
                m = index+1
            if len(points)-1 > index >= len(points)-4 and length > cutoff_length:
                if index < n:
                    n = index+1
        planes = planes[m:n]
        planes_y.extend(planes)
    artist = CurveArtist(line_y)
    lines_y.append(artist.draw())

points_aligned_x = list_to_ghtree(points_grid_nearest_x)
points_aligned_y = list_to_ghtree(points_grid_nearest_y)
# ---------- end grid_to_pointcloud_frames ----------
msh2psrf_2 = MeshToPolysurface(Mesh=clean_2, Triangles=False, FaceMerge=False)
splitmul = SplitBrepMultiple(Brep=msh2psrf, Cutters=msh2psrf_2)
point = Point(grid_to_pointcloud_frames.points_aligned_x)
curve = Curve(grid_to_pointcloud_frames.lines_x)
point_2 = Point(grid_to_pointcloud_frames.points_aligned_y)
curve_2 = Curve(grid_to_pointcloud_frames.lines_y)
plane = Plane(grid_to_pointcloud_frames.planes_x)
plane_2 = Plane(grid_to_pointcloud_frames.planes_y)
item_5 = ListItem(List=splitmul, Index=Slider(1, range=0..10), Wrap=True)
end_points = EndPoints(Curve=curve_2)  # -> Start, End
polyline = PolyLine(Vertices=point, Closed=False)
geometry = Geometry(end_points.Start)
frame_generation = GhPythonScript()  # -> points_aligned_x, points_aligned_y, lines_x, lines_y, planes_x, planes_y; inputs points: list of Point3d, x_bounds: list, y_bounds: list, u_count: Int32, v_count: Int32; disabled
# ---------- frame_generation: Python ----------
__author__ = "emakr"
__version__ = "2022.09.29"

import rhinoscriptsyntax as rs
from compas_ghpython.utilities import list_to_ghtree, draw_frame
from compas_ghpython.artists import CurveArtist
from compas.geometry import NurbsCurve, Vector, cross_vectors, Point, Frame

x_segment = (x_bounds[1]-x_bounds[0])/u_count
y_segment = (y_bounds[1]-y_bounds[0])/v_count
x_values = []
y_values = []
points_aligned_x = [[] for i in range(u_count)]
points_aligned_y = [[] for i in range(v_count)]
lines_x = []
lines_y = []
planes_x = []
planes_y = []

for u in range(0,u_count):
    x_values.append(x_bounds[0]+x_segment*u)

for point in points:
    for x_value in x_values:
        if abs(point[0]-x_value) < 0.005:
            points_aligned_x[x_values.index(x_value)].append(point)

for v in range(0,v_count):
    y_values.append(y_bounds[0]+y_segment*v)

for point in points:
    for y_value in y_values:
        if abs(point[1]-y_value) < 0.005:
            points_aligned_y[y_values.index(y_value)].append(point)

for points in points_aligned_x:
    points.sort(key=lambda x: x[1])
    line_x = NurbsCurve.from_points(points)
    for index, point in enumerate(points):
        if index == 0:
            vy = Vector.from_start_end(point,points[index+1])
        elif index == len(points)-1:
            vy = Vector.from_start_end(points[index-1],point)
        else:
            v1 = Vector.from_start_end(points[index-1],point)
            v2 = Vector.from_start_end(point,points[index+1])
            vy = v1+v2
        vx = cross_vectors(vy, Vector.Zaxis())
        print(vx)
        planes_x.append(draw_frame(Frame(point, vx, vy)))
    artist = CurveArtist(line_x)
    lines_x.append(artist.draw())

"""
for points in points_aligned_y:
    points.sort(key=lambda x: x[0])
    line_y = NurbsCurve.from_points(points)
    for index, point in enumerate(points):
        if index == 0:
            vy = Vector.from_start_end(point,points[index+1])
        elif index == len(points)-1:
            vy = Vector.from_start_end(points[index-1],point)
        else:
            v1 = Vector.from_start_end(points[index-1],point)
            v2 = Vector.from_start_end(point,points[index+1])
            vy = v1+v2
        vx = cross_vectors(vy, Vector.Zaxis())
        planes_y.append(draw_frame(Frame(point, vx, vy)))
    artist = CurveArtist(line_y)
    lines_y.append(artist.draw())

"""

points_aligned_x = list_to_ghtree(points_aligned_x)
points_aligned_y = list_to_ghtree(points_aligned_y)
# ---------- end frame_generation ----------
merge = Merge(Data1=msh2psrf_2, Data2=item_5)

# ----
# xpaths
pdecon_5 = Deconstruct(Point=item_4)  # -> XComponent, YComponent, ZComponent
sort_2 = SortList(Keys=pdecon_5.YComponent, ValuesA=item_4)  # -> Keys, ValuesA
shift = ShiftList(List=sort_2.ValuesA, Shift=1, Wrap=False)
pdecon_6 = Deconstruct(Point=sort_2.ValuesA)  # -> XComponent, YComponent, ZComponent
pdecon_7 = Deconstruct(Point=shift)  # -> XComponent, YComponent, ZComponent
equalst = EqualityWithinTolerance(FirstNumber=pdecon_6.YComponent, SecondNumber=pdecon_7.YComponent, Tolerance=Slider(0.002, range=0..0.1))  # -> Equality, Inequality
cull_3 = CullPattern(List=sort_2.ValuesA, CullPattern=equalst.Inequality)
index_2 = ItemIndex(List=sort_2.ValuesA, Item=cull_3)
x_plus_one = XPlusOne(NumberX=index_2)
ins = InsertItems(List=x_plus_one, Item=0, Indices=0, Wrap=True)
path = ConstructPath(Indices=Slider(4, range=0..100))
cull_i = CullIndex(List=ins, Indices=-1, Wrap=True)
dom = ConstructDomain(DomainStart=cull_i, DomainEnd=index_2)
subset = SubList(List=sort_2.ValuesA, Domain=graft(dom), Wrap=True)  # -> List, Index
branch = TreeBranch(Tree=simplify(subset.List), Path=path, MaintainPaths=True)
pdecon_8 = Deconstruct(Point=subset.List)  # -> XComponent, YComponent, ZComponent
sort_3 = SortList(Keys=pdecon_8.XComponent, ValuesA=subset.List)  # -> Keys, ValuesA

join = BrepJoin(Breps=merge)  # -> Breps, Closed

# ----
# ypaths
shift_2 = ShiftList(List=item_4, Shift=1, Wrap=True)
pdecon_9 = Deconstruct(Point=shift_2)  # -> XComponent, YComponent, ZComponent
pdecon_10 = Deconstruct(Point=item_4)  # -> XComponent, YComponent, ZComponent
ln = Line(StartPoint=item_4, EndPoint=shift_2)
pt_9 = ConstructPoint(XCoordinate=pdecon_9.XComponent, YCoordinate=pdecon_9.YComponent, ZCoordinate=0)
pt_10 = ConstructPoint(XCoordinate=pdecon_10.XComponent, YCoordinate=pdecon_10.YComponent, ZCoordinate=0)
len = Length(Curve=ln)
dist = Distance(PointA=pt_10, PointB=pt_9)
larger = LargerThan(FirstNumber=dist, SecondNumber=Slider(0.079, range=0..0.1))  # -> LargerThan, OrEqualTo
cull_4 = CullPattern(List=ln, CullPattern=invert(larger.LargerThan))
join_2 = JoinCurves(Curves=cull_4, Preserve=False)
cp_2 = ControlPoints(Curve=join_2)  # -> Points, Weights, Knots
intcrv = Interpolate(Vertices=cp_2.Points, Degree=3, Periodic=False, KnotStyle=1)  # -> Curve, Length, Domain

list_2 = ValueList({"default", "measured", "initial"}, selected="default")

python_2 = GhPythonScript(choice=list_2, vertical_axis_height=Slider(0.288, range=0..0.72), vertical_axis_correction=Slider(0, range=-0.1..0.1))  # -> out, ur_base_frame_rhino_local_tf, ur_base_plane
# ---------- python_2: Python ----------
__author__ = "Gido"
__version__ = "2022.04.11"

import rhinoscriptsyntax as rs
from compas.geometry import Frame
from compas.geometry import Translation
from compas_ghpython.utilities import draw_frame

if choice=="measured":
    ur_base_frame_rhino_local_tf = Frame(ur_base_plane_rhino_local_tf.Origin, 
                                         ur_base_plane_rhino_local_tf.XAxis, 
                                         ur_base_plane_rhino_local_tf.YAxis)
    T = Translation.from_vector(ur_base_frame_rhino_local_tf.zaxis*(vertical_axis_height+vertical_axis_correction))
    ur_base_frame_rhino_local_tf = ur_base_frame_rhino_local_tf.transformed(T)
elif choice=="initial":
    ur_base_frame_rhino_local_tf = Frame(ur_base_plane_init.Origin, 
                                         ur_base_plane_init.XAxis, 
                                         ur_base_plane_init.YAxis)
    T = Translation.from_vector(ur_base_frame_rhino_local_tf.zaxis*(vertical_axis_height+vertical_axis_correction))
    ur_base_frame_rhino_local_tf = ur_base_frame_rhino_local_tf.transformed(T)

elif choice =="default":
    ur_base_frame_rhino_local_tf = Frame([0.207, 0.0, 1.215], [-0.707, 0.707, 0.0], [-0.707, -0.707,0.0])
    T = Translation.from_vector(ur_base_frame_rhino_local_tf.zaxis*(vertical_axis_height+vertical_axis_correction))
    ur_base_frame_rhino_local_tf = ur_base_frame_rhino_local_tf.transformed(T)


ur_base_plane = draw_frame(ur_base_frame_rhino_local_tf)
# ---------- end python_2 ----------

# ----
# Print parameters
path_resolution = Slider(1, range=0..100)
spiral_or_seam = Slider(1, range=0..1)
layer_height = Slider(5, range=0..30)
layer_width = Slider(3.5, range=0..200)

# ----
# Mesh to be printed
mesh_4 = Mesh(join.Breps)

# ----
# Obejct number /
# new export
export_data = Button()

speed = Slider(4500, range=0..10000)
flatten = FlattenTree(Tree=cp_2.Points, Path="{0}")
pdecon_11 = Deconstruct(Point=flatten)  # -> XComponent, YComponent, ZComponent
sort_4 = SortList(Keys=pdecon_11.XComponent, ValuesA=flatten)  # -> Keys, ValuesA

# ----
# Export Geometry
boolean_toggle = BooleanToggle(False)
directory = GhPythonScript(Number="1")  # -> FilePath
# ---------- directory: Python ----------
from ghpythonlib.componentbase import executingcomponent as component
import Grasshopper, GhPython
import System
import Rhino
import rhinoscriptsyntax as rs

class MyComponent(component):
    
    def RunScript(self, Number):
        """Provides a scripting component.
            Inputs:
                x: The x script variable
                y: The y script variable
            Output:
                a: The a output variable"""
        
        __author__ = "lachmayer"
        __version__ = "2022.05.24"
        
        import rhinoscriptsyntax as rs
        import os
        cwd = ghenv.Component.OnPingDocument().FilePath
        laenge = len(cwd)-12
        cwd1 = ""
        for i in range(laenge):
            cwd1 = (cwd1+cwd[i])
        cwd = cwd1
        cwd = cwd + "\mesh" + Number + ".stl"
        print(cwd)
        FilePath = cwd
                
        
        # return outputs if you have them; here I try it for you:
        return FilePath
# ---------- end directory ----------
pcexportstl = ExportSTL(
    Mesh=mesh_4,
    Relocate=boolean_toggle,
    SavePath=directory,
    SaveAsBinaryFile=True,
    SaveNow=export_data,
    LastSaveLocalization="neutral,N")

# ----
# Export Print parameters
directory_2 = GhPythonScript(Number="1")  # -> FilePath
# ---------- directory_2: Python ----------
from ghpythonlib.componentbase import executingcomponent as component
import Grasshopper, GhPython
import System
import Rhino
import rhinoscriptsyntax as rs

class MyComponent(component):
    
    def RunScript(self, Number):
        """Provides a scripting component.
            Inputs:
                x: The x script variable
                y: The y script variable
            Output:
                a: The a output variable"""
                
        __author__ = "lachmayer"
        __version__ = "2022.05.24"
                
        import rhinoscriptsyntax as rs
        import os
        cwd = ghenv.Component.OnPingDocument().FilePath
        laenge = len(cwd)-12
        cwd1 = ""
        for i in range(laenge):
            cwd1 = (cwd1+cwd[i])
        cwd = cwd1
        cwd = cwd + "\parameters" + Number + ".txt"
        print(cwd)
        FilePath = cwd
                
        
        # return outputs if you have them; here I try it for you:
        return FilePath
# ---------- end directory_2 ----------
merge_2 = Merge(Data1=layer_height, Data2=layer_width, Data3=path_resolution, Data4=spiral_or_seam)
join_3 = TextJoin(Text=merge_2, Join=";")
pcexporttxt = ExportTXT(
    Content=join_3,
    FileLocation=directory_2,
    Overwrite=export_data,
    Encoding="utf-8",
    Export=export_data,
    LastSaveLocalization="neutral,N")

shift_3 = ShiftList(List=sort_4.ValuesA, Shift=1, Wrap=False)
pdecon_12 = Deconstruct(Point=sort_4.ValuesA)  # -> XComponent, YComponent, ZComponent
pdecon_13 = Deconstruct(Point=shift_3)  # -> XComponent, YComponent, ZComponent
prune = PruneTree(Tree=sort_3.ValuesA, Minimum=5, Maximum=0)
equalst_2 = EqualityWithinTolerance(FirstNumber=pdecon_12.XComponent, SecondNumber=pdecon_13.XComponent, Tolerance=Slider(0.002, range=0..0.1))  # -> Equality, Inequality
shift_4 = ShiftList(List=prune, Shift=1, Wrap=True)
cull_5 = CullPattern(List=sort_4.ValuesA, CullPattern=equalst_2.Inequality)
dist_2 = Distance(PointA=prune, PointB=shift_4)
pline = PolyLine(Vertices=prune, Closed=False)  # -> flatten(Polyline)
index_3 = ItemIndex(List=sort_4.ValuesA, Item=cull_5)
x_plus_one_2 = XPlusOne(NumberX=index_3)
avr_2 = Average(Input=dist_2)  # -> flatten(ArithmeticMean)
ins_2 = InsertItems(List=x_plus_one_2, Item=0, Indices=0, Wrap=True)
smaller_2 = SmallerThan(FirstNumber=avr_2, SecondNumber=Slider(0.04, range=0..0.1))  # -> SmallerThan, OrEqualTo
cull_i_2 = CullIndex(List=ins_2, Indices=-1, Wrap=True)
dom_2 = ConstructDomain(DomainStart=cull_i_2, DomainEnd=index_3)
cull_6 = CullPattern(List=pline, CullPattern=smaller_2.OrEqualTo)
subset_2 = SubList(List=sort_4.ValuesA, Domain=graft(dom_2), Wrap=True)  # -> List, Index
smoothpline = SmoothPolyline(Polyline=cull_6, Strength=1, Times=2)
pdecon_14 = Deconstruct(Point=subset_2.List)  # -> XComponent, YComponent, ZComponent
sort_5 = SortList(Keys=pdecon_14.YComponent, ValuesA=subset_2.List)  # -> Keys, ValuesA
panel_8 = Panel(avr_2)
prune_2 = PruneTree(Tree=sort_5.ValuesA, Minimum=5, Maximum=0)
shift_5 = ShiftList(List=prune_2, Shift=1, Wrap=True)
dist_3 = Distance(PointA=prune_2, PointB=shift_5)
avr_3 = Average(Input=dist_3)  # -> flatten(ArithmeticMean)
pline_2 = PolyLine(Vertices=prune_2, Closed=False)  # -> flatten(Polyline)
smaller_3 = SmallerThan(FirstNumber=avr_3, SecondNumber=Slider(0.04, range=0..0.1))  # -> SmallerThan, OrEqualTo
cull_7 = CullPattern(List=pline_2, CullPattern=smaller_3.OrEqualTo)
smoothpline_2 = SmoothPolyline(Polyline=cull_7, Strength=1, Times=2)
cp_3 = ControlPoints(Curve=smoothpline)  # -> Points, Weights, Knots
cp_4 = ControlPoints(Curve=smoothpline_2)  # -> Points, Weights, Knots
lng_2 = ListLength(List=cp_4.Points)  # -> flatten(Length)
lng_3 = ListLength(List=cp_3.Points)  # -> flatten(Length)
pframes = PerpFrames(Curve=smoothpline, Count=lng_3, Align=True)  # -> Frames, Parameters
# Concrete --------------------------------------------
pframes_2 = PerpFrames(Curve=smoothpline_2, Count=lng_2, Align=True)  # -> Frames, Parameters

# ----
# Stop Extruder
stop = Button()
stop_2 = PythonScript(stop=stop)
# ---------- stop_2: Python ----------
import time
from scriptcontext import sticky as st
from extruder_control.extruderclient import ExtruderClient

ext_ip = st["ext_ip"]
ext_port = st["ext_port"]

ec = ExtruderClient(ext_ip, ext_port)
wait_for_response = False

if stop:
    ec.connect()
    time.sleep(0.2)
    ec.send_stop(wait_for_response)
    time.sleep(0.2)
    ec.close()
# ---------- end stop_2 ----------

# ----
# Set Extruder data
speed_2 = Slider(2000, range=0..51200)
# Direct extruder control
max_speed = Slider(16000, range=0..51200)
value = BooleanToggle(True)
send = Button()
extruder_data = PythonScript(motor_state=value, max_speed=max_speed, speed=speed_2, send=send)  # -> urscript; inputs motor_state: Boolean
# ---------- extruder_data: Python ----------
import time
from scriptcontext import sticky as st
from extruder_control.extruderclient import ExtruderClient

ext_ip = st["ext_ip"]
ext_port = st["ext_port"]

ec = ExtruderClient(ext_ip, ext_port)
wait_for_response = False

if send:
    ec.connect()
    time.sleep(0.2)
    ec.send_motordata(motor_state, max_speed, speed, wait_for_response)
    time.sleep(0.2)
    ec.close()
# ---------- end extruder_data ----------

# ----
# Toggle Extruder
value_2 = BooleanToggle(False)
send_2 = Button()
extruder_state = PythonScript(state=value_2, send=send_2)  # -> urscript; inputs state: Boolean
# ---------- extruder_state: Python ----------
import time
from scriptcontext import sticky as st
from extruder_control.extruderclient import ExtruderClient

ext_ip = st["ext_ip"]
ext_port = st["ext_port"]

ec = ExtruderClient(ext_ip, ext_port)
wait_for_response = False

if send:
    ec.connect()
    time.sleep(0.2)
    ec.send_motorstate(int(state), wait_for_response)
    time.sleep(0.2)
    ec.close()
# ---------- end extruder_state ----------

list_3 = ValueList({"left", "right", "both"}, selected="left")

# ----
# SERVER
button_2 = Button()
feedbackserver = GhPythonScript(create=button_2, clear=Button(), close=Button())  # -> server
# ---------- feedbackserver: Python ----------
__author__ = "Gido"
__version__ = "2022.05.16"

import rhinoscriptsyntax as rs
from scriptcontext import sticky as st
from fabrication_control.communication import TCPFeedbackServer

server_ip = st["server_ip"]
server_port = st["server_port"]

server = TCPFeedbackServer(server_ip, server_port)

if clear:
    server.clear()
    
if close:
    server.shutdown()
# ---------- end feedbackserver ----------

# ----
# Toggle Extruder and Air Off
max_speed_2 = Slider(16000, range=0..16000)
speed_3 = Slider(1000, range=0..16000)
send_3 = Button()
value_3 = BooleanToggle(False)
list_4 = ValueList({"8"}, selected="8")
extruder_data_2 = PythonScript(state=value_3, max_speed=max_speed_2, speed=speed_3, pin=list_4, send=send_3)  # -> urscript; inputs state: Boolean
# ---------- extruder_data_2: Python ----------
import time
from scriptcontext import sticky as st
from extruder_control.extruderclient import ExtruderClient

ext_ip = st["ext_ip"]
ext_port = st["ext_port"]

ec = ExtruderClient(ext_ip, ext_port)
wait_for_response = False

if send:
    ec.connect()
    time.sleep(0.2)
    ec.send_motordata(int(state), max_speed, speed, wait_for_response)
    ec.send_set_do(pin, int(state), wait_for_response)
    time.sleep(0.2)
    ec.close()
# ---------- end extruder_data_2 ----------

# ----
# Toggle Extruder and Air ON
max_speed_3 = Slider(24000, range=0..24000)
speed_4 = Slider(1000, range=0..16000)
value_4 = BooleanToggle(True)
send_4 = Button()
list_5 = ValueList({"8"}, selected="8")
extruder_data_3 = PythonScript(state=value_4, max_speed=max_speed_3, speed=speed_4, pin=list_5, send=send_4)  # -> urscript; inputs state: Boolean; same code as extruder_data_2

# ----
# Toggle air
value_5 = BooleanToggle(True)
send_5 = Button()
list_6 = ValueList({"8"}, selected="8")
digital_out = PythonScript(pin=list_6, state=value_5, send=send_5)  # -> urscript; inputs pin: Int32, state: Boolean
# ---------- digital_out: Python ----------
import time
from scriptcontext import sticky as st
from extruder_control.extruderclient import ExtruderClient

ext_ip = st["ext_ip"]
ext_port = st["ext_port"]

ec = ExtruderClient(ext_ip, ext_port)
wait_for_response = False

if send:
    ec.connect()
    time.sleep(0.2)
    ec.send_set_do(pin, int(state), wait_for_response)
    time.sleep(0.2)
    ec.close()
# ---------- end digital_out ----------

reset_task = Button()
next_task = Button()

prev_task = Button()

# ----
# FABRICATION STATE  VIEWER
fabrication_state = PythonScript(update=Toggle(True))  # -> out, state, num_tasks, num_current_task, num_tasks_left, log_messages
# ---------- fabrication_state: Python ----------
from scriptcontext import sticky as st
from compas_ghpython.utilities import update_component

fabrication = st["fabrication"]

if hasattr(fabrication, "fab_thread"):
    if fabrication.fab_thread.is_alive():
        state = "THREAD RUNNING"
    else:
        state = "THREAD STOPPED"
else:
    state = "THREAD NOT STARTED"

num_tasks = len(fabrication.tasks)
if fabrication.current_task_key is not None:
    num_current_task = fabrication.current_task_key
else:
    num_current_task = 0
num_tasks_left = num_tasks-num_current_task
log_messages = fabrication.log_messages

if update:
    update_component(ghenv, 1000)
# ---------- end fabrication_state ----------
state = Panel(fabrication_state.state)
num_tasks = Panel(fabrication_state.num_tasks)
num_current_task = Panel(fabrication_state.num_current_task)
log_messages = Panel(fabrication_state.log_messages)

# ----
# Get Pose Cartesian
get = Button()

# ----
# SIMULATION ENVIRONMENT
py_3 = PythonScript()  # -> repositories_path, rbvogui_data_path, ur_data_path
# ---------- py_3: Python ----------
import os

"""
ASSUMING THE BELOW PACKAGES ARE STORED IN THE SAME LOCATION:
    ur_fabrication_control;
    rbvogui_common; and
    mobile_additive_manufacturing.
"""

repositories_path = os.path.abspath(os.path.join(ghdoc.Path,"../../../"))

assert os.path.exists(os.path.join(repositories_path, "ur_fabrication_control/data"))
assert os.path.exists(os.path.join(repositories_path, "rbvogui_common/rbvogui_description"))
assert os.path.exists(os.path.join(repositories_path, "mobile_fabrication_control"))

ur_data_path = os.path.abspath(os.path.join(ghdoc.Path,"../../../ur_fabrication_control/data"))
rbvogui_data_path = os.path.abspath(os.path.join(repositories_path, "rbvogui_common"))
# ---------- end py_3 ----------
list_7 = ValueList({"ur3.urdf", "ur3_rot.urdf", "ur5.urdf", "ur10.urdf", "ur3e.urdf", "ur5e.urdf", "ur10e.urdf", "ur10e_rot.urdf"}, selected="ur10e_rot.urdf")
list_8 = ValueList({"ur3.srdf", "ur5.srdf", "ur10.srdf", "ur3e.srdf", "ur5e.srdf", "ur10e.srdf"}, selected="ur10e.srdf")
list_9 = ValueList({"realsense": 0, "keyence": 1}, selected="keyence")
py_4 = PythonScript()  # -> DATA
# ---------- py_4: Python ----------
import os

#package_path = os.path.dirname(mobile_fabrication_control.__file__)
#DATA = os.path.abspath(os.path.join(package_path,"../../data"))

package_path = ghdoc.Path
# package_path = os.path.dirname(ur_fabrication_control.__file__)
#DATA = os.path.abspath(os.path.join(package_path,"../../data"))

# .stl files not stored in am_hackathon repo. but in mobile_fabrication_control
DATA = os.path.abspath(os.path.join(package_path,"../../../workshop_aaec_revamp/data"))

print(package_path)
print(DATA)
# ---------- end py_4 ----------
plane_nr = Slider(19, range=0..200)
list_10 = ValueList({"Zero": 0, "One": 1, "Two": 2, "Three": 3, "Four": 4, "Five": 5}, selected="Zero")

# ----
# Robot Model
# Load Model
list_11 = ValueList({"ur_description", "ur_e_description", "ur_setups"}, selected="ur_e_description")
py_5 = PythonScript(
    repositories_path=py_3.repositories_path,
    rbvogui_data_path=py_3.rbvogui_data_path,
    ur_data_path=py_3.ur_data_path,
    package=list_11,
    urdf_name=list_7,
    srdf_name=list_8)  # -> loaders, urdf_filename, srdf_filename
# ---------- py_5: Python ----------
import os
from compas.robots import LocalPackageMeshLoader

#loaders

ur_path = os.path.join(ur_data_path, "robot_description")
ur_packages = ["ur_description", "ur_e_description", "ur_end_effectors", "ur_setups"]
ur_loaders = [LocalPackageMeshLoader(ur_path, pck) for pck in ur_packages]

rbvogui_packages = ["rbvogui_description"]
rbvogui_loaders = [LocalPackageMeshLoader(rbvogui_data_path, pck) for pck in rbvogui_packages]

ewellix_packages = ["ewellix_description"]
ewellix_loaders = [LocalPackageMeshLoader(repositories_path, pck) for pck in ewellix_packages]

sensors_packages = ["robotnik_sensors"]
sensors_loaders = [LocalPackageMeshLoader(repositories_path, pck) for pck in sensors_packages]

loaders = ur_loaders + rbvogui_loaders + ewellix_loaders + sensors_loaders

#files
urdf_filename = os.path.join(repositories_path, r"mobile_fabrication_control\data\rbvogui_xl_lift_ur10e.urdf")
srdf_filename = os.path.join(repositories_path, r"mobile_fabrication_control\data\rbvogui.srdf")

assert os.path.isfile(urdf_filename)
assert os.path.isfile(srdf_filename)
# ---------- end py_5 ----------
units = ValueList({"m": 1, "cm": 100, "mm": 1000}, selected="m")
load = Button()
create = PythonScript(
    load=load,
    ur_base_frame_rhino_local_tf=python_2.ur_base_frame_rhino_local_tf,
    loaders=py_5.loaders,
    urdf_filename=py_5.urdf_filename,
    srdf_filename=py_5.srdf_filename,
    scale_factor=units)  # -> out, robot, rcf; inputs load: Boolean, loaders: list
# ---------- create: Python ----------
import os
from scriptcontext import sticky as st

import compas

from compas_ghpython import draw_frame
from compas.robots import RobotModel
from compas.robots import LocalPackageMeshLoader

from compas_fab.robots import Robot
from compas_fab.robots import RobotSemantics
from compas_fab.ghpython import RobotArtist

compas.PRECISION = '12f'

# store robot in component
guid = str(ghenv.Component.InstanceGuid)
robot_key = "robot"

if robot_key not in st:
    st[robot_key] = None

#print loaders
if load:
    model = RobotModel.from_urdf_file(urdf_filename)
    
    model.load_geometry(*loaders)
    artist = RobotArtist(model)
    semantics = RobotSemantics.from_srdf_file(srdf_filename, model)
    robot = Robot(model, artist, semantics, client=None)
    
    st[robot_key] = robot

robot = st[robot_key]
print(robot)
rcf = draw_frame(robot.get_RCF())
print(rcf)

if robot:
    robot.scale(scale_factor)
    robot.RCF_in_WCF = ur_base_frame_rhino_local_tf
# ---------- end create ----------
robot = Data(create.robot)

# ----
# Tool
list_12 = ValueList({"measurement_tool": 0, "clay_extruder_7mm": 1, "clay_extruder_7mm_with_2d_laser": 2, "clay_extruder_v21_7mm": 3, "scanner_tool": 4}, selected="scanner_tool")
show = BooleanToggle(True)
python_3 = PythonScript(data_path=py_4, tool=list_12, tcp_frame=list_9, show=show)  # -> tool, M; inputs tcp_frame: Int32
# ---------- python_3: Python ----------
import os, math
from compas.geometry import Frame, Rotation
from compas.datastructures import Mesh
from compas_ghpython.artists import MeshArtist
from compas_fab.robots import Tool

tolerance = 0

if tool == 0:
    filename = 'measurement_tool_zaxis.stl'
    ee_frame = Frame([0, 0, 0.109], [1, 0, 0], [0, 1, 0])

elif tool == 1:
    filename = 'clay_extruder_7mm.stl'
    # real frame:
    ee_frame = Frame([-0.000502, -0.105348, 0.0662,], [1, 0, 0], [0, 0, 1])
    
    # test frame:
    # ee_frame = Frame([0.0, 0.0, 0.1,], [1, 0, 0], [0, 1, 0])
elif tool == 2:
    filename = 'clay_extruder_7mm_with_2d_laser.stl'
    # non-rotated frame:
    if tcp_frame == "nozzle":
        ee_frame = Frame([-0.0013, -0.0053, 0.3441,], [1, 0, 0], [0, 1, 0])
    elif tcp_frame == "scanner":
        # Original frame
#        ee_frame = Frame([-0.0493, -0.0063, 0.3949,], [-1, 0, 0], [0, -1, 0])
        # Raised frame
        ee_frame = Frame([-0.0493, -0.0063, 0.4200,], [-1, 0, 0], [0, -1, 0])

elif tool == 3:
    filename = 'clay_extruder_v21_7mm.stl'
    ee_frame = Frame([0, 0, 0.33821], [1, 0, 0], [0, 1, 0])

elif tool == 4:
    filename = 'scanner_end_effector.stl'
    if tcp_frame == 0: # Realsense
        ee_frame = Frame([0.0785987,0.00509097,0.230886], [0,-1,0], [1,0,0])
    elif tcp_frame == 1: # Keyence
        ee_frame = Frame([0.01185,0.00562,0.41045], [0,-1,0], [1,0,0])

data_path = os.path.join(data_path, "tool_geometry")
fullfilename = os.path.join(data_path, filename)
print fullfilename

ee_mesh = Mesh.from_stl(fullfilename)

#R = Rotation.from_axis_and_angle(ee_frame.zaxis, math.radians(180), point=ee_frame.point)
#ee_frame.transform(R)

if show:
    artist = MeshArtist(ee_mesh)
    M = artist.draw()

tool = Tool(ee_mesh, ee_frame)
# ---------- end python_3 ----------
panel_9 = Panel("Attach a custom tool")
py_6 = PythonScript(robot=robot, tool=python_3.tool, attach=Toggle(True))  # -> a
# ---------- py_6: Python ----------
if attach:
    robot.attach_tool(tool, group = "ur10e")
else:
    robot.detach_tool()
# ---------- end py_6 ----------

pose = PythonScript(get=get, tool=python_3.tool, from_robot=Toggle(False))  # -> pose_cartesian, frame_WCS, plane_WCS
# ---------- pose: Python ----------
from scriptcontext import sticky as st
from ur_fabrication_control.direct_control.common import get_current_pose_cartesian
from compas.geometry import Frame
from compas_ghpython import draw_frame

robot = st["robot"]

server_ip = st["server_ip"]
server_port = st["server_port"]
ur_port = st["ur_port"]
ur_ip = st["ur_ip"]

# retrieve the current tool frame in axis angle format
if from_robot:
    if robot.attached_tool:
        tool_angle_axis = list(robot.attached_tool.frame.point) + list(robot.attached_tool.frame.axis_angle_vector)
    else:
        tool0_frame = Frame([0, 0, 0], [1, 0, 0], [0, 1, 0])
        tool_angle_axis = list(tool0_frame.point) + list(tool0_frame.axis_angle_vector)
else:
    tool_angle_axis = list(tool.frame.point) + list(tool.frame.axis_angle_vector)

print(tool_angle_axis)

guid = str(ghenv.Component.InstanceGuid)
pose_cartesian_key = "pose_cartesian" + guid


if get:
    st[pose_cartesian_key] = get_current_pose_cartesian(tool_angle_axis, server_ip, server_port, ur_ip, ur_port, send=True)

if pose_cartesian_key not in st:
    pose_cartesian = []
else:
    pose_cartesian = st[pose_cartesian_key]

print(pose_cartesian)

# get frame and plane of the current pose cartesian in world coordinates for visualization
if pose_cartesian:
    frame_RCS = Frame.from_axis_angle_vector(axis_angle_vector=pose_cartesian[3:], point=pose_cartesian[:3])
    frame_WCS = robot.RCF_in_WCF.to_world_coordinates(frame_RCS)
    plane_WCS  = draw_frame(frame_WCS)
    print frame_RCS
    print frame_WCS
# ---------- end pose ----------
draw = GhPythonScript(frames=pose.frame_WCS, scale=Slider(0.1, range=0..1))  # -> P, V, W; inputs frames: list
# ---------- draw: Python ----------
from System.Drawing import Color
from compas_ghpython.utilities import draw_frame

red = Color.FromArgb(255, 0, 0)
green = Color.FromArgb(0, 255, 0)
blue = Color.FromArgb(0, 0, 255)

P = []
V = []
C = []

scale = float(scale)

for frame in frames:
    if not frame:
        continue
    plane = draw_frame(frame)
    P += [plane.Origin] * 3
    V.append(plane.XAxis * scale)
    V.append(plane.YAxis * scale)
    V.append(plane.ZAxis * scale)
    C += [red, green, blue]

W = 3
# ---------- end draw ----------
vdisex = VectorDisplayEx(Point=draw.P, Vector=draw.V, Colour=RGB(0, 0, 0), Width=draw.W)
panel_10 = Panel(pose.pose_cartesian)

pln_2 = Plane(pose.plane_WCS)  # disabled

pln_3 = Plane(create.rcf)

orient_3 = Orient(Geometry=clo_3, Source=PlaneXY(0, 0, 0), Target=pln_3)  # -> Geometry, Transform

# ----
# Info
info = PythonScript(robot=robot)  # -> out, main_group_name
# ---------- info: Python ----------
if robot:
    robot.info()
    main_group_name = robot.main_group_name
# ---------- end info ----------
panel_11 = Panel(info.out)

# ---- group: forward kinematics
# Configuration
a1 = Slider(45, range=-360..360)
a2 = Slider(-45, range=-360..360)
a3 = Slider(135, range=-360..360)
a5 = Slider(-90, range=-360..360)
a6 = Slider(0, range=-360..360)
a4 = Slider(-180, range=-360..360)
jp = GhPythonScript()  # -> joint_positions
# ---------- jp: Python ----------
import math

joint_positions = [0,-90,90,0,90,0]
joint_positions = [math.radians(a) for a in joint_positions]
#joint_positions = [-3.136, -0.328, -1.218, 3.129, 0.852, 0.008]
#joint_positions = [0] * 6



#joint_positions = [1.6239667567485938, 0.25439606475392273, 4.409424838594969-2*3.14, 3.1901607306255908, 1.5707963267948954, 0.053170429953696939]
#joint_positions = [1.598543436748912, 0.23021224965157744, 4.712232135219824-2*3.14, 6.0531299026928744, 4.7123889803846915, 0.027747109954015234]
#joint_positions = [-1.1373533430447322, 4.0117247163121572, 5.4083762087596021-2*3.14, 1.5754733624925168, 4.7123889803846879, 3.5750356373399574]
print joint_positions
# ---------- end jp ----------
forward_kinematics = PythonScript(robot=robot, set_joint_positions=Button(), joint_positions=jp, a1=a1, a2=a2, a3=a3, a4=a4, a5=a5, a6=a6)  # -> full_configuration; inputs joint_positions: list
# ---------- forward_kinematics: Python ----------
import math
import Grasshopper
from compas.robots import Joint
from compas_fab.robots import Configuration

if set_joint_positions:

    j = 0
    for i in range(ghenv.Component.Params.Input.Count):
        nslider = ghenv.Component.Params.Input[i].Sources[0]
        if nslider.GetType() == Grasshopper.Kernel.Special.GH_NumberSlider:
            nslider.TrySetSliderValue(math.degrees(joint_positions[j]))
            j += 1

if robot:
    joint_positions = [a1, a2, a3, a4, a5, a6]
    joint_types = robot.get_configurable_joint_types()
    for i, joint_type in enumerate(joint_types):
        if joint_type == Joint.REVOLUTE:
            joint_positions[i] = math.radians(joint_positions[i])
    full_configuration = Configuration(joint_positions, joint_types)
    
print(full_configuration)
# ---------- end forward_kinematics ----------

# ---- group: inverse kinematics
select_configuration = Slider(0, range=0..7)
inverse = PythonScript(robot=robot, group=info.main_group_name, idx=select_configuration)  # -> out, plane_tool0_RCS, plane_tcp_RCS, configuration; inputs plane_WCS: Plane, idx: Int32
# ---------- inverse: Python ----------
import Rhino.Geometry as rg
import math
from compas.geometry import Frame, Transformation, Rotation
from compas_fab.robots import Configuration
from ur_fabrication_control.kinematics.ur_kinematics import inverse_kinematics
from ur_fabrication_control.kinematics.ur_params import ur_params
from compas_ghpython import draw_frame

tcp_WCS = Frame(plane_WCS.Origin, plane_WCS.XAxis, plane_WCS.YAxis)

# transform frame to robot coordinate system
print tcp_WCS
print plane_WCS
tcp_RCS = robot.RCF_in_WCF.to_local_coordinates(tcp_WCS)
tool0_RCS = robot.from_tcf_to_t0cf([tcp_RCS])[0]
tool0_RCS_rot = Frame(tool0_RCS.point, tool0_RCS.zaxis, tool0_RCS.yaxis)
print tcp_RCS
print tool0_RCS
plane_tool0_RCS = draw_frame(tool0_RCS)
plane_tcp_RCS = draw_frame(tcp_RCS)
# calculate solutions to frame
ur_params = ur_params["ur10e"] # get the parameters according to the robot model
print ur_params
solutions = inverse_kinematics(tool0_RCS, ur_params)
print solutions

if not len(solutions):
    joint_values = [0,0,0,0,0,0]
    configuration = Configuration.from_revolute_values(joint_values)
else:
    joint_values = solutions[idx]
    #print joint_values
    
    ### ***** HACK ***** ##### TODO: CHECK!!!
    for i, v in enumerate(joint_values):
        if v > math.pi:
            v -= 2*math.pi
        if v < -math.pi:
            v += 2*math.pi
        joint_values[i] = v
    ### ***** HACK ***** ##### TODO: CHECK!!!
    configuration = [Configuration.from_revolute_values(joint_values)]

print(configuration)
# ---------- end inverse ----------

select_configuration_2 = Slider(2, range=0..7)
inverse_2 = PythonScript(robot=robot, plane_nr=plane_nr, idx=select_configuration_2)  # -> out, plane_tool0_RCS, plane_tcp_RCS, configuration; inputs planes_WCS: list of Plane, plane_nr: Int32, idx: Int32
# ---------- inverse_2: Python ----------
import Rhino.Geometry as rg
import math
from compas.geometry import Frame, Transformation, Rotation
from compas_fab.robots import Configuration
from ur_fabrication_control.kinematics.ur_kinematics import inverse_kinematics
from ur_fabrication_control.kinematics.ur_params import ur_params
from compas_ghpython import draw_frame

plane_WCS = planes_WCS[plane_nr]
tcp_WCS = Frame(plane_WCS.Origin, plane_WCS.XAxis, plane_WCS.YAxis)

# transform frame to robot coordinate system
tcp_RCS = robot.RCF_in_WCF.to_local_coordinates(tcp_WCS)
tool0_RCS = robot.from_tcf_to_t0cf([tcp_RCS])[0]

print tcp_RCS
print tool0_RCS
plane_tool0_RCS = draw_frame(tool0_RCS)
plane_tcp_RCS = draw_frame(tcp_RCS)
# calculate solutions to frame
ur_params = ur_params["ur10e"] # get the parameters according to the robot model
solutions = inverse_kinematics(tool0_RCS, ur_params)

if not len(solutions):
    joint_values = [0,0,0,0,0,0]
    configuration = Configuration.from_revolute_values(joint_values)
else:
    joint_values = solutions[idx]
    #print joint_values
    
    ### ***** HACK ***** ##### TODO: CHECK!!!
    for i, v in enumerate(joint_values):
        if v > math.pi:
            v -= 2*math.pi
        if v < -math.pi:
            v += 2*math.pi
        joint_values[i] = v
    ### ***** HACK ***** ##### TODO: CHECK!!!
    
    configuration = [Configuration.from_revolute_values(joint_values)]

print(configuration)
# ---------- end inverse_2 ----------

# ----
list_13 = ValueList({"0 forward_kinematics": 0, "1 inverse_kinematics": 1, "2 inverse_kinematics": 2}, selected="1 inverse_kinematics")
filter = StreamFilter(Gate=list_13, Stream0=forward_kinematics, Stream1=inverse.configuration, Stream2=inverse_2.configuration)

# ----
# Visualisation
show_end_effector_frame = BooleanToggle(True)
show_base_frame = BooleanToggle(False)
show_collision = BooleanToggle(False)
show_frames = BooleanToggle(False)
show_visual = BooleanToggle(True)
show_acm = BooleanToggle(False)
visualize = PythonScript(
    robot=robot,
    tool=python_3.tool,
    group=info.main_group_name,
    configuration=filter,
    redraw=py_6,
    show_visual=show_visual,
    show_collision=show_collision,
    show_end_effector_frame=show_end_effector_frame,
    show_frames=show_frames,
    show_base_frame=show_base_frame,
    show_acm=show_acm,
    station=list_10)  # -> out, robot, visual, collision, attached_meshes, frames, ee_frame, tool0_frame, base_frame, base_pt; inputs redraw: list, attached_collision_meshes: list, station_pts: list
# ---------- visualize: Python ----------
import rhinoscriptsyntax as rs
import Rhino.Geometry as rg
import ghpythonlib.components as ghcomp
from compas.geometry import Vector
from compas.geometry import Point
from compas.geometry import Transformation
from compas.geometry import Frame
from compas_ghpython.artists import MeshArtist
from compas_ghpython.utilities import draw_frame
from compas_fab.robots import Configuration
from ur_fabrication_control.kinematics.ur_kinematics import forward_kinematics
from ur_fabrication_control.kinematics.ur_params import ur_params

print(configuration)

if robot and configuration:
    
    robot.update(configuration, visual=show_visual, collision=show_collision)
    ur_params = ur_params[robot.main_group_name]
    print(ur_params)
    if show_visual:
        visual = robot.artist.draw_visual()
        robot_RCF = draw_frame(robot.RCF_in_WCF)
        init_robot_plane = rg.Plane(rg.Point3d(0.207, 0.0, 1.215), rg.Vector3d(-0.707, 0.707, 0.0), rg.Vector3d(-0.707, -0.707,0.0))
        visual = ghcomp.Orient(visual, init_robot_plane, robot_RCF)[0]
        
    if show_collision:
        collision = robot.artist.draw_collision()
    
    frames = robot.transformed_frames(configuration, group)

    if show_base_frame:
        base_frame = frames[0]

    if show_end_effector_frame:
#        tool0_frame = forward_kinematics(configuration.revolute_values, ur_params)
        tool0_frame = robot.forward_kinematics(configuration, group)
        print tool0_frame
        ee_frame = robot.from_t0cf_to_tcf([tool0_frame])
        print("End-effector", ee_frame)
    
    if not show_frames:
        frames = None

#    frame = forward_kinematics(configuration.revolute_values, ur_params)
    frame = robot.forward_kinematics(configuration, options=dict(solver='model', link_name=robot.attached_tool.link_name))
    #robot.artist.update_tool(visual=visual, collision=collision, transformation=Transformation.from_frame_to_frame(Frame.worldXY(), tool0_frame))
    
    if show_acm:
        M = []
        for acm in attached_collision_meshes:
            frame = robot.forward_kinematics(configuration, options=dict(solver='model', link_name=acm.link_name))
            T = Transformation.from_frame_to_frame(Frame.worldXY(), frame)
            mesh = acm.collision_mesh.mesh.transformed(T)
            M.append(MeshArtist(mesh).draw())
        attached_meshes = M
# ---------- end visualize ----------
geo = Geometry(visualize.visual)
geo_2 = Geometry(visualize.collision)
draw_2 = GhPythonScript(frames=[visualize.frames, visualize.ee_frame, visualize.base_frame], scale=Slider(0.1, range=0..1))  # -> P, V, C, W; inputs frames: list; same code as draw
preview = CustomPreview(Geometry=geo, Shader=ColourSwatch(SwatchColor=RGB(105, 105, 105)))
preview_2 = CustomPreview(Geometry=visualize.attached_meshes, Shader=ColourSwatch(SwatchColor=RGB(255, 255, 255)))
vdisex_2 = VectorDisplayEx(Point=draw_2.P, Vector=draw_2.V, Colour=draw_2.C, Width=draw_2.W)

# ----
# TASKS
robot_speed = Slider(0.012, range=0..1)
tasks = GhPythonScript(
    create=Button(),
    robot=robot,
    server=feedbackserver,
    robot_speed=robot_speed,
    init_rot_dz=Slider(0, range=-180..180),
    init_rot_dx=Slider(0, range=-180..180),
    init_rot_num_frames=Slider(0, range=0..100),
    init_rot_side=list_3,
    init_rot_layers=Slider(0, range=0..100))  # -> tasks
# ---------- tasks: Python ----------
import time
import math
from scriptcontext import sticky as st
from fabrication_control.task import Task
from ur_fabrication_control.direct_control.fabrication_process import URTask
from ur_fabrication_control.direct_control import URScript
from extruder_control.fabrication import EXTTask
from compas.geometry import Vector
from compas.geometry import Rotation
from compas.geometry import Frame


ur_ip = st["ur_ip"]
ur_port = st["ur_port"]
server_ip = st["server_ip"]
server_port = st["server_port"]

def create_tasks_from_am_model(am_model):
    tasks = []
    key = 0
#    req_msg = "Initial_pos_Layer{}_completed".format(key)
#    urscript = urscript_initial_position(am_model.layer(0), req_msg)
#    new_task = URTask(server, urscript, req_msg, key)
#    tasks.append(new_task)
#    key += 1
#    ext_task = extruder_task(key, state=1, ext_speed=24000)
#    tasks.append(ext_task)
#    key += 1
    for k, layer in am_model.layers():
        req_msg = "Layer{}_completed".format(key)
        urscript = urscript_from_layer(layer, key, req_msg)
        new_task = URTask(server, urscript, req_msg, key)
        tasks.append(new_task)
        key += 1
#    ext_task = extruder_task(key, state=0, ext_speed=24000)
#    tasks.append(ext_task)
    return tasks

def get_frames_in_RCS(frames):
    return [robot.RCF_in_WCF.to_local_coordinates(frame) for frame in frames]

def urscript_initial_position(layer, exit_message):
    ur_script = URScript(ur_ip=ur_ip, ur_port=ur_port)
    tool_angle_axis = list(robot.attached_tool.frame.point) + list(robot.attached_tool.frame.axis_angle_vector)
    ur_script.start()
    ur_script.set_tcp(tool_angle_axis)
    RCS_frame = get_frames_in_RCS([layer.node(0).frame])
    ur_script.move_linear(RCS_frame[0], robot_speed, 0.0)
    # Signify ready
    ur_script.socket_open(server_ip, server_port, "Feedbackserver")
    ur_script.socket_send_line_string(exit_message, socket_name="Feedbackserver")
    ur_script.socket_close(name="Feedbackserver")# BS: Closing socket at the end of the loop
    #Finalize script
    ur_script.end()
    ur_script.generate()
    return ur_script
    
def extruder_task(key, state, ext_speed):
    exttask = EXTTask(ext_address=("192.168.0.220", 50004), key=key)
    exttask.add_function("send_set_do", 8, state, True)
    exttask.add_function("send_motordata", state, ext_speed, 10000, True)
    return exttask

def limit_frames_rotation(frames, lnum, init_rdz = 90, init_rdx=20, init_rot_frames=10, sides="left"):
    lfrs = []
    veca2ds = []
    yvec2ds = []
    init_rdz_left = -init_rdz
    init_rdz_right = init_rdz
    for i, frame in enumerate(frames):
        new_frame = frame.copy()
        # Maximum rotation based on platform location
        veca3d = Vector.from_start_end(frame.point, Frame.worldXY().point)
        veca2d = Vector(veca3d.x, veca3d.y, 0)
        yvec2d = Vector(new_frame.yaxis[0], new_frame.yaxis[1], 0)
        anglea = yvec2d.angle_signed(veca2d, Vector.Zaxis())
#        print anglea
        if anglea > math.pi/4:
            R = Rotation.from_axis_and_angle(frame.zaxis, math.pi/4-anglea, frame.point)
            new_frame.transform(R)
        elif anglea < -math.pi/4:
            R = Rotation.from_axis_and_angle(frame.zaxis, -math.pi/4-anglea, frame.point)
            new_frame.transform(R)
            
        # Manual manipulations
        if (lnum%2 == 0 and sides in ["left", "both"]):
            if i<init_rot_frames:
                R = Rotation.from_axis_and_angle(new_frame.zaxis, math.radians(init_rdz_left)*math.cos(i*(math.pi/(2*init_rot_frames))), new_frame.point)
                new_frame.transform(R)
                R = Rotation.from_axis_and_angle(new_frame.xaxis, math.radians(init_rdx)*((init_rot_frames-i)/init_rot_frames), new_frame.point)
                new_frame.transform(R)
            elif i>len(frames)-init_rot_frames:
                R = Rotation.from_axis_and_angle(new_frame.zaxis, 0, new_frame.point)
                new_frame.transform(R)
        else:
            pass
        if (lnum%2 == 0 and sides in ["right", "both"]):
            if i<init_rot_frames:
                R = Rotation.from_axis_and_angle(new_frame.zaxis, 0, new_frame.point)
                new_frame.transform(R)
            elif i>=len(frames)-init_rot_frames:
                R = Rotation.from_axis_and_angle(new_frame.zaxis, math.radians(init_rdz_right)*math.cos((math.pi/2)-(i-(len(frames)-init_rot_frames))*(math.pi/(2*init_rot_frames))), new_frame.point)
                new_frame.transform(R)
                R = Rotation.from_axis_and_angle(new_frame.xaxis, math.radians(init_rdx)*((i-(len(frames)-1-init_rot_frames))/(init_rot_frames)), new_frame.point)
                print((i-(len(frames)-1-init_rot_frames))/(init_rot_frames))
                new_frame.transform(R)
        else:
            pass
        if (lnum%2 ==1 and sides in ["left", "both"]):
            if i<init_rot_frames:
                R = Rotation.from_axis_and_angle(new_frame.zaxis, 0, new_frame.point)
                new_frame.transform(R)
            elif i>=len(frames)-init_rot_frames:
                R = Rotation.from_axis_and_angle(new_frame.zaxis, math.radians(-init_rdz_right)*math.cos((math.pi/2)-(i-(len(frames)-init_rot_frames))*(math.pi/(2*init_rot_frames))), new_frame.point)
                new_frame.transform(R)
                R = Rotation.from_axis_and_angle(new_frame.xaxis, math.radians(init_rdx)*((i-(len(frames)-1-init_rot_frames))/(init_rot_frames)), new_frame.point)
                print((i-(len(frames)-1-init_rot_frames))/(init_rot_frames))
                new_frame.transform(R)
        else:
            pass
        if (lnum%2 ==1 and sides in ["right", "both"]):
            if i<init_rot_frames:
                R = Rotation.from_axis_and_angle(new_frame.zaxis, math.radians(-init_rdz_left)*math.cos(i*(math.pi/(2*init_rot_frames))), new_frame.point)
                new_frame.transform(R)
                R = Rotation.from_axis_and_angle(new_frame.xaxis, math.radians(init_rdx)*((init_rot_frames-i)/init_rot_frames), new_frame.point)
                new_frame.transform(R)
            elif i>len(frames)-init_rot_frames:
                R = Rotation.from_axis_and_angle(new_frame.zaxis, 0, new_frame.point)
                new_frame.transform(R)
        else:
            pass
        
        lfrs.append(new_frame)
#        veca2dartist = VectorArtist(veca2d)
#        yvec2dartist = VectorArtist(yvec2d)
#        veca2ds.append(veca2dartist.draw()[0])
#        yvec2ds.append(yvec2dartist.draw()[0])
    return lfrs

def urscript_from_layer(layer, layer_number, exit_message):
    ur_script = URScript(ur_ip=ur_ip, ur_port=ur_port)
    tool_angle_axis = list(robot.attached_tool.frame.point) + list(robot.attached_tool.frame.axis_angle_vector)
    ur_script.start()
    ur_script.set_tcp(tool_angle_axis)
    RCS_frames = get_frames_in_RCS([node.frame for key, node in layer.nodes()])
#    RCS_frames = limit_frames_rotation(RCS_frames, layer_number, init_rot_dz, init_rot_dx, init_rot_num_frames, init_rot_side)
    radii = [node.radius for key, node in layer.nodes()]
    ur_script.add_line("textmsg(\">> TASK {}.\")".format(layer_number))
    # Initialize first movement (with accelleration)
    ur_script.socket_open(server_ip, server_port, "Feedbackserver")
    ur_script.move_linear(RCS_frames[0], robot_speed, 0.0)
    node_msg = {"LAYER":layer_number, "NODE":0}
    ur_script.socket_send_line_string(str(node_msg), socket_name="Feedbackserver")
    # Send all next frames of the layer (constant speed, no accelleration)
    for key, RCS_frame in enumerate(RCS_frames[1:len(RCS_frames)]):
        ur_script.move_linear(RCS_frame, robot_speed, 0)
        node_msg = {"LAYER":layer_number, "NODE":key}
        ur_script.socket_send_line_string(str(node_msg), socket_name="Feedbackserver")
    ur_script.socket_close(name="Feedbackserver")# BS: Closing socket at the end of the loop
    # Signify ready
    ur_script.socket_open(server_ip, server_port, "Feedbackserver")
    ur_script.socket_send_line_string(exit_message, socket_name="Feedbackserver")
    ur_script.socket_close(name="Feedbackserver")# BS: Closing socket at the end of the loop
    #Finalize script
    ur_script.end()
    ur_script.generate()
    return ur_script

if create:
    st["tasks"] = create_tasks_from_am_model(am_model)

tasks = st["tasks"]
# ---------- end tasks ----------

# ----
# CONTROL ENVIRONMENT
# FABRICATION MANAGER
# 3>
reset_fabrication = Button()
start_fabrication = Button()
stop_fabrication = Button()
set_tasks = Button()
init = Button()
fabrication = PythonScript(
    server=feedbackserver,
    tasks=tasks,
    init=init,
    parallelize=Toggle(False),
    set_tasks=set_tasks,
    start=start_fabrication,
    stop=stop_fabrication,
    reset=reset_fabrication,
    next_task=next_task,
    reset_task=reset_task,
    prev_task=prev_task)  # -> out, server; inputs tasks: list
# ---------- fabrication: Python ----------
from scriptcontext import sticky as st
from fabrication_control.fabrication import Fabrication

if init:
    fabrication = Fabrication(server)
    fabrication.parallelize = parallelize
    st["fabrication"] = fabrication

fabrication = st["fabrication"]

if set_tasks:
    print "setting tasks"    
    fabrication.clear_tasks()
    fabrication.set_tasks(tasks)

if start:
    #if robot.is_connected(): #and arduino.is_connected():
    print "starting process"
    fabrication.start()

if stop:
    print "stopping process"
    fabrication.stop()
    
if reset:
    print "resetting process"
    fabrication.reset()

if next_task:
    t = fabrication.get_next_task()
    task_state_set(True, t)
    
if reset_task:
    t = fabrication.get_next_task()
    task_state_set(False, t)

if prev_task:
    t = fabrication.get_next_task()
    task_state_set(False, t)
    t = fabrication.tasks[fabrication.current_task_key-1]
    task_state_set(False, t)
    fabrication.get_next_task()

def task_state_set(state, t):
    t.is_completed = state
    t.is_running = False

server = fabrication.server
# ---------- end fabrication ----------
num_tasks_left = Panel(fabrication_state.num_tasks_left)

# ----
# SERVER STATE  VIEWER
server_state = GhPythonScript(server=fabrication.server)  # -> out, msgs, server_state, processing_state
# ---------- server_state: Python ----------
__author__ = "Gido"
__version__ = "2022.05.17"

import rhinoscriptsyntax as rs

msgs = server.msgs.values()
if hasattr(server, "server_thread"):
    if server.server_thread.is_alive():
        server_state = "RUNNING"
    else:
        server_state = "HALTED"
else:
    server_state = "NOT RUNNING"

if hasattr(server, "process_thread"):
    if server.process_thread.is_alive():
        processing_state = "RUNNING"
    else:
        processing_state = "HALTED"
else:
    processing_state = "NOT RUNNING"
# ---------- end server_state ----------
server_state_2 = Panel(server_state.server_state)
processing_state = Panel(server_state.processing_state)
server_messages = Panel(server_state.msgs)
