# Grasshopper definition mobile_robot_workspace_revamp_print_2.ghx (Grasshopper 1.0.7)
# plug-ins: Pufferfish

ext_ip = ValueList({"192.168.10.10", "192.168.10.20", "192.168.10.11", "192.168.10.12", "127.0.0.1", "192.168.10.111", "192.168.0.220", "192.168.0.30", "192.168.10.50", "0.0.0.0"}, selected="192.168.0.220")
ext_port = ValueList({"50003", "50004"}, selected="50004")

# ----
# Settings
# --> Set your IP address
# --> Set robot IP address
server_ip = ValueList({"192.168.10.44", "192.168.10.12", "192.168.10.11", "192.168.10.10", "192.168.10.2", "127.0.0.1", "192.168.10.111", "192.168.0.250", "192.168.0.30", "10.42.0.212", "10.42.0.133"}, selected="192.168.0.250")
ur_ip = ValueList({"192.168.10.10", "192.168.10.20", "192.168.10.11", "192.168.10.12", "127.0.0.1", "192.168.10.111", "192.168.0.210", "192.168.0.30"}, selected="192.168.0.210")
server_port = ValueList({"50002", "50003", "50005", "50006", "50007", "50008", "50009", "50010", "50011", "50012", "50013", "50014", "50015", "50016"}, selected="50013")
ur_port = ValueList({"30002"}, selected="30002")
globals = PythonScript(
    server_ip=server_ip,
    server_port=server_port,
    ur_ip=ur_ip,
    ur_port=ur_port,
    ext_ip=ext_ip,
    ext_port=ext_port,
    clear=Button())  # inputs server_port: Int32
# ---------- globals: Python ----------
from scriptcontext import sticky as st

st["server_ip"] = server_ip
st["server_port"] = server_port

st["ur_ip"] = ur_ip
st["ur_port"] = ur_port

st["ext_ip"] = ext_ip
st["ext_port"] = ext_port


if clear:
    st.clear()
# ---------- end globals ----------

# ----
# Check if UR robot
#  is available
ping = Button()
py = PythonScript(ip=ur_ip, ping=ping)  # -> out, trigger
# ---------- py: Python ----------
from scriptcontext import sticky as st
from ur_fabrication_control.direct_control.utilities import is_available

guid = str(ghenv.Component.InstanceGuid)
txt_key = "txt_" + guid
if txt_key not in st:
    st[txt_key] = ""

if ping:
    
    available = is_available(ip)
    
    if available:
        st[txt_key] = "%s is up!" % ip
        trigger = True
    else:
        st[txt_key] = "%s is down!" % ip
        trigger = False

print(st[txt_key])
# ---------- end py ----------
panel = Panel(py.out)

reload = Button()
panel_2 = Panel("Unload libraries")
# CAPTURE ENVIRONMENT
py_2 = PythonScript(reload=reload)
# ---------- py_2: Python ----------
from compas_ghpython import unload_modules

if reload:
    unload_modules("compas")
    unload_modules("compas_fab")
    unload_modules("roslibpy")
    unload_modules("fabrication_control")
    unload_modules("assembly_information_model")
    unload_modules("am_information_model")
    unload_modules("ur_fabrication_control")
    unload_modules("workshop_aaec_revamp")
# ---------- end py_2 ----------

list = ValueList({"measurement_tool": 0, "clay_extruder_7mm": 1, "clay_extruder_7mm_with_2d_laser": 2, "clay_extruder_v21_7mm": 3, "scanner_tool": 4}, selected="scanner_tool")
panel_3 = Panel("221011keyence_scan3.ply")  # disabled

# ---- group: ROS client
panel_4 = Panel("192.168.0.4")  # disabled
disconnect = Button()  # disabled
connect = Button()  # disabled
connect_2 = PythonScript(ip=panel_4, connect=connect, disconnect=disconnect)  # -> out, ros_client; disabled
# ---------- connect_2: Python ----------
import sys
import scriptcontext as sc
from compas_fab.backends import RosClient

key = 'rosclient_%s' % str(ghenv.Component.InstanceGuid)
previous_client = sc.sticky.get(key, None)

if previous_client and (connect or disconnect):
    previous_client.close()

if connect:
    ros_client = RosClient(ip, 9090)
    sc.sticky[key] = ros_client
    ros_client.run(5)

ros_client = sc.sticky.get(key, None)
print('ROS connected: {}'.format(ros_client.is_connected if ros_client else 'False'))
# ---------- end connect_2 ----------
is_connected = Panel(connect_2.out)  # disabled

# ----
# Option 3. Keyence
# Load pointcloud and transformation
panel_5 = Panel("221011keyence_scan3.ply")

show = BooleanToggle(True)
list_2 = ValueList({"realsense": 0, "keyence": 1}, selected="realsense")
py_3 = PythonScript()  # -> DATA
# ---------- py_3: Python ----------
import os

package_path = ghdoc.Path
DATA = os.path.abspath(os.path.join(package_path,"../../data"))

print(package_path)
print(DATA)
# ---------- end py_3 ----------
python = PythonScript(data_path=py_3, tool=list, tcp_frame=list_2, show=show)  # -> tool, M, ee_plane; inputs tcp_frame: Int32
# ---------- python: Python ----------
import os, math
from compas.geometry import Frame, Rotation
from compas.datastructures import Mesh
from compas_ghpython.artists import MeshArtist
from compas_fab.robots import Tool
from compas_ghpython.utilities import draw_frame

tolerance = 0

if tool == 0:
    filename = 'measurement_tool_zaxis.stl'
    ee_frame = Frame([0, 0, 0.109], [1, 0, 0], [0, 1, 0])

elif tool == 1:
    filename = 'clay_extruder_7mm.stl'
    # real frame:
    ee_frame = Frame([-0.000502, -0.105348, 0.0662,], [1, 0, 0], [0, 0, 1])
    
    # test frame:
    # ee_frame = Frame([0.0, 0.0, 0.1,], [1, 0, 0], [0, 1, 0])
elif tool == 2:
    filename = 'clay_extruder_7mm_with_2d_laser.stl'
    # non-rotated frame:
    if tcp_frame == "nozzle":
        ee_frame = Frame([-0.0013, -0.0053, 0.3441,], [1, 0, 0], [0, 1, 0])
    elif tcp_frame == "scanner":
        # Original frame
#        ee_frame = Frame([-0.0493, -0.0063, 0.3949,], [-1, 0, 0], [0, -1, 0])
        # Raised frame
        ee_frame = Frame([-0.0493, -0.0063, 0.4200,], [-1, 0, 0], [0, -1, 0])

elif tool == 3:
    filename = 'clay_extruder_v21_7mm.stl'
    ee_frame = Frame([0, 0, 0.33821], [1, 0, 0], [0, 1, 0])

elif tool == 4:
    filename = 'scanner_end_effector_v2.stl'
    if tcp_frame == 0: # Realsense
        ee_frame = Frame([0.0693178,-0.01232132,0.239685], [0,-1,0], [1,0,0])
    elif tcp_frame == 1: # Keyence
        ee_frame = Frame([0.0110607,0.00809854,0.41498], [0,-1,0], [-1,0,0])

data_path = os.path.join(data_path, "tool_geometry")
fullfilename = os.path.join(data_path, filename)
print fullfilename

ee_mesh = Mesh.from_stl(fullfilename)

#R = Rotation.from_axis_and_angle(ee_frame.zaxis, math.radians(180), point=ee_frame.point)
#ee_frame.transform(R)

if show:
    artist = MeshArtist(ee_mesh)
    M = artist.draw()

tool = Tool(ee_mesh, ee_frame)
ee_plane = draw_frame(ee_frame)
print(ee_frame.quaternion.xyzw)
ee_framek = Frame([0.0110607,0.00809854,0.41498], [0,1,0], [1,0,0])
print(ee_framek.quaternion.xyzw)
# ---------- end python ----------
panel_6 = Panel("Attach a custom tool")
start_fabrication = Button()  # disabled
stop_fabrication = Button()  # disabled

# ---- group: Toggle true to read .ply file
toggle = BooleanToggle(False)

# ---- group: Click to create new .ply file, when camera connected
button = Button()

# ---- group: Change the path to your directory
data = GhPythonScript()  # -> data
# ---------- data: Python ----------
import os

package_path = ghdoc.Path
data = os.path.abspath(os.path.join(package_path,"../../data"))

print(package_path)
print(data)
# ---------- end data ----------

# ----
# Get Pose Cartesian - Realsense camera frame
get = Button()
pose = PythonScript(get=get, tool=python.tool, from_robot=Toggle(False))  # -> pose_cartesian, frame_WCS, plane_WCS
# ---------- pose: Python ----------
from scriptcontext import sticky as st
from ur_fabrication_control.direct_control.common import get_current_pose_cartesian
from compas.geometry import Frame
from compas_ghpython import draw_frame

robot = st["robot"]

server_ip = st["server_ip"]
server_port = st["server_port"]
ur_port = st["ur_port"]
ur_ip = st["ur_ip"]

# retrieve the current tool frame in axis angle format
if from_robot:
    if robot.attached_tool:
        tool_angle_axis = list(robot.attached_tool.frame.point) + list(robot.attached_tool.frame.axis_angle_vector)
    else:
        tool0_frame = Frame([0, 0, 0], [1, 0, 0], [0, 1, 0])
        tool_angle_axis = list(tool0_frame.point) + list(tool0_frame.axis_angle_vector)
else:
    tool_angle_axis = list(tool.frame.point) + list(tool.frame.axis_angle_vector)

print(tool_angle_axis)

guid = str(ghenv.Component.InstanceGuid)
pose_cartesian_key = "pose_cartesian" + guid


if get:
    st[pose_cartesian_key] = get_current_pose_cartesian(tool_angle_axis, server_ip, server_port, ur_ip, ur_port, send=True)

if pose_cartesian_key not in st:
    pose_cartesian = []
else:
    pose_cartesian = st[pose_cartesian_key]

print(pose_cartesian)

# get frame and plane of the current pose cartesian in world coordinates for visualization
if pose_cartesian:
    frame_RCS = Frame.from_axis_angle_vector(axis_angle_vector=pose_cartesian[3:], point=pose_cartesian[:3])
    frame_WCS = robot.RCF_in_WCF.to_world_coordinates(frame_RCS)
    plane_WCS  = draw_frame(frame_WCS)
    print frame_RCS
    print frame_WCS
# ---------- end pose ----------
draw = GhPythonScript(frames=pose.frame_WCS, scale=Slider(0.1, range=0..1))  # -> P, V, W; inputs frames: list
# ---------- draw: Python ----------
from System.Drawing import Color
from compas_ghpython.utilities import draw_frame

red = Color.FromArgb(255, 0, 0)
green = Color.FromArgb(0, 255, 0)
blue = Color.FromArgb(0, 0, 255)

P = []
V = []
C = []

scale = float(scale)

for frame in frames:
    if not frame:
        continue
    plane = draw_frame(frame)
    P += [plane.Origin] * 3
    V.append(plane.XAxis * scale)
    V.append(plane.YAxis * scale)
    V.append(plane.ZAxis * scale)
    C += [red, green, blue]

W = 3
# ---------- end draw ----------
vdisex = VectorDisplayEx(Point=draw.P, Vector=draw.V, Colour=RGB(0, 0, 0), Width=draw.W)
panel_7 = Panel(pose.pose_cartesian)

record_once = Button()  # disabled

# ---- group: Toggle true to read .ply file
toggle_2 = BooleanToggle(False)

# ----
# Option 1. Keyence
# Subscribing and recording the pointcloud from GH
save_to_file = Button()  # disabled

# ----
# Realsense capture
# -- Rough scan --
realsense_d435i = GhPythonScript(data=data, file="221011_brick_wall_print2.ply", create=button, read=toggle)  # -> out, scanmodel, points
# ---------- realsense_d435i: Python ----------
import os
import Rhino.Geometry as rg
from compas_ghpython.utilities import draw_points
from compas.rpc import Proxy
from workshop_aaec_revamp import ScanModel

# create filepath
filepath = os.path.join(data, file)
print(filepath)

# create a new file using RPC
if create:
    with Proxy("workshop_aaec_revamp.sensors.realsense_d435i_methods") as rs:
        rs.export_to_ply(filepath)

# read the .ply file
if read:
    # check if there is a file with the name at the location
    assert os.path.isfile(filepath)
    # in case of an AssertionError please confirm the filepath and ensure the file is present
    scanmodel = ScanModel.from_ply(filepath)
    points = draw_points(scanmodel.points())
# ---------- end realsense_d435i ----------
pt = Point(realsense_d435i.points)

button_2 = Button()  # disabled
convert = Button()  # disabled
toggle_3 = BooleanToggle(False)  # disabled

# ---- group: Change the path to your directory
data_2 = GhPythonScript()  # -> data
# ---------- data_2: Python ----------
__author__ = "Gido"
__version__ = "2020.01.14"

import rhinoscriptsyntax as rs

# Path to directory containing .ply files
data = r"C:\Users\Gido\Documents\workspace\development\workshop_aaec_revamp\data"
# ---------- end data_2 ----------

# ----
clear = Button()  # disabled
py_4 = PythonScript()  # -> DATA; disabled
# ---------- py_4: Python ----------
import os

#package_path = os.path.dirname(mobile_fabrication_control.__file__)
#DATA = os.path.abspath(os.path.join(package_path,"../../data"))

package_path = ghdoc.Path
# package_path = os.path.dirname(ur_fabrication_control.__file__)
#DATA = os.path.abspath(os.path.join(package_path,"../../data"))

# .stl files not stored in am_hackathon repo. but in mobile_fabrication_control
DATA = os.path.abspath(os.path.join(package_path,"../../../workshop_aaec_revamp/data"))

print(package_path)
print(DATA)
# ---------- end py_4 ----------

# ----
# Option 2. Keyence
# Converting Bag to Ply and loading in Python (with Matlab backend)
panel_8 = Panel("2022-10-09-13-01-40.bag")  # disabled
panel_9 = Panel("test_bag_to.ply")  # disabled
python_2 = GhPythonScript(compute=button_2, bag_filename=panel_8, ply_filename=panel_9, data=py_4)  # -> out, a; disabled
# ---------- python_2: Python ----------
__author__ = "Gido"
__version__ = "2022.10.03"

import rhinoscriptsyntax as rs
from workshop_aaec_revamp import ScanModel
import os

bag_filepath = os.path.join(data, bag_filename))
ply_filepath = os.path.join(data, ply_filename))

if compute:
    scanmodel = ScanModel()
    scanmodel.pointcloud_from_bag(bag_filepath, ply_filepath)
# ---------- end python_2 ----------

py_5 = PythonScript()  # -> DATA; disabled; same code as py_4

# ----
# Listen to topics
record = Button()  # disabled
bang = Button()  # disabled
stop = Button()  # disabled
listener = GhPythonScript(
    ros_client=connect_2.ros_client,
    create=bang,
    record=record,
    stop=stop,
    record_once=record_once,
    convert_to_pc=convert,
    save_to_file=save_to_file,
    clear=clear,
    show=toggle_3,
    data=py_5,
    filename=panel_3)  # -> out, pc, points; disabled
# ---------- listener: Python ----------
from scriptcontext import sticky
from compas_ghpython.utilities import update_component
from compas_ghpython import draw_frame
from roslibpy import Topic
from workshop_aaec_revamp import PointcloudRecorder
from compas_ghpython.utilities import draw_points
import time
import os

filepath = os.path.join(data, filename)

pcr_key = 'pcr_' + str(ghenv.Component.InstanceGuid)

if ros_client and ros_client.is_connected:
    if pcr_key in sticky and create:
        pcr = PointcloudRecorder(ros_client)
        pcr.set_topic()
        sticky[pcr_key] = pcr
    elif pcr_key not in sticky:
        sticky[pcr_key] = None

if clear:
    pcr = sticky[pcr_key]
    pcr.clear()

if record:
    pcr = sticky[pcr_key]
    pcr.start_recording()

if stop:
    pcr = sticky[pcr_key]
    pcr.stop_recording()

if record_once:
    pcr = sticky[pcr_key]
    pcr.record_once()

if convert_to_pc:
    pcr = sticky[pcr_key]
    pcr.convert_data_to_pc()

if save_to_file:
    pcr = sticky[pcr_key]
    pcr.save_to_file(filepath)
    
if show:
    pcr = sticky[pcr_key]
    points = draw_points(pcr.points())
# ---------- end listener ----------
panel_10 = Panel(listener.out)  # disabled

keyence = GhPythonScript(data=data_2, file=panel_5, read=toggle_2)  # -> out, scanmodel, points
# ---------- keyence: Python ----------
import os
import Rhino.Geometry as rg
from compas_ghpython.utilities import draw_points
from compas.rpc import Proxy
from workshop_aaec_revamp import ScanModel

# create filepath
filepath = os.path.join(data, file)
print(filepath)

# read the .ply file
if read:
    # check if there is a file with the name at the location
    assert os.path.isfile(filepath)
    # in case of an AssertionError please confirm the filepath and ensure the file is present
    scanmodel = ScanModel.from_ply(filepath)
    points = draw_points(scanmodel.points())
# ---------- end keyence ----------

realsense_tcf_in_wcf_print2 = Plane(Plane(origin=(1.138975592, 0.07185194846, 0.805865), x=(-0.139897073, 0.98986193, -0.02453912196), y=(0.9891585761, 0.1408294888, 0.04162170592)))
realsense_tcf_in_wcf_print1 = Plane(Plane(origin=(1.107006312, -0.006907311816, 0.920639), x=(-0.04967065867, 0.998765651, -1.429441465e-06), y=(0.998765651, 0.04967065867, 6.432016809e-07)))

# ----
# Realsense pointcloud to Fine scan paths
panel_11 = Panel("0,0,0.25")
xy = XYPlane(Origin=panel_11)
transform_crop = GhPythonScript(
    compute=Button(),
    scanmodel=realsense_d435i.scanmodel,
    tool_plane=realsense_tcf_in_wcf_print2,
    split=Toggle(True),
    split_plane=xy,
    show=Toggle(False))  # -> out, points; inputs tool_plane: Plane, split_plane: Plane
# ---------- transform_crop: Python ----------
from compas.geometry import Frame
from compas_ghpython.utilities import draw_points

if compute:
    tool_frame= Frame(tool_plane.Origin, tool_plane.XAxis, tool_plane.YAxis)
    scanmodel.tool_frame = tool_frame
    scanmodel.set_pc_in_tcp()
    
    split_frame = Frame(split_plane.Origin, split_plane.XAxis, split_plane.YAxis)
    if split:
        split_cpts = scanmodel.split_pointcloud_by_frame(split_frame)

if show:
    points = draw_points(scanmodel.points())
# ---------- end transform_crop ----------
pt_2 = Point(transform_crop.points)
local_grid_subdivisions = Slider(4, range=0..10)
global_grid_size = Slider(0.047, range=0..0.1)
tolerance = Slider(0.002, range=0..0.005)
pt_3 = Point()
pointcloud_to_grid = GhPythonScript(compute=Toggle(False), density=global_grid_size, factor=local_grid_subdivisions, tolerance=tolerance, pointcloud=pt_3)  # -> out, planes_x, planes_y; inputs pointcloud: list of Point3d
# ---------- pointcloud_to_grid: Python ----------
import rhinoscriptsyntax as rs
import math
from compas.geometry import bounding_box, Box, Point, KDTree, NurbsCurve, Vector, cross_vectors, Frame, angle_vectors, Rotation, length_vector
from compas_ghpython.utilities import draw_points, draw_frame, list_to_ghtree
from compas_ghpython.artists import CurveArtist
from math import ceil,floor, pi

cutoff_length = 0.02

def grid_from_points(points, density):
    bbox = bounding_box(points)
    box = Box.from_bounding_box(bbox)
    u_count = int(ceil(abs(box.xmin-box.xmax)/density))
    v_count = int(ceil(abs(box.ymin-box.ymax)/density))
    u_length = box.width/(u_count-1)
    v_length = box.depth/(v_count-1)
    
    points_grid_x = []
    points_grid_y = []
    
    dx = box.width/(u_count*factor-1)
    dy = box.depth/(v_count*factor-1)
    
    for u in range(0,u_count):
        points_xline = []
        x = box.xmin+u*(u_length)
        points_xline = [Point(x,box.ymin+v*dy,0) for v in range(0,int(v_count*factor))]
        points_grid_x.append(points_xline)

    for v in range(0,v_count):
        points_yline = []
        y = box.ymin + v*(v_length)
        points_yline = [Point(box.xmin+u*dx,y,0) for u in range(0,int(u_count*factor))]
        points_grid_y.append(points_yline)
    return points_grid_x, points_grid_y

def pointcloud_grid_cpts(pointcloud, points_grid_x, points_grid_y):
    pointcloud_flat = [Point(point.X,point.Y,0) for point in pointcloud]
    points_kdtree = KDTree(pointcloud_flat)
    points_grid_nearest_x = []
    points_grid_nearest_y = []
    for i,points in enumerate(points_grid_x):
        points_xline_nearest = []
        for point in points:
            nearest_point, index, d = points_kdtree.nearest_neighbor(point)
            nearest_point = Point(point.x,nearest_point[1],pointcloud[index].Z)
            if d < tolerance:
                points_xline_nearest.append(nearest_point)
        points_grid_nearest_x.append(points_xline_nearest)
    for i,points in enumerate(points_grid_y):
        points_yline_nearest = []
        for point in points:
            nearest_point, index, d = points_kdtree.nearest_neighbor(point)
            nearest_point = Point(nearest_point[0],point.y,pointcloud[index].Z)
            if d < tolerance:
                points_yline_nearest.append(nearest_point)
        points_grid_nearest_y.append(points_yline_nearest)
    return points_grid_nearest_x, points_grid_nearest_y

def planes_from_grid(pts_xgrid, pts_y):
    
    planes_x = []
    for pts_xline in pts_xgrid:
        if len(pts_xline) > 5:
            m = 0
            n = len(pts_xline)
            planes = []
            for index, point in enumerate(pts_xline):
                if index == 0:
                    vy = Vector.from_start_end(point,pts_xline[index+1])
                    length = length_vector(vy)
                elif index == len(pts_xline)-1:
                    vy = Vector.from_start_end(pts_xline[index-1],point)
                else:
                    v1 = Vector.from_start_end(pts_xline[index-1],point)
                    v2 = Vector.from_start_end(point,pts_xline[index+1])
                    vy = v1+v2
                    length = length_vector(Vector.from_start_end(point,pts_xline[index+1]))
                if vy.z < 0:
                    vector_z = [0,0,-1]
                    k = -1
                else:
                    vector_z = [0,0,1]
                    k=1
                if angle_vectors(vy, vector_z) >= math.pi/2.2:  
                    vy = Vector(vy.x,vy.y,0)
                elif angle_vectors(vy, vector_z) < math.pi/2.2: 
                    vy = Vector(vy.x,vy.y,0)
                    axis = vy.cross(Vector.Zaxis())
                    R = Rotation.from_axis_and_angle(axis, k*math.pi/16)
                    vy.transform(R)
                vx = vy.cross(Vector.Zaxis())
                if index>0 and angle_vectors(vy, planes[index-1].YAxis) <= math.pi/9:
                    planes.append(draw_frame(Frame(point, vx, vy)))
                else:
                    planes.append(draw_frame(Frame(point, vx, vy)))
                if index <= 2 and length > cutoff_length:
                    m = index+1
                if len(pts_xline)-1 > index >= len(pts_xline)-4 and length > cutoff_length:
                    if index < n:
                        n = index+1
            planes = planes[m:n]
            planes_x.append(planes)
            
            
    planes_y = []
    for pts_yline in points_grid_nearest_y:
        if len(pts_yline) > 5:
            m = 0
            n = len(pts_yline)
            planes = []
            for index, point in enumerate(pts_yline):
                if index == 0:
                    vy = Vector.from_start_end(point,pts_yline[index+1])
                    length = length_vector(vy)
                elif index == len(pts_yline)-1:
                    vy = Vector.from_start_end(pts_yline[index-1],point)
                else:
                    v1 = Vector.from_start_end(pts_yline[index-1],point)
                    v2 = Vector.from_start_end(point,pts_yline[index+1])
                    vy = v1+v2
                    length = length_vector(Vector.from_start_end(point,pts_yline[index+1]))
                if vy.z < 0:
                    vector_z = [0,0,-1]
                    k=-1
                else:
                    vector_z = [0,0,1]
                    k=1
                if angle_vectors(vy, vector_z) >= math.pi/2.2:  
                    vy = Vector(vy.x,vy.y,0)
                elif angle_vectors(vy, vector_z) < math.pi/2.2: 
                    vy = Vector(vy.x,vy.y,0)
                    axis = vy.cross(Vector.Zaxis())
                    R = Rotation.from_axis_and_angle(axis, k*math.pi/16)
                    vy.transform(R)
                vx = vy.cross(Vector.Zaxis())
                if index>0 and angle_vectors(vy, planes[index-1].YAxis) <= math.pi/9:
                    planes.append(draw_frame(Frame(point, vx, vy)))
                else:
                    planes.append(draw_frame(Frame(point, vx, vy)))
                if index <= 2 and length > cutoff_length:
                    m = index+1
                if len(pts_yline)-1 > index >= len(pts_yline)-4 and length > cutoff_length:
                    if index < n:
                        n = index+1
            planes = planes[m:n-1]
            planes_y.append(planes)
            
    return planes_x, planes_y

if compute:
    pts_grid_x, pts_grid_y = grid_from_points(pointcloud, density)
    points_grid_nearest_x, points_grid_nearest_y = pointcloud_grid_cpts(pointcloud, pts_grid_x, pts_grid_y)
    planes_x, planes_y = planes_from_grid(points_grid_nearest_x, points_grid_nearest_y)
    
    planes_x = list_to_ghtree(planes_x)
    planes_y = list_to_ghtree(planes_y)
# ---------- end pointcloud_to_grid ----------
plane = Plane(pointcloud_to_grid.planes_y)
plane_2 = Plane(pointcloud_to_grid.planes_x)

# ----
# DESIGN ENVIRONMENT
printpaths = Curve([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])

# ---- group: Sorting curves on Z-value
end = EndPoints(Curve=printpaths)  # -> Start, End
pdecon = Deconstruct(Point=end.Start)  # -> XComponent, YComponent, ZComponent
lng = ListLength(List=pdecon.ZComponent)
x_minus_one = XMinusOne(NumberX=lng)
range = Range(Domain=x_minus_one, Steps=x_minus_one)
sort = SortList(Keys=pdecon.ZComponent, ValuesA=range)  # -> Keys, ValuesA
item = ListItem(List=printpaths, Index=sort.ValuesA, Wrap=True)

# ---- group: Retraction distance
number_slider = Slider(0.05, range=0..0.1)

# ----
# SERVER
button_3 = Button()
feedbackserver = GhPythonScript(create=button_3, clear=Button(), close=Button())  # -> server
# ---------- feedbackserver: Python ----------
__author__ = "Gido"
__version__ = "2022.05.16"

import rhinoscriptsyntax as rs
from scriptcontext import sticky as st
from fabrication_manager.communication import TCPFeedbackServer

server_ip = st["server_ip"]
server_port = st["server_port"]

server = TCPFeedbackServer(server_ip, server_port)

if clear:
    server.clear()
    
if close:
    server.shutdown()
# ---------- end feedbackserver ----------

# ----
# Option 2. Realsense
# Subscribing and recording the pointcloud from GH
# Listen to topics
panel_12 = Panel("test_sub_to.ply")  # disabled
save_to_file_2 = Button()  # disabled
record_2 = Button()  # disabled
create = Button()  # disabled
stop_2 = Button()  # disabled

record_once_2 = Button()  # disabled
toggle_4 = BooleanToggle(True)  # disabled
clear_2 = Button()  # disabled
py_6 = PythonScript()  # -> DATA; disabled; same code as py_4

listener_2 = GhPythonScript(
    ros_client=connect_2.ros_client,
    create=create,
    record=record_2,
    stop=stop_2,
    record_once=record_once_2,
    convert_to_pc=toggle_4,
    save_to_file=save_to_file_2,
    clear=clear_2,
    data=py_6,
    filename=panel_12)  # -> out, pc, points; disabled
# ---------- listener_2: Python ----------
from scriptcontext import sticky
from compas_ghpython.utilities import update_component
from compas_ghpython import draw_frame
from roslibpy import Topic
from workshop_aaec_revamp import PointcloudRecorder
from compas_ghpython.utilities import draw_points
import time
import os

filepath = os.path.join(data, filename))

pcr_key = 'pcr_' + str(ghenv.Component.InstanceGuid)

if ros_client and ros_client.is_connected:
    if pcr_key in sticky and create:
        pcr = PointcloudRecorder(ros_client)
        pcr.set_topic()
        sticky[pcr_key] = pcr
    elif pcr_key not in sticky:
        sticky[pcr_key] = None

if clear:
    pcr = sticky[pcr_key]
    pcr.clear()

if record:
    pcr = sticky[pcr_key]
    pcr.start_recording()

if stop:
    pcr = sticky[pcr_key]
    pcr.stop_recording()

if record_once:
    pcr = sticky[pcr_key]
    pcr.record_once()

if convert_to_pc:
    pcr = sticky[pcr_key]
    pc = pcr.convert_data_to_pc()
    cpoints = [{"pos":pt.data} for pt in pc.points]
    points = draw_points(cpoints)

if save_to_file:
    pcr = sticky[pcr_key]
    pcr.save_to_file(filepath)

#pcext = PointcloudExtended([])
#listener = Topic(ros_client, "/point_cloud_data2", "std_msgs/Float32MultiArray")
#listener.subscribe(pcext)
#time.sleep(5)
#listener.unsubscribe()
# ---------- end listener_2 ----------
panel_13 = Panel(listener_2.out)  # disabled

pt_4 = Point(listener_2.points)  # disabled

# ---- group: reposition within RCF
xy_2 = XYPlane(Origin=Point(0, 0, 0))
pi = Pi(Factor=1)
prot = RotatePlane(Plane=xy_2, Angle=pi)

# ----
# SIMULATION ENVIRONMENT
py_7 = PythonScript()  # -> repositories_path, rbvogui_data_path, ur_data_path
# ---------- py_7: Python ----------
import os

"""
ASSUMING THE BELOW PACKAGES ARE STORED IN THE SAME LOCATION:
    ur_fabrication_control;
    rbvogui_common; and
    mobile_additive_manufacturing.
"""

repositories_path = os.path.abspath(os.path.join(ghdoc.Path,"../../../"))

assert os.path.exists(os.path.join(repositories_path, "ur_fabrication_control/data"))
assert os.path.exists(os.path.join(repositories_path, "rbvogui_common/rbvogui_description"))
assert os.path.exists(os.path.join(repositories_path, "mobile_fabrication_control"))

ur_data_path = os.path.abspath(os.path.join(ghdoc.Path,"../../../ur_fabrication_control/data"))
rbvogui_data_path = os.path.abspath(os.path.join(repositories_path, "rbvogui_common"))
# ---------- end py_7 ----------
list_3 = ValueList({"ur3.urdf", "ur3_rot.urdf", "ur5.urdf", "ur10.urdf", "ur3e.urdf", "ur5e.urdf", "ur10e.urdf", "ur10e_rot.urdf"}, selected="ur10e_rot.urdf")
list_4 = ValueList({"ur3.srdf", "ur5.srdf", "ur10.srdf", "ur3e.srdf", "ur5e.srdf", "ur10e.srdf"}, selected="ur10e.srdf")
list_5 = ValueList({"realsense": 0, "keyence": 1}, selected="keyence")
py_8 = PythonScript()  # -> DATA; same code as py_4
list_6 = ValueList({"default", "measured", "initial"}, selected="default")
plane_nr = Slider(0, range=0..200)
list_7 = ValueList({"Zero": 0, "One": 1, "Two": 2, "Three": 3, "Four": 4, "Five": 5}, selected="Zero")

python_3 = GhPythonScript(choice=list_6, vertical_axis_height=Slider(0, range=0..0.72), vertical_axis_correction=Slider(0, range=-0.1..0.1))  # -> out, ur_base_frame_rhino_local_tf, ur_base_plane
# ---------- python_3: Python ----------
__author__ = "Gido"
__version__ = "2022.04.11"

import rhinoscriptsyntax as rs
from compas.geometry import Frame
from compas.geometry import Translation
from compas_ghpython.utilities import draw_frame

if choice=="measured":
    ur_base_frame_rhino_local_tf = Frame(ur_base_plane_rhino_local_tf.Origin, 
                                         ur_base_plane_rhino_local_tf.XAxis, 
                                         ur_base_plane_rhino_local_tf.YAxis)
    T = Translation.from_vector(ur_base_frame_rhino_local_tf.zaxis*(vertical_axis_height+vertical_axis_correction))
    ur_base_frame_rhino_local_tf = ur_base_frame_rhino_local_tf.transformed(T)
elif choice=="initial":
    ur_base_frame_rhino_local_tf = Frame(ur_base_plane_init.Origin, 
                                         ur_base_plane_init.XAxis, 
                                         ur_base_plane_init.YAxis)
    T = Translation.from_vector(ur_base_frame_rhino_local_tf.zaxis*(vertical_axis_height+vertical_axis_correction))
    ur_base_frame_rhino_local_tf = ur_base_frame_rhino_local_tf.transformed(T)

elif choice =="default":
    ur_base_frame_rhino_local_tf = Frame([0.275, 0.0, 1.105], [-0.707, 0.707, 0.0], [-0.707, -0.707,0.0])
    T = Translation.from_vector(ur_base_frame_rhino_local_tf.zaxis*(vertical_axis_height+vertical_axis_correction))
    ur_base_frame_rhino_local_tf = ur_base_frame_rhino_local_tf.transformed(T)


ur_base_plane = draw_frame(ur_base_frame_rhino_local_tf)
# ---------- end python_3 ----------

# ----
# Robot Model
# Load Model
list_8 = ValueList({"ur_description", "ur_e_description", "ur_setups"}, selected="ur_e_description")
py_9 = PythonScript(
    repositories_path=py_7.repositories_path,
    rbvogui_data_path=py_7.rbvogui_data_path,
    ur_data_path=py_7.ur_data_path,
    package=list_8,
    urdf_name=list_3,
    srdf_name=list_4)  # -> loaders, urdf_filename, srdf_filename
# ---------- py_9: Python ----------
import os
from compas.robots import LocalPackageMeshLoader

#loaders

ur_path = os.path.join(ur_data_path, "robot_description")
ur_packages = ["ur_description", "ur_e_description", "ur_end_effectors", "ur_setups"]
ur_loaders = [LocalPackageMeshLoader(ur_path, pck) for pck in ur_packages]

rbvogui_packages = ["rbvogui_description"]
rbvogui_loaders = [LocalPackageMeshLoader(rbvogui_data_path, pck) for pck in rbvogui_packages]

ewellix_packages = ["ewellix_description"]
ewellix_loaders = [LocalPackageMeshLoader(repositories_path, pck) for pck in ewellix_packages]

sensors_packages = ["robotnik_sensors"]
sensors_loaders = [LocalPackageMeshLoader(repositories_path, pck) for pck in sensors_packages]

loaders = ur_loaders + rbvogui_loaders + ewellix_loaders + sensors_loaders

#files
urdf_filename = os.path.join(repositories_path, r"mobile_fabrication_control\data\rbvogui_xl_lift_ur10e.urdf")
srdf_filename = os.path.join(repositories_path, r"mobile_fabrication_control\data\rbvogui.srdf")

assert os.path.isfile(urdf_filename)
assert os.path.isfile(srdf_filename)
# ---------- end py_9 ----------
units = ValueList({"m": 1, "cm": 100, "mm": 1000}, selected="m")
load = Button()
create_2 = PythonScript(
    load=load,
    ur_base_frame_rhino_local_tf=python_3.ur_base_frame_rhino_local_tf,
    loaders=py_9.loaders,
    urdf_filename=py_9.urdf_filename,
    srdf_filename=py_9.srdf_filename,
    scale_factor=units)  # -> out, robot, rcf; inputs load: Boolean, loaders: list
# ---------- create_2: Python ----------
import os
from scriptcontext import sticky as st

import compas

from compas_ghpython import draw_frame
from compas.robots import RobotModel
from compas.robots import LocalPackageMeshLoader

from compas_fab.robots import Robot
from compas_fab.robots import RobotSemantics
from compas_fab.ghpython import RobotArtist

compas.PRECISION = '12f'

# store robot in component
guid = str(ghenv.Component.InstanceGuid)
robot_key = "robot"

if robot_key not in st:
    st[robot_key] = None

#print loaders
if load:
    model = RobotModel.from_urdf_file(urdf_filename)
    
    model.load_geometry(*loaders)
    artist = RobotArtist(model)
    semantics = RobotSemantics.from_srdf_file(srdf_filename, model)
    robot = Robot(model, artist, semantics, client=None)
    
    st[robot_key] = robot

robot = st[robot_key]
print(robot)
rcf = draw_frame(robot.get_RCF())
print(rcf)

if robot:
    robot.scale(scale_factor)
    robot.RCF_in_WCF = ur_base_frame_rhino_local_tf
# ---------- end create_2 ----------
robot = Data(create_2.robot)

# ----
# Tool
list_9 = ValueList({"measurement_tool": 0, "clay_extruder_7mm": 1, "clay_extruder_7mm_with_2d_laser": 2, "clay_extruder_v21_7mm": 3, "scanner_tool": 4}, selected="clay_extruder_v21_7mm")
show_2 = BooleanToggle(True)
python_4 = PythonScript(data_path=py_8, tool=list_9, tcp_frame=list_5, show=show_2)  # -> tool, M, ee_plane; inputs tcp_frame: Int32; same code as python
py_10 = PythonScript(robot=robot, tool=python_4.tool, attach=Toggle(True))  # -> a
# ---------- py_10: Python ----------
if attach:
    robot.attach_tool(tool, group = "ur10e")
else:
    robot.detach_tool()
# ---------- end py_10 ----------

# ----
# Get Pose Cartesian
get_2 = Button()
pose_2 = PythonScript(get=get_2, tool=python_4.tool, from_robot=Toggle(False))  # -> pose_cartesian, frame_WCS, plane_WCS; same code as pose
draw_2 = GhPythonScript(frames=pose_2.frame_WCS, scale=Slider(0.1, range=0..1))  # -> P, V, W; inputs frames: list; same code as draw
vdisex_2 = VectorDisplayEx(Point=draw_2.P, Vector=draw_2.V, Colour=RGB(0, 0, 0), Width=draw_2.W)
panel_15 = Panel(pose_2.pose_cartesian)

pln = Plane(create_2.rcf)

# ----
# requires the installation of matlab.engine
# These pointclouds are very large, might slow your rhino down substantially, use at your own risk
python_5 = GhPythonScript(compute=Button(), scanmodel=keyence.scanmodel, base_plane=pln, show=Toggle(True))  # -> out, points; inputs base_plane: Plane
# ---------- python_5: Python ----------
from compas.geometry import Frame, Translation, Vector
from compas_ghpython.utilities import draw_points

if compute:
    tool_frame= Frame(tool_plane.Origin, tool_plane.XAxis, tool_plane.YAxis)
    T = Translation.from_vector(Vector(0,0,0.006196))
    tool_frame_tf = tool_frame.transformed(T)
    scanmodel.tool_frame = tool_frame_tf
    scanmodel.set_pc_in_tcp()

if show:
    points = draw_points(scanmodel.points())
# ---------- end python_5 ----------
pt_5 = Point(python_5.points)

# ---- group: reposition within RCF (continued)
orient = Orient(Geometry=item, Source=prot, Target=pln)  # -> Geometry, Transform

# ---- group: Create planes
divlength = DivideLength(Curve=orient.Geometry, Length=Slider(0.012, range=0..0.1))  # -> Points, Tangents, Parameters
control_points = Point(divlength.Points)
pl = ConstructPlane(Origin=control_points, XAxis=Vector(1, 0, 0), YAxis=Vector(0, 1, 0))

# ----
# Printplanes generation
python_6 = GhPythonScript(planes=simplify(pl), z_offset=number_slider)  # -> out, planes_data, jumps; inputs planes: tree of Plane
# ---------- python_6: Python ----------
import rhinoscriptsyntax as rs
import Rhino.Geometry as rg
from compas_ghpython import ghtree_to_list, draw_frame
from compas.geometry import Frame, Vector, Translation

def planes_to_frames(planes):
    return [Frame(plane.Origin, plane.XAxis, -plane.YAxis) if plane.XAxis[0]>0 else Frame(plane.Origin, -plane.XAxis, -plane.YAxis) for plane in planes if plane]

def frames_to_planes(frames):
    return [draw_frame(frame) for frame in frames]

jumps = 0
nl_planes = ghtree_to_list(planes)
print(len(nl_planes))
T = Translation.from_vector(Vector(0,0,z_offset))
planes_data = []
for subplanes in nl_planes:
    if len(subplanes)>3:
        subframes = planes_to_frames(subplanes)
        init_frame = subframes[0].transformed(T)
        end_frame = subframes[-1].transformed(T)
        planes_data.extend([draw_frame(init_frame), draw_frame(subframes[0])])
        planes_data.append("extruder_on")
        planes_data.extend(frames_to_planes(subframes[1:len(subframes)]))
        planes_data.append("extruder_off")
        planes_data.extend([draw_frame(init_frame)])
        jumps += 1
# ---------- end python_6 ----------
panel_16 = Panel(python_6.planes_data)

# ----
# Info
info = PythonScript(robot=robot)  # -> out, main_group_name
# ---------- info: Python ----------
if robot:
    robot.info()
    main_group_name = robot.main_group_name
# ---------- end info ----------
panel_17 = Panel(info.out)

# ---- group: forward kinematics
# Configuration
a1 = Slider(45, range=-360..360)
a2 = Slider(-45, range=-360..360)
a3 = Slider(135, range=-360..360)
a5 = Slider(-90, range=-360..360)
a6 = Slider(0, range=-360..360)
a4 = Slider(-180, range=-360..360)
jp = GhPythonScript()  # -> joint_positions
# ---------- jp: Python ----------
import math

joint_positions = [0,-90,90,0,90,0]
joint_positions = [math.radians(a) for a in joint_positions]
#joint_positions = [-3.136, -0.328, -1.218, 3.129, 0.852, 0.008]
#joint_positions = [0] * 6



#joint_positions = [1.6239667567485938, 0.25439606475392273, 4.409424838594969-2*3.14, 3.1901607306255908, 1.5707963267948954, 0.053170429953696939]
#joint_positions = [1.598543436748912, 0.23021224965157744, 4.712232135219824-2*3.14, 6.0531299026928744, 4.7123889803846915, 0.027747109954015234]
#joint_positions = [-1.1373533430447322, 4.0117247163121572, 5.4083762087596021-2*3.14, 1.5754733624925168, 4.7123889803846879, 3.5750356373399574]
print joint_positions
# ---------- end jp ----------
forward_kinematics = PythonScript(robot=robot, set_joint_positions=Button(), joint_positions=jp, a1=a1, a2=a2, a3=a3, a4=a4, a5=a5, a6=a6)  # -> full_configuration; inputs joint_positions: list
# ---------- forward_kinematics: Python ----------
import math
import Grasshopper
from compas.robots import Joint
from compas_fab.robots import Configuration

if set_joint_positions:

    j = 0
    for i in range(ghenv.Component.Params.Input.Count):
        nslider = ghenv.Component.Params.Input[i].Sources[0]
        if nslider.GetType() == Grasshopper.Kernel.Special.GH_NumberSlider:
            nslider.TrySetSliderValue(math.degrees(joint_positions[j]))
            j += 1

if robot:
    joint_positions = [a1, a2, a3, a4, a5, a6]
    joint_types = robot.get_configurable_joint_types()
    for i, joint_type in enumerate(joint_types):
        if joint_type == Joint.REVOLUTE:
            joint_positions[i] = math.radians(joint_positions[i])
    full_configuration = Configuration(joint_positions, joint_types)
    
print(full_configuration)
# ---------- end forward_kinematics ----------

# ---- group: inverse kinematics
select_configuration = Slider(1, range=0..7)
inverse = PythonScript(
    robot=robot,
    group=info.main_group_name,
    tool=python_4.ee_plane,
    plane_WCS=realsense_tcf_in_wcf_print2,
    idx=select_configuration)  # -> out, plane_tool0_RCS, plane_tcp_RCS, configuration; inputs tool: Plane, plane_WCS: Plane, idx: Int32
# ---------- inverse: Python ----------
import Rhino.Geometry as rg
import math
from compas.geometry import Frame, Transformation, Rotation
from compas_fab.robots import Configuration
from ur_fabrication_control.kinematics.ur_kinematics import inverse_kinematics
from ur_fabrication_control.kinematics.ur_params import ur_params
from compas_ghpython import draw_frame

tcp_WCS = Frame(plane_WCS.Origin, plane_WCS.XAxis, plane_WCS.YAxis)

# transform frame to robot coordinate system
print tcp_WCS
print plane_WCS
tcp_RCS = robot.RCF_in_WCF.to_local_coordinates(tcp_WCS)
#T = Transformation.from_frame(Frame(tool.Origin, tool.XAxis, tool.YAxis))
#Tinv = T.inverted()
tool0_RCS = robot.from_tcf_to_t0cf([tcp_RCS])[0]
#tool0_RCS = tcp_RCS.transformed(Tinv)
print tcp_RCS
print tool0_RCS
plane_tool0_RCS = draw_frame(tool0_RCS)
plane_tcp_RCS = draw_frame(tcp_RCS)
# calculate solutions to frame
ur_params = ur_params["ur10e"] # get the parameters according to the robot model
print ur_params
solutions = inverse_kinematics(tool0_RCS, ur_params)
print solutions

if not len(solutions):
    joint_values = [0,0,0,0,0,0]
    configuration = Configuration.from_revolute_values(joint_values)
else:
    joint_values = solutions[idx]
    #print joint_values
    
    ### ***** HACK ***** ##### TODO: CHECK!!!
    for i, v in enumerate(joint_values):
        if v > math.pi:
            v -= 2*math.pi
        if v < -math.pi:
            v += 2*math.pi
        joint_values[i] = v
    ### ***** HACK ***** ##### TODO: CHECK!!!
    configuration = [Configuration.from_revolute_values(joint_values)]

print(configuration)
# ---------- end inverse ----------

select_configuration_2 = Slider(2, range=0..7)
# Block is red due to invalid inputs, though remains perfectly functional
inverse_2 = PythonScript(robot=robot, planes_WCS=python_6.planes_data, plane_nr=plane_nr, idx=select_configuration_2)  # -> out, plane_tool0_RCS, plane_tcp_RCS, configuration; inputs planes_WCS: list of Plane, plane_nr: Int32, idx: Int32
# ---------- inverse_2: Python ----------
import Rhino.Geometry as rg
import math
from compas.geometry import Frame, Transformation, Rotation
from compas_fab.robots import Configuration
from ur_fabrication_control.kinematics.ur_kinematics import inverse_kinematics
from ur_fabrication_control.kinematics.ur_params import ur_params
from compas_ghpython import draw_frame

plane_WCS = planes_WCS[plane_nr]
tcp_WCS = Frame(plane_WCS.Origin, plane_WCS.XAxis, plane_WCS.YAxis)

# transform frame to robot coordinate system
tcp_RCS = robot.RCF_in_WCF.to_local_coordinates(tcp_WCS)
tool0_RCS = robot.from_tcf_to_t0cf([tcp_RCS])[0]

print tcp_RCS
print tool0_RCS
plane_tool0_RCS = draw_frame(tool0_RCS)
plane_tcp_RCS = draw_frame(tcp_RCS)
# calculate solutions to frame
ur_params = ur_params["ur10e"] # get the parameters according to the robot model
solutions = inverse_kinematics(tool0_RCS, ur_params)

if not len(solutions):
    joint_values = [0,0,0,0,0,0]
    configuration = Configuration.from_revolute_values(joint_values)
else:
    joint_values = solutions[idx]
    #print joint_values
    
    ### ***** HACK ***** ##### TODO: CHECK!!!
    for i, v in enumerate(joint_values):
        if v > math.pi:
            v -= 2*math.pi
        if v < -math.pi:
            v += 2*math.pi
        joint_values[i] = v
    ### ***** HACK ***** ##### TODO: CHECK!!!
    
    configuration = [Configuration.from_revolute_values(joint_values)]

print(configuration)
# ---------- end inverse_2 ----------

# ----
list_10 = ValueList({"0 forward_kinematics": 0, "1 inverse_kinematics": 1, "2 inverse_kinematics": 2}, selected="2 inverse_kinematics")
filter = StreamFilter(Gate=list_10, Stream0=forward_kinematics, Stream1=inverse.configuration, Stream2=inverse_2.configuration)

# ----
# Visualisation
show_end_effector_frame = BooleanToggle(True)
show_base_frame = BooleanToggle(False)
show_collision = BooleanToggle(False)
show_frames = BooleanToggle(True)
show_visual = BooleanToggle(True)
show_acm = BooleanToggle(False)
visualize = PythonScript(
    robot=robot,
    tool=python_4.tool,
    group=info.main_group_name,
    configuration=filter,
    redraw=py_10,
    show_visual=show_visual,
    show_collision=show_collision,
    show_end_effector_frame=show_end_effector_frame,
    show_frames=show_frames,
    show_base_frame=show_base_frame,
    show_acm=show_acm,
    station=list_7)  # -> out, robot, visual, collision, attached_meshes, frames, ee_frame, tool0_frame, base_frame, base_pt; inputs redraw: list, attached_collision_meshes: list, station_pts: list
# ---------- visualize: Python ----------
import rhinoscriptsyntax as rs
import Rhino.Geometry as rg
import ghpythonlib.components as ghcomp
from compas.geometry import Vector
from compas.geometry import Point
from compas.geometry import Transformation
from compas.geometry import Frame
from compas_ghpython.artists import MeshArtist
from compas_ghpython.utilities import draw_frame
from compas_fab.robots import Configuration
from ur_fabrication_control.kinematics.ur_kinematics import forward_kinematics
from ur_fabrication_control.kinematics.ur_params import ur_params

print(configuration)

if robot and configuration:
    
    robot.update(configuration, visual=show_visual, collision=show_collision)
    ur_params = ur_params[robot.main_group_name]
    print(ur_params)
    if show_visual:
        visual = robot.artist.draw_visual()
        robot_RCF = draw_frame(robot.RCF_in_WCF)
        init_robot_plane = rg.Plane(rg.Point3d(0.275, 0.0, 1.105), rg.Vector3d(-0.707, 0.707, 0.0), rg.Vector3d(-0.707, -0.707,0.0))
        visual = ghcomp.Orient(visual, init_robot_plane, robot_RCF)[0]
        
    if show_collision:
        collision = robot.artist.draw_collision()
    
    frames = robot.transformed_frames(configuration, group)

    if show_base_frame:
        base_frame = frames[0]

    if show_end_effector_frame:
#        tool0_frame = forward_kinematics(configuration.revolute_values, ur_params)
        tool0_frame = robot.forward_kinematics(configuration, group)
        print tool0_frame
        ee_frame = robot.from_t0cf_to_tcf([tool0_frame])
        print("End-effector", ee_frame)
    
    if not show_frames:
        frames = None

#    frame = forward_kinematics(configuration.revolute_values, ur_params)
    frame = robot.forward_kinematics(configuration, options=dict(solver='model', link_name=robot.attached_tool.link_name))
    #robot.artist.update_tool(visual=visual, collision=collision, transformation=Transformation.from_frame_to_frame(Frame.worldXY(), tool0_frame))
    
    if show_acm:
        M = []
        for acm in attached_collision_meshes:
            frame = robot.forward_kinematics(configuration, options=dict(solver='model', link_name=acm.link_name))
            T = Transformation.from_frame_to_frame(Frame.worldXY(), frame)
            mesh = acm.collision_mesh.mesh.transformed(T)
            M.append(MeshArtist(mesh).draw())
        attached_meshes = M
# ---------- end visualize ----------
geo = Geometry(visualize.visual)
geo_2 = Geometry(visualize.collision)
draw_3 = GhPythonScript(frames=[visualize.frames, visualize.ee_frame, visualize.base_frame], scale=Slider(0.1, range=0..1))  # -> P, V, C, W; inputs frames: list; same code as draw
preview = CustomPreview(Geometry=geo, Shader=ColourSwatch(SwatchColor=RGB(105, 105, 105)))
preview_2 = CustomPreview(Geometry=visualize.attached_meshes, Shader=ColourSwatch(SwatchColor=RGB(255, 255, 255)))
vdisex_3 = VectorDisplayEx(Point=draw_3.P, Vector=draw_3.V, Colour=draw_3.C, Width=draw_3.W)

# ----
# SCAN TASKS
number_slider_2 = Slider(0.03, range=0..0.2)
scantasks = GhPythonScript(
    create=Button(),
    robot=robot,
    robot_speed=number_slider_2,
    tool=python_4.tool,
    server=feedbackserver,
    planes_x=plane_2,
    planes_y=plane)  # -> out, tasks; inputs planes_x: tree of Plane, planes_y: tree of Plane
# ---------- scantasks: Python ----------
from scriptcontext import sticky as st
from ur_fabrication_control.direct_control.fabrication_process import URTask
from extruder_control.fabrication import EXTTask
from ur_fabrication_control.direct_control import URScript
from compas.geometry import Frame, Transformation
from compas_ghpython.utilities import ghtree_to_list, draw_frame

ur_ip = st["ur_ip"]
ur_port = st["ur_port"]
server_ip = st["server_ip"]
server_port = st["server_port"]

def tasks_from_planes(planestree, start_ind=0):
    tasks = []
    for planes in planestree:
        tasks.append(urtask_from_planes(planes, start_ind+len(tasks)))
    return tasks

def urtask_from_planes(planes, key):
    req_msg = "Task_{}_Completed".format(key)
    if key%2==0:
        planes = list(reversed(planes))
    urscript = urscript_from_planes(planes, key, req_msg)
    new_task = URTask(server, urscript, req_msg, key)
    return new_task

def planes_to_frames(planes):
    print(planes[0])
    return [Frame(plane.Origin, plane.XAxis, plane.YAxis) for plane in planes if plane is not None]

def get_frames_in_RCS(frames):
    return [robot.RCF_in_WCF.to_local_coordinates(frame) for frame in frames]


def urscript_from_planes(planes, pkey, exit_message):
    frames = planes_to_frames(planes)
#    T0_frames = robot.attached_tool.from_tcf_to_t0cf(frames)
    RCS_frames = get_frames_in_RCS(frames)
    
    ur_script = URScript(ur_ip=ur_ip, ur_port=ur_port)
    tool_angle_axis = list(robot.attached_tool.frame.point) + list(robot.attached_tool.frame.axis_angle_vector)
#    tool_angle_axis = [0,0,0,0,0,0]
    ur_script.start()
    ur_script.set_tcp(tool_angle_axis)
    ur_script.add_line("textmsg(\">> TASK {}.\")".format(pkey))
    # Initialize first movement (with accelleration)
    ur_script.socket_open(server_ip, server_port, "Feedbackserver")
    
    for key, RCS_frame in enumerate(RCS_frames):
        if key == 0:
            ur_script.move_linear(RCS_frame, robot_speed, 0.01)
            node_msg = {"TASK":pkey, "NODE":0}
            ur_script.socket_send_line_string(str(node_msg), socket_name="Feedbackserver")
        else:
            # Send all next frames of the layer (constant speed, no accelleration)
            ur_script.move_process(RCS_frame, robot_speed, 0.01)
            node_msg = {"TASK":pkey, "NODE":key}
            ur_script.socket_send_line_string(str(node_msg), socket_name="Feedbackserver")
    ur_script.socket_close(name="Feedbackserver")# BS: Closing socket at the end of the loop
    # Signify ready
    ur_script.socket_open(server_ip, server_port, "Feedbackserver")
    ur_script.socket_send_line_string(exit_message, socket_name="Feedbackserver")
    ur_script.socket_close(name="Feedbackserver")# BS: Closing socket at the end of the loop
    #Finalize script
    ur_script.end()
    ur_script.generate()
    return ur_script

if create:
    planes_x = ghtree_to_list(planes_x)[0]
    planes_y = ghtree_to_list(planes_y)[0]
    tasks_x = tasks_from_planes(planes_x)
    tasks_y = tasks_from_planes(planes_y, len(tasks_x))
    st["tasks"] = tasks_x + tasks_y

tasks = st["tasks"]
# ---------- end scantasks ----------

# ----
# PRINT TASKS
number_slider_3 = Slider(0.014, range=0..1)
printtasks = GhPythonScript(create=Button(), robot=robot, robot_speed=number_slider_3, server=feedbackserver, planes_data=python_6.planes_data)  # -> out, tasks; inputs planes_data: list
# ---------- printtasks: Python ----------
from scriptcontext import sticky as st
from ur_fabrication_control.direct_control.fabrication_process import URTask
from extruder_control.fabrication import EXTTask
from ur_fabrication_control.direct_control import URScript
from compas.geometry import Frame
from compas_ghpython.utilities import ghtree_to_list

ur_ip = st["ur_ip"]
ur_port = st["ur_port"]
server_ip = st["server_ip"]
server_port = st["server_port"]

def eval_data(data):
    tasks=[]
    datalist = []
    for item in data:
        if item == "extruder_on":
            tasks.append(urtask_from_data(datalist, len(tasks)))
            datalist = []
            exttask = EXTTask(key=len(tasks))
            exttask.add_function("send_set_do", 8, 1, True)
            exttask.add_function("send_motordata", 1, 24000, 1000, True)
            tasks.append(exttask)
        elif item == "extruder_off":
            tasks.append(urtask_from_data(datalist, len(tasks)))
            datalist = []
            exttask = EXTTask(key=len(tasks))
            exttask.add_function("send_motordata", 0, 24000, 1000, True)
#            exttask.add_function("send_set_do", 8, 0, True)
            tasks.append(exttask)
        elif len(datalist)>250:
            datalist.append(item)
            tasks.append(urtask_from_data(datalist, len(tasks)))
            datalist = []
        else:
            datalist.append(item)
    if len(datalist)>0:
        tasks.append(urtask_from_data(datalist, len(tasks)))
        datalist = []
        exttask = EXTTask(key=len(tasks))
        exttask.add_function("send_motordata", 0, 24000, 1000, True)
        exttask.add_function("send_set_do", 8, 0, True)
        tasks.append(exttask)
    return tasks

def urtask_from_data(data, key):
    planes = data
    req_msg = "Task_{}_Completed".format(key)
    urscript = urscript_from_data(planes, robot_speed, key, req_msg)
    new_task = URTask(server, urscript, req_msg, key)
    return new_task

def planes_to_frames(planes):
    return [Frame(plane.Origin, plane.XAxis, plane.YAxis) for plane in planes]

def get_frames_in_RCS(frames):
    return [robot.RCF_in_WCF.to_local_coordinates(frame) for frame in frames]

def urscript_from_data(planes, speed, pkey, exit_message):
    frames = planes_to_frames(planes)
    ur_script = URScript(ur_ip=ur_ip, ur_port=ur_port)
    tool_angle_axis = list(robot.attached_tool.frame.point) + list(robot.attached_tool.frame.axis_angle_vector)
    ur_script.start()
    ur_script.set_tcp(tool_angle_axis)
    RCS_frames = get_frames_in_RCS(frames)
    ur_script.add_line("textmsg(\">> TASK {}.\")".format(pkey))
    # Initialize first movement (with accelleration)
    ur_script.socket_open(server_ip, server_port, "Feedbackserver")
    
    for key, RCS_frame in enumerate(RCS_frames):
        if key == 0:
            ur_script.move_linear(RCS_frame, speed, 0.004)
            node_msg = {"TASK":pkey, "NODE":0}
            ur_script.socket_send_line_string(str(node_msg), socket_name="Feedbackserver")
        else:
            # Send all next frames of the layer (constant speed, no accelleration)
            ur_script.move_process(RCS_frame, speed, 0.004)
            node_msg = {"TASK":pkey, "NODE":key}
            ur_script.socket_send_line_string(str(node_msg), socket_name="Feedbackserver")
    ur_script.socket_close(name="Feedbackserver")# BS: Closing socket at the end of the loop
    # Signify ready
    ur_script.socket_open(server_ip, server_port, "Feedbackserver")
    ur_script.socket_send_line_string(exit_message, socket_name="Feedbackserver")
    ur_script.socket_close(name="Feedbackserver")# BS: Closing socket at the end of the loop
    #Finalize script
    ur_script.end()
    ur_script.generate()
    return ur_script

if create:
#    fabdata = [[planes_data[i], vels_data[i]] for i,p in enumerate(planes_data)]
    st["tasks"] = eval_data(planes_data)

tasks = st["tasks"]
print(tasks)
# ---------- end printtasks ----------

# ----
# CONTROL ENVIRONMENT
# FABRICATION MANAGER
# 3>
reset_fabrication = Button()
start_fabrication_2 = Button()
stop_fabrication_2 = Button()
reset_task = Button()
next_task = Button()
prev_task = Button()
set_tasks = Button()
init = Button()
fabricationmanager = PythonScript(
    server=feedbackserver,
    tasks=printtasks.tasks,
    init=init,
    parallelize=Toggle(False),
    set_tasks=set_tasks,
    start=start_fabrication_2,
    stop=stop_fabrication_2,
    reset=reset_fabrication,
    next_task=next_task,
    reset_task=reset_task,
    prev_task=prev_task)  # -> out, server; inputs tasks: list
# ---------- fabricationmanager: Python ----------
from scriptcontext import sticky as st
from fabrication_manager.fabrication import FabricationManager

if init:
    fabrication = FabricationManager(server)
    fabrication.parallelize = parallelize
    st["fabrication"] = fabrication

fabrication = st["fabrication"]

if set_tasks:
    print "setting tasks"    
    fabrication.clear_tasks()
    fabrication.set_tasks(tasks)

if start:
    #if robot.is_connected(): #and arduino.is_connected():
    print "starting process"
    fabrication.start()

if stop:
    print "stopping process"
    fabrication.stop()
    
if reset:
    print "resetting process"
    fabrication.reset()

if next_task:
    t = fabrication.get_next_task()
    task_state_set(True, t)
    
if reset_task:
    t = fabrication.get_next_task()
    task_state_set(False, t)

if prev_task:
    t = fabrication.get_next_task()
    task_state_set(False, t)
    t = fabrication.tasks[fabrication.current_task_key-1]
    task_state_set(False, t)
    fabrication.get_next_task()

def task_state_set(state, t):
    t.is_completed = state
    t.is_running = False

server = fabrication.server
# ---------- end fabricationmanager ----------

# ----
# FABRICATION STATE  VIEWER
fabrication_state = PythonScript(update=Toggle(True))  # -> out, state, num_tasks, num_current_task, num_tasks_left, log_messages
# ---------- fabrication_state: Python ----------
from scriptcontext import sticky as st
from compas_ghpython.utilities import update_component

fabrication = st["fabrication"]

if hasattr(fabrication, "fab_thread"):
    if fabrication.fab_thread.is_alive():
        state = "THREAD RUNNING"
    else:
        state = "THREAD STOPPED"
else:
    state = "THREAD NOT STARTED"

num_tasks = len(fabrication.tasks)
if fabrication.current_task_key is not None:
    num_current_task = fabrication.current_task_key
else:
    num_current_task = 0
num_tasks_left = num_tasks-num_current_task
log_messages = fabrication.log_messages

if update:
    update_component(ghenv, 1000)
# ---------- end fabrication_state ----------
state = Panel(fabrication_state.state)
num_tasks = Panel(fabrication_state.num_tasks)
num_current_task = Panel(fabrication_state.num_current_task)
log_messages = Panel(fabrication_state.log_messages)

# ----
# SERVER STATE  VIEWER
server_state = GhPythonScript(server=fabricationmanager.server)  # -> out, msgs, server_state, processing_state
# ---------- server_state: Python ----------
__author__ = "Gido"
__version__ = "2022.05.17"

import rhinoscriptsyntax as rs

msgs = server.msgs.values()
if hasattr(server, "server_thread"):
    if server.server_thread.is_alive():
        server_state = "RUNNING"
    else:
        server_state = "HALTED"
else:
    server_state = "NOT RUNNING"

if hasattr(server, "process_thread"):
    if server.process_thread.is_alive():
        processing_state = "RUNNING"
    else:
        processing_state = "HALTED"
else:
    processing_state = "NOT RUNNING"
# ---------- end server_state ----------
server_state_2 = Panel(server_state.server_state)
processing_state = Panel(server_state.processing_state)
server_messages = Panel(server_state.msgs)

num_tasks_left = Panel(fabrication_state.num_tasks_left)
