# Grasshopper definition pointcloud_edge_2021Jul23d.gh (Grasshopper 1.0.7)

geo = Geometry([Point(240.751461, 17.57677819, -116.9775283), Point(245.5087334, 7.240826541, -110.8754302), Point(-29.88623129, 10.81737026, -116.1925193), Point(-33.8528726, 24.94482805, -110.8721225), Point(-38.96627833, 20.07926965, -73.84103002), Point(6.624453643, 49.09648257, -93.69312752)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])
project = Project(Geometry=geo, Plane=PlaneXY(0, 0, 0))  # -> Geometry, Transform

del = DelaunayMesh(Points=project.Geometry, Plane=PlaneXY(0, 0, 0))
demesh = DeconstructMesh(Mesh=del)  # -> Vertices, Faces, Colours, Normals
deface = DeconstructFace(Face=demesh.Faces)  # -> CornerA, CornerB, CornerC, CornerD
entwine = Entwine(Branch00=deface.CornerA, Branch01=deface.CornerB, Branch02=deface.CornerC, FlattenInputs=True)
flip = FlipMatrix(Data=entwine)
item = ListItem(List=demesh.Vertices, Index=flip, Wrap=True)
pline = PolyLine(Vertices=item, Closed=invert(False))
explode = Explode(Curve=pline, Recursive=True)  # -> Segments, Vertices
len = Length(Curve=explode.Segments)
edge_l = Slider(65.291, range=0..100)
ma = MassAddition(Input=len)  # -> flatten(Result), PartialResults
smaller = SmallerThan(FirstNumber=ma.Result, SecondNumber=edge_l)  # -> SmallerThan, OrEqualTo

# ---- group: mesh
cullf = CullFaces(Mesh=del, Pattern=invert(smaller.SmallerThan))

# ----
medges = MeshEdges(Mesh=cullf)  # -> NakedEdges, InteriorEdges, NonManifoldEdges
edge_l_2 = Slider(4.431, range=0..20)

# ---- group: boundary
join = JoinCurves(Curves=medges.NakedEdges, Preserve=False)

# ----
pull = PullPoint(Point=project.Geometry, Geometry=join, ClosestOnly=True)  # -> ClosestPoint, Distance
smaller_2 = SmallerThan(FirstNumber=pull.Distance, SecondNumber=edge_l_2)  # -> SmallerThan, OrEqualTo
dispatch = Dispatch(List=geo, DispatchPattern=smaller_2.SmallerThan)  # -> ListA, ListB
pt = Point(dispatch.ListB)
preview = CustomPreview(Geometry=dispatch.ListA, Material=ColourSwatch(SwatchColor=RGB(255, 255, 255)))

alongcrv = SortAlongCurve(Points=dispatch.ListA, Curve=join)  # -> Points, Indices
lng = ListLength(List=alongcrv.Points)
series = Series(Start=0, Step=1, Count=lng)
addition = Addition(A=series, B=Slider(4, range=0..10))
dom = ConstructDomain(DomainStart=series, DomainEnd=addition)
subset = SubList(List=alongcrv.Points, Domain=dom, Wrap=True)  # -> List, Index
pdecon = Deconstruct(Point=subset.List)  # -> XComponent, YComponent, ZComponent
sort = SortList(Keys=pdecon.ZComponent, ValuesA=subset.List)  # -> Keys, reverse(ValuesA)
item_2 = ListItem(List=sort.ValuesA, Index=0, Wrap=True)
cullpt = CullDuplicates(Points=flatten(item_2), Tolerance=0.1, CullMode=3)  # -> Points, Indices, Valence
intcrv = Interpolate(Vertices=cullpt.Points, Degree=3, Periodic=invert(False), KnotStyle=1)  # -> Curve, Length, Domain
preview_2 = CustomPreview(Geometry=[cullpt.Points, intcrv.Curve], Material=ColourSwatch(SwatchColor=RGB(111, 255, 255)))

min_d = Slider(2.14, range=0..5)
crv_cp = CurveClosestPoint(Point=alongcrv.Points, Curve=intcrv.Curve)  # -> Point, Parameter, Distance
smaller_3 = SmallerThan(FirstNumber=crv_cp.Distance, SecondNumber=min_d)  # -> SmallerThan, OrEqualTo
cull = CullPattern(List=alongcrv.Points, CullPattern=smaller_3.SmallerThan)
nurbs = NurbsCurve(Vertices=cull, Degree=3, Periodic=invert(False))  # -> Curve, Length, Domain
preview_3 = CustomPreview(Geometry=[cull, nurbs.Curve], Material=ColourSwatch(SwatchColor=RGB(255, 255, 0)))

patch = Patch(Curves=nurbs.Curve, Points=geo, Spans=Slider(21, range=0..60), Flexibility=Slider(8.709, range=0..60), Trim=True)
