# Grasshopper definition printingpath.gh (Grasshopper 1.0.7)

brep = Brep(<brep referenced from the Rhino model>)
crv = Curve([<curve referenced from the Rhino model> x28])
xy = XYPlane(Origin=Point(0, 0, 0))
offset = OffsetCurve(Curve=crv, Distance=Slider(-3, range=-5..5), Plane=xy, Corners=1)
crv_2 = Curve(offset)
